# Grasshopper definition sim_gen_1.3.0.gh (Grasshopper 1.0.7)
# plug-ins: Human, MetaHopper, Pufferfish, PTComponentLibrary, LunchBox

banim = BatchAnimator()
bslider = BatchSlider(Steps=5)
# creates python list of all possible cominations then sends to ‘parameters’ component
parameter_generator = GhPythonScript()  # -> out, param
# ---------- parameter_generator: Python ----------
__author__ = "tmendeze, ppape"

import rhinoscriptsyntax as rs

sizes           = [0, 1, 2]
orientation     = [1, 2, 3, 4] #orientation of existing dwelling to dadu
wwr             = [10, 20, 30, 40, 50, 60]
assemblies      = [0, 1, 2, 3, 4, 5] #cut down to half? or 3?
infiltration    = [0, 1]
sites           = [0, 1, 2, 3] #four site combinations **tie floor area to site
#0:infill alley
#1:infill no alley
#2:corner alley
#3:corner no alley
# model all site ideas for next week
setbacks        = [0, 1] #use existing, consult rick for options to test
stories         = [1, 2] #one or two stories - currently adiabatic
units           = [1, 2]

#run two sims 40% on one facade (on each direction) vs 40% on all facades. keep glazing area equivalent
#test adiabatic vs nonadiabatic roof impact (1 vs 2 stories)
#test 4 different sizes/volumes to see impact of non-adiabtic surface-volume ratios
#test impact of shading on energy
#include these impacts in thesis, document as i go

param = []
for s in sizes:
    for o in orientation:
        for w in wwr:
            for a in assemblies:
                for i in infiltration:
                    for si in sites:
                        for sb in setbacks:
                            for st in stories:
                                for u in units:
                                    param.append([s, o, w, a, i, si, sb, st, u])
print(len(param))
#print(param)
# ---------- end parameter_generator ----------
panel = Panel("C:\Users\papep\Documents\GitHub\msdc-thesis\!tool\temp")
number_slider = Slider(0, range=0..9999)
# animate 1x1 for i number of frames, make sure run energy sim = true
number_slider_2 = Slider(10000, range=10000..19999)
batchdriver = BatchDriver()  # -> Path, ValuesA
number_slider_3 = Slider(17365, range=0..27648)
number_slider_4 = Slider(11336, range=0..20000)
number_slider_5 = Slider(6336, range=0..10000)
number_slider_6 = Slider(6, range=0..10)
number_slider_7 = Slider(1, range=0..10)
panel_2 = Panel("""0
15""")
panel_3 = Panel("""0
25""")
# !add to parameters component:
# - site type (0,1,2,3 [infill vs corner and alley vs no alley, including context geo)
# - rotation on lot
# - setback options
# - FAR impact on max size
# - orientation of existing house to DADU
panel_4 = Panel(parameter_generator.out)
line = Line(Line((0, 0, 0), (0.08333333333, 0, 0)))
line_2 = Line(Line((0, 0, 0), (0, 0.08333333333, 0)))
pt = Point(Point(0, 0, 0))
connected = GetConnectedObjects(Objects=number_slider_3)
make_grid = GhPythonScript(
    sp=pt,
    span_x=panel_2,
    span_y=panel_3,
    xaxis=line,
    yaxis=line_2,
    height=Slider(10, range=0..10),
    core=[Slider(0, range=0..10), Slider(0, range=0..10)])  # -> out, columns, beams_x, beams_y, cores; inputs span_x: list, span_y: list, core: list of Int32
# ---------- make_grid: Python ----------
import rhinoscriptsyntax as rs

from studio2021.functions import make_grid
reload(make_grid)
from studio2021.functions.make_grid import make_grid_structure


columns, beams_x, beams_y, cores = make_grid_structure(sp,
                                                       span_x,
                                                       span_y,
                                                       xaxis,
                                                       yaxis,
                                                       height,
                                                       core)
# ---------- end make_grid ----------
parameters = GhPythonScript(param=parameter_generator.param, i=number_slider_3)  # -> out, orientation, shading, wwr, glazing, shgc, ext_ins_mat, ext_ins_t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; inputs param: list, i: Int32
# ---------- parameters: Python ----------
__author__ = "tmendeze, ppape"


assemblies = {
    0: {'frame':'2x4 Wood Studs',  'cellulose':0.00, 'polyiso':1.},
    1: {'frame':'2x4 Wood Studs',  'cellulose':3.50, 'polyiso':0.},
    2: {'frame':'2x6 Wood Studs',  'cellulose':5.50, 'polyiso':0.},
    3: {'frame':'2x8 Wood Studs',  'cellulose':7.25, 'polyiso':0.},
    4: {'frame':'2x10 Wood Studs', 'cellulose':9.25, 'polyiso':0.},
    5: {'frame':'2x10 Wood Studs', 'cellulose':9.25, 'polyiso':1.}}

setbackd = {
    0:{
        0: {'rear':0, 'side':5, 'structure':5},  #existing infill/alley
        1: {'rear':5, 'side':5, 'structure':5},  #existing infill/no alley
        2: {'rear':0, 'side':5, 'structure':5},  #existing corner/alley - ***HOW DOES THIS WORK?***
        3: {'rear':5, 'side':5, 'structure':5}}, #existing corner/no alley
    1:{
        0: {'rear':0, 'side':5, 'structure':5},  #potential infill/alley
        1: {'rear':0, 'side':5, 'structure':5},  #potential infill/no alley
        2: {'rear':0, 'side':5, 'structure':5},  #potential corner/alley
        3: {'rear':0, 'side':5, 'structure':5}}} #potential corner/no alley

#assemblies = {
#    0: {'frame':'2x4 Wood Studs',  'cellulose':0.00, 'polyiso':0.},
#    1: {'frame':'2x4 Wood Studs',  'cellulose':0.00, 'polyiso':0.5},
#    2: {'frame':'2x4 Wood Studs',  'cellulose':0.00, 'polyiso':1.},
#    3: {'frame':'2x4 Wood Studs',  'cellulose':3.50, 'polyiso':0.},
#    4: {'frame':'2x6 Wood Studs',  'cellulose':5.50, 'polyiso':0.},
#    5: {'frame':'2x8 Wood Studs',  'cellulose':7.25, 'polyiso':0.},
#    6: {'frame':'2x10 Wood Studs', 'cellulose':9.25, 'polyiso':0.},
#    7: {'frame':'2x10 Wood Studs', 'cellulose':9.25, 'polyiso':1.},
#    8: {'frame':'2x10 Wood Studs', 'cellulose':9.25, 'polyiso':2.},
#    9: {'frame':'2x10 Wood Studs', 'cellulose':9.25, 'polyiso':3.},
#    10:{'frame':'2x10 Wood Studs', 'cellulose':9.25, 'polyiso':4.},
#    11:{'frame':'2x10 Wood Studs', 'cellulose':9.25, 'polyiso':5.}}

infd = {0:.00059, 1:.00015} #cu-m (air)/s*m^2(facade)
dadu_sizes = {
    1:{
        0:200, 1:400, 2: 600},
    2:{
        0:600, 1:800, 2:1000}}

p = param[i]


orientation     = p[1]
wwr             = p[2] / 100.
assembly        = assemblies[p[3]]
inf_rate        = infd[p[4]]
site            = p[5]
setbacks        = p[6]
num_stories     = p[7]
size            = dadu_sizes[num_stories][p[0]]
num_dadus       = p[8]

if num_stories == 1:
    height = 10
    footprint = size
else:
    height = 20
    footprint = size / 2.

shading         = 0
glazing         = 'Aluminum Double'
shgc            = .25
ext_ins_mat     = 'Polyiso'
ext_ins_t       = assembly['polyiso']
int_ins_mat     = 'Cellulose'
int_ins_t       = assembly['cellulose']
frame           = assembly['frame']

setback         = setbackd[setbacks][site]
rear_setback    = setback['rear']
side_setback    = setback['side']
structure_setback = setback['structure']


odict = {1:'n', 2:'s', 3:'e', 4:'w'}

filename = '{}_'.format(odict[orientation])
for n in p[2:-1]:
    filename += str(n) +'_'
filename = filename[:-1]

print 'size', size
print 'orientation', odict[orientation]
print 'wwr', wwr 
print 'assembly', assemblies[p[4]], assembly 
print 'inf_rate', inf_rate
print 'site', site
print 'setback', setbacks
print 'rear_setback', rear_setback
print 'side_setback', side_setback
print 'structure_setback', structure_setback
print 'num_stories', num_stories
print 'num_dadus', num_dadus
# ---------- end parameters ----------

# ----
# Simulation Inputs
# Simulation Folder Name:
# Simulation Name:
# .sql Filepath:
path = GhPythonScript()  # -> out, path
# ---------- path: Python ----------
__author__ = "tmendeze"


import studio2021

path = studio2021.TEMP
# ---------- end path ----------
panel_5 = Panel(parameters.filename)
csv_path = GhPythonScript(path=panel, sim_name=parameters.filename)  # -> out, sql_path
# ---------- csv_path: Python ----------
__author__ = "tmendeze"
__version__ = "2021.03.02"

import rhinoscriptsyntax as rs
import os
sql = os.path.join('OpenStudio','run','eplusout.sql')
sql_path = os.path.join(path, sim_name, sql)
# ---------- end csv_path ----------
panel_6 = Panel(path.path)
panel_7 = Panel(csv_path.sql_path)

# ----
# reads parameter comination from generator then sends specified comination of data to black box component to simulate
cities = GhPythonScript(city=0)  # -> out, city, weather_file, kgCo2e_kwh
# ---------- cities: Python ----------
__author__ = "tmendeze"

import rhinoscriptsyntax as rs

from studio2021.functions import city_carbon
reload(city_carbon)
from studio2021.functions.city_carbon import city_EUI
from studio2021.functions.city_carbon import weather

cities = {0: 'Seattle'}

city = cities[city]
kgCo2e_kwh = city_EUI(city)['kg/kWh']
weather_file = weather(city)
# ---------- end cities ----------
set_slider = SetSliderProperties(Slider=connected, Range=panel_4)
crv = Curve([<curve referenced from the Rhino model> x4])
panel_9 = Panel(cities.city)
num_floors_above = Slider(0, range=0..10)
trim_grid = GhPythonScript(polyline=crv, columns=make_grid.columns, beams_x=make_grid.beams_x, beams_y=make_grid.beams_y, cores=make_grid.cores)  # -> out, columns, beams_x, beams_y, cores; inputs polyline: list, columns: list, beams_x: list, beams_y: list, cores: list
# ---------- trim_grid: Python ----------
import rhinoscriptsyntax as rs

from studio2021.functions import make_grid
reload(make_grid)
from studio2021.functions.make_grid import trim_structure


columns, beams_x, beams_y, cores = trim_structure(polyline,
                                                  columns,
                                                  beams_x,
                                                  beams_y,
                                                  cores)
# ---------- end trim_grid ----------
office_20_glazing = Brep([<brep referenced from the Rhino model> x8])
office_40_glazing = Brep([<brep referenced from the Rhino model> x16])
office_60_glazing = Brep([<brep referenced from the Rhino model> x24])
office_80_glazing = Brep([<brep referenced from the Rhino model> x31])
outsidecrvfromrhino = Curve(<curve referenced from the Rhino model>)
adiabaticcrvfromrhino = Curve([<curve referenced from the Rhino model> x3])
panel_10 = Panel(parameters.out)
building_type = ValueList({"Type 3", "Type 4A", "Type 4B", "Type 4C", "Type 5"}, selected="Type 4A")
composite_slab = BooleanToggle(False)
columns = Curve(trim_grid.columns)
beams_x = Curve(trim_grid.beams_x)
beams_y = Curve(trim_grid.beams_y)
cores = Curve(trim_grid.cores)
filter = StreamFilter(Gate=0, Stream0=office_20_glazing, Stream1=office_40_glazing, Stream2=office_60_glazing, Stream3=office_80_glazing)

# ----
# Simulation Outputs
# Output Folder Name:
csv_path_2 = GhPythonScript(path=panel, sim_name=parameters.filename)  # -> out, csv_path
# ---------- csv_path_2: Python ----------
__author__ = "tmendeze"
__version__ = "2021.03.02"

import rhinoscriptsyntax as rs
import os
csv_path = os.path.join(path, sim_name+".csv")
# ---------- end csv_path_2 ----------
panel_11 = Panel(csv_path_2.csv_path)

# ----
# Run Energy
# Simulation
run_energy_simulation = BooleanToggle(False)

filter_2 = StreamFilter(
    Gate=parameters.orientation,
    Stream1=Slider(180, range=0..1000),
    Stream2=Slider(0, range=0..100),
    Stream3=Slider(90, range=0..100),
    Stream4=Slider(270, range=0..1000))
panel_12 = Panel(trim_grid.out)
core = Curve(flatten(cores))
columns_2 = Curve(flatten(columns))
beams_x_2 = Curve(flatten(beams_x))
beams_y_2 = Curve(flatten(beams_y))
rad = Radians(Degrees=filter_2)
check_previous = GhPythonScript(filename=parameters.filename, run=run_energy_simulation)  # -> out, run
# ---------- check_previous: Python ----------
__author__ = "tmendeze"

import rhinoscriptsyntax as rs

import studio2021
import os


files = []
for f in os.listdir(os.path.join(studio2021.TEMP)):#change dir
    if f.endswith('.csv'):
        files.append(f)

fn = filename + '.csv'

if fn in files:
    run = False
# ---------- end check_previous ----------
rear_setback = Number(parameters.rear_setback)
side_setback = Number(parameters.side_setback)
structure_setback = Number(parameters.structure_setback)
rotate = Rotate(Geometry=filter, Angle=rad, Plane=PlaneXY(0, 0, 0))  # -> Geometry, Transform
area = Area(Geometry=filter)  # -> Area, Centroid
subtraction = Subtraction(B=1)
ma = MassAddition(Input=area.Area)  # -> Result, PartialResults
item = ListItem(List=area.Area, Index=0, Wrap=True)
panel_13 = Panel(check_previous.out)
division = Division(A=item, B=subtraction)

# ---- group: site
pipeline = GeometryPipeline(
    GroupByLayer=False,
    GroupByType=False,
    IncludeHidden=True,
    IncludeLocked=True,
    LayerFilter="sites::1-infill_no-alley::existing",
    NameFilter="*",
    SublayerFiltering=True,
    TypeFilter=1073741848)
pipeline_2 = GeometryPipeline(
    GroupByLayer=False,
    GroupByType=False,
    IncludeHidden=True,
    IncludeLocked=True,
    LayerFilter="sites::3-corner_no-alley::context",
    NameFilter="*",
    SublayerFiltering=True,
    TypeFilter=1073741848)
pipeline_3 = GeometryPipeline(
    GroupByLayer=False,
    GroupByType=False,
    IncludeHidden=True,
    IncludeLocked=True,
    LayerFilter="sites::1-infill_no-alley::lot_line",
    NameFilter="*",
    SublayerFiltering=True,
    TypeFilter=4)
pipeline_4 = GeometryPipeline(
    GroupByLayer=False,
    GroupByType=False,
    IncludeHidden=True,
    IncludeLocked=True,
    LayerFilter="sites::1-infill_no-alley::context",
    NameFilter="*",
    SublayerFiltering=True,
    TypeFilter=1073741848)
pipeline_5 = GeometryPipeline(
    GroupByLayer=False,
    GroupByType=False,
    IncludeHidden=True,
    IncludeLocked=True,
    LayerFilter="sites::3-corner_no-alley::existing",
    NameFilter="*",
    SublayerFiltering=True,
    TypeFilter=1073741848)
pipeline_6 = GeometryPipeline(
    GroupByLayer=False,
    GroupByType=False,
    IncludeHidden=True,
    IncludeLocked=True,
    LayerFilter="sites::3-corner_no-alley::lot_line",
    NameFilter="*",
    SublayerFiltering=True,
    TypeFilter=4)
pipeline_7 = GeometryPipeline(
    GroupByLayer=False,
    GroupByType=False,
    IncludeHidden=True,
    IncludeLocked=True,
    LayerFilter="sites::0-infill_alley::existing",
    NameFilter="*",
    SublayerFiltering=True,
    TypeFilter=1073741848)
pipeline_8 = GeometryPipeline(
    GroupByLayer=False,
    GroupByType=False,
    IncludeHidden=True,
    IncludeLocked=True,
    LayerFilter="sites::2-corner_alley::existing",
    NameFilter="*",
    SublayerFiltering=True,
    TypeFilter=1073741848)
pipeline_9 = GeometryPipeline(
    GroupByLayer=False,
    GroupByType=False,
    IncludeHidden=True,
    IncludeLocked=True,
    LayerFilter="sites::0-infill_alley::lot_line",
    NameFilter="*",
    SublayerFiltering=True,
    TypeFilter=4)
pipeline_10 = GeometryPipeline(
    GroupByLayer=False,
    GroupByType=False,
    IncludeHidden=True,
    IncludeLocked=True,
    LayerFilter="sites::2-corner_alley::lot_line",
    NameFilter="*",
    SublayerFiltering=True,
    TypeFilter=4)
pipeline_11 = GeometryPipeline(
    GroupByLayer=False,
    GroupByType=False,
    IncludeHidden=True,
    IncludeLocked=True,
    LayerFilter="sites::0-infill_alley::context",
    NameFilter="*",
    SublayerFiltering=True,
    TypeFilter=1073741848)
pipeline_12 = GeometryPipeline(
    GroupByLayer=False,
    GroupByType=False,
    IncludeHidden=True,
    IncludeLocked=True,
    LayerFilter="sites::2-corner_alley::context",
    NameFilter="*",
    SublayerFiltering=True,
    TypeFilter=1073741848)
entwine = Entwine(Branch00=pipeline_2, Branch01=pipeline_6, Branch02=pipeline_5, FlattenInputs=True)
entwine_2 = Entwine(Branch00=pipeline_12, Branch01=pipeline_10, Branch02=pipeline_8, FlattenInputs=True)
entwine_3 = Entwine(Branch00=pipeline_11, Branch01=pipeline_9, Branch02=pipeline_7, FlattenInputs=True)
entwine_4 = Entwine(Branch00=pipeline_4, Branch01=pipeline_3, Branch02=pipeline, FlattenInputs=True)
filter_3 = StreamFilter(Gate=parameters.site, Stream0=entwine_3, Stream1=entwine_4, Stream2=entwine_2, Stream3=entwine)
panel_14 = Panel(filter_3)
bang = ExplodeTree(Data=filter_3)  # -> Branch0, Branch1, Branch2
entwine_5 = Entwine(Branch00=bang.Branch0, Branch01=bang.Branch2, FlattenInputs=True)  # -> flatten(Result)

# ---- group: buildable area on lot
explode = Explode(Curve=bang.Branch1, Recursive=True)  # -> Segments, Vertices
item_2 = ListItem(List=explode.Segments, Index=Slider(0, range=0..3), Wrap=True)
midpt = CurveMiddle(Curve=item_2)
brep_cp = BrepClosestPoint(Point=midpt, Brep=bang.Branch2)  # -> Point, Normal, Distance
dist = Distance(PointA=brep_cp.Point, PointB=midpt)
item_3 = ListItem(List=explode.Segments, Index=Slider(1, range=0..3), Wrap=True)
item_4 = ListItem(List=explode.Segments, Index=Slider(3, range=0..3), Wrap=True)
subtraction_2 = Subtraction(A=dist, B=structure_setback)
X = UnitX(Factor=side_setback)  # -> expr("-x", UnitVector)
X_2 = UnitX(Factor=side_setback)
Y = UnitY(Factor=subtraction_2)
Y_2 = UnitY(Factor=rear_setback)
move = Move(Geometry=item_2, Motion=Y)  # -> Geometry, Transform
move_2 = Move(Geometry=item_4, Motion=X_2)  # -> Geometry, Transform
move_3 = Move(Geometry=item_3, Motion=X)  # -> Geometry, Transform
move_4 = Move(Geometry=item_2, Motion=Y_2)  # -> Geometry, Transform
ptuvcrvs = IntersectCurves(CU=[move_2.Geometry, move.Geometry], CV=[move_3.Geometry, move_4.Geometry])  # -> flatten(Grid)
panel_15 = Panel(ptuvcrvs)
item_5 = ListItem(List=flatten(ptuvcrvs), Index=Slider(2, range=0..4), Wrap=True)
item_6 = ListItem(List=flatten(ptuvcrvs), Index=Slider(1, range=0..4), Wrap=True)
rec_2pt = Rectangle2Pt(Plane=PlaneXY(0, 0, 0), PointA=item_5, PointB=item_6, Radius=0)  # -> Rectangle, Length
area_2 = Area(Geometry=rec_2pt.Rectangle)  # -> Area, Centroid
explode_2 = Explode(Curve=rec_2pt.Rectangle, Recursive=True)  # -> Segments, Vertices
panel_16 = Panel(rec_2pt.Rectangle)
panel_17 = Panel(area_2.Area)
item_7 = ListItem(List=explode_2.Segments, Index=Slider(0, range=0..3), Wrap=True)
item_8 = ListItem(List=explode_2.Segments, Index=Slider(1, range=0..3), Wrap=True)
len = Length(Curve=item_7)
len_2 = Length(Curve=item_8)
division_2 = Division(A=len, B=len_2)

# ----
division_3 = Division(A=ma.Result, B=subtraction)
division_4 = Division(A=ma.Result, B=division)
panel_18 = Panel(division_3)
panel_19 = Panel(division_4)
total_shade_len = GhPythonScript(orientation=parameters.orientation, vertical=division_4, horizontal=division_3)  # -> out, tsl
# ---------- total_shade_len: Python ----------
__author__ = "tmendeze"

import rhinoscriptsyntax as rs

North = 1
South = 2
East  = 3
West  = 4

if not horizontal:
    horizontal = 0
if not vertical:
    vertical = 0

if orientation == 1:
    tsl = 0
elif orientation == 2:
    tsl = horizontal
elif orientation == 3 or orientation == 4:
    tsl = vertical
# ---------- end total_shade_len ----------

# ---- group: zone_program
bldgprograms = HBBuildingPrograms({"LargeOffice", "MediumOffice", "SmallOffice", "MidriseApartment", "HighriseApartment", "Retail", "StripMall", "PrimarySchool", "SecondarySchool", "SmallHotel", "LargeHotel", "Hospital", "Outpatient", "Laboratory", "Warehouse", "SuperMarket", "FullServiceRestaurant", "QuickServiceRestaurant", "Courthouse", "LargeDataCenterHighITE", "LargeDataCenterLowITE", "SmallDataCenterHighITE", "SmallDataCenterLowITE"}, selected="MidriseApartment")
searchprog = HBSearchPrograms(bldg_prog=bldgprograms, keywords="Apartment")  # -> room_prog; plug-in component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
list = ItemSelector(searchprog, {"2019::MidriseApartment::Apartment"}, selected="2019::MidriseApartment::Apartment")

# ---- group: floor + ceiling construction
searchmats = HBSearchMaterials(keywords="air")  # -> opaque_mats, window_mats; plug-in component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
searchmats_2 = HBSearchMaterials(keywords="carpet")  # -> opaque_mats, window_mats; plug-in component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
searchmats_3 = HBSearchMaterials(keywords="gypsum")  # -> opaque_mats, window_mats; plug-in component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
list_2 = ItemSelector(
    searchmats_3.opaque_mats,
    {"1/2 in. Gypsum Board", "1/2IN Gypsum", "5/8 in. Gypsum Board", "G01 13mm gypsum board", "G01a 19mm gypsum board", "Generic Gypsum Board", "Gypsum Board - 1/2 in. CBES", "Gypsum Or Plaster Board - 3/8 in.", "NACM_Gypsum Board 5/8in"}, selected="1/2 in. Gypsum Board")
list_3 = ItemSelector(
    searchmats.opaque_mats,
    {"F04 Wall air space resistance", "F05 Ceiling air space resistance", "Generic Ceiling Air Gap", "Generic Wall Air Gap", "Typical Air Wall"}, selected="F04 Wall air space resistance")
list_4 = ItemSelector(
    searchmats_2.opaque_mats,
    {"CP02 CARPET PAD", "Carpet - 3/4 in. CBES", "NACM_Carpet 3/4in", "Typical Carpet Pad"}, selected="CP02 CARPET PAD")
opaqueconstr = HBOpaqueConstruction(name="Ceiling_Residential", materials=[list_3, list_2])  # -> constr; plug-in component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
opaqueconstr_2 = HBOpaqueConstruction(name="Floor_Residential", materials=[list_3, list_4])  # -> constr; plug-in component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

# ---- group: znames
entwine_6 = Entwine(Branch00="zone1", Branch01="zone2", FlattenInputs=True)
filter_4 = StreamFilter(Gate=parameters.num_stories, Stream1="zone1", Stream2=entwine_6)

# ---- group: height
filter_5 = StreamFilter(Gate=parameters.num_stories, Stream1=Slider(10, range=0..10), Stream2=Slider(20, range=0..100))

# ----
panel_20 = Panel([filter_4, filter_5])
Z = UnitZ(Factor=parameters.height)

# ---- group: generate massing by area and stories
consarearec = ConstrainedAreaRectangle(Plane=PlaneXY(0, 0, 0), Area=parameters.footprint, FactorX=division_2, FactorY=Slider(1, range=0..1))  # -> Rectangle, DimensionX, DimensionY
area_3 = Area(Geometry=consarearec.Rectangle)  # -> Area, Centroid
move2pt = MoveToPoint(Geometry=consarearec.Rectangle, PointA=area_3.Centroid, PointB=area_2.Centroid)  # -> Moved, Vector, Transform
panel_21 = Panel(area_3.Area)
debrep = DeconstructBrep(Brep=move2pt.Moved)  # -> Faces, Edges, Vertices
boundary = BoundarySurfaces(FloorCrvs=debrep.Edges)  # -> simplify(Surfaces)
division_5 = Division(A=parameters.height, B=Slider(2, range=0..10))
filter_6 = StreamFilter(Gate=parameters.num_stories, Stream1=parameters.height, Stream2=division_5)
Z_2 = UnitZ(Factor=filter_6)
extr = Extrude(Base=boundary, Direction=Z_2)
move_5 = Move(Geometry=extr, Motion=Z_2)  # -> Geometry, Transform

# ----
extr_2 = Extrude(Base=boundary, Direction=Z)
debrep_2 = DeconstructBrep(Brep=extr_2)  # -> simplify(Faces), Edges, Vertices
debrep_3 = DeconstructBrep(Brep=debrep_2.Faces)  # -> Faces, Edges, Vertices
pdecon = Deconstruct(Point=debrep_3.Vertices)  # -> XComponent, YComponent, ZComponent
ma_2 = MassAddition(Input=pdecon.ZComponent)  # -> Result, PartialResults
multiplication = Multiplication(A=parameters.height, B=Slider(4, range=0..10))
equals = Equality(FirstNumber=ma_2.Result, SecondNumber=Slider(0, range=0..100))  # -> Equality, Inequality
equals_2 = Equality(FirstNumber=multiplication, SecondNumber=ma_2.Result)  # -> Equality, Inequality
and = GateAnd(A=equals_2.Inequality, B=equals.Inequality)
cull = CullPattern(List=debrep_3.Faces, CullPattern=equals_2.Equality)  # -> simplify(flatten(List))
cull_2 = CullPattern(List=debrep_3.Faces, CullPattern=and)  # -> simplify(flatten(List))
cull_3 = CullPattern(List=debrep_3.Faces, CullPattern=equals.Equality)  # -> simplify(flatten(List))
number_slider_8 = Slider(0.5, range=0..1)
num_stories = Number(parameters.num_stories)
scale_nu = ScaleNU(Geometry=cull_2, Plane=PlaneXY(0, 0, 0), ScaleX=1, ScaleY=1, ScaleZ=number_slider_8)  # -> Geometry, Transform
multiplication_2 = Multiplication(A=parameters.height, B=number_slider_8)
item_9 = ListItem(List=cull_2, Index=Slider(0, range=0..3), Wrap=True)
item_10 = ListItem(List=cull_2, Index=Slider(2, range=0..3), Wrap=True)
item_11 = ListItem(List=cull_2, Index=Slider(1, range=0..3), Wrap=True)
item_12 = ListItem(List=cull_2, Index=Slider(3, range=0..3), Wrap=True)
filter_7 = StreamFilter(Gate=num_stories, Stream1=extr, Stream2=[move_5.Geometry, extr])
Z_3 = UnitZ(Factor=multiplication_2)
debrep_4 = DeconstructBrep(Brep=item_11)  # -> Faces, Edges, Vertices
debrep_5 = DeconstructBrep(Brep=item_12)  # -> Faces, Edges, Vertices
debrep_6 = DeconstructBrep(Brep=item_10)  # -> Faces, Edges, Vertices
debrep_7 = DeconstructBrep(Brep=item_9)  # -> Faces, Edges, Vertices
debrep_8 = DeconstructBrep(Brep=cull)  # -> Faces, Edges, Vertices
debrep_9 = DeconstructBrep(Brep=cull_3)  # -> Faces, Edges, Vertices
move_6 = Move(Geometry=scale_nu.Geometry, Motion=Z_3)  # -> Geometry, Transform
roomsolid = HBRoomFromSolid(geo=flatten(filter_7), name=filter_4, program=list, conditioned=True)  # -> report, rooms; plug-in component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
join = JoinCurves(Curves=debrep_4.Edges, Preserve=False)
join_2 = JoinCurves(Curves=debrep_5.Edges, Preserve=False)
join_3 = JoinCurves(Curves=debrep_6.Edges, Preserve=False)
join_4 = JoinCurves(Curves=debrep_7.Edges, Preserve=False)
join_5 = JoinCurves(Curves=debrep_8.Edges, Preserve=False)
join_6 = JoinCurves(Curves=debrep_9.Edges, Preserve=False)
flatten = FlattenTree(Tree=roomsolid.rooms, Path="{0}")
panel_22 = Panel(roomsolid.rooms)
filter_8 = StreamFilter(Gate=parameters.num_stories, Stream1=cull_2, Stream2=[scale_nu.Geometry, move_6.Geometry])
item_13 = ListItem(List=flatten, Index=0, Wrap=True)
item_14 = ListItem(List=flatten, Index=Slider(3, range=0..10), Wrap=True)
filter_9 = StreamFilter(Gate=num_stories, Stream1=roomsolid.rooms, Stream2=[item_14, item_13])
aperturesbyratio = HBAperturesByRatio(hb_objs=flatten(filter_9), ratio=parameters.wwr)  # -> report, hb_objs; plug-in component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
# create one csv/text file for each sim
# 
# then combine(in case of crash)
# 
# can add column "num_adiabatic": all 0 to make compatible with future datasets
csv = CreateCSV(Delimiter=",")
python = GhPythonScript()  # -> Out, A
toggle = BooleanToggle(True)
facade_cladding = ValueList({"Brick", "Fiber Cement", "Steel Panel", "Aluminum Panel": "Aluminum"}, selected="Aluminum Panel")
solveadj = HBSolveAdjacency(rooms=flatten(aperturesbyratio.hb_objs), adiabatic=toggle, run=toggle)  # -> report, adj_rooms; plug-in component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
panel_23 = Panel(csv)
interior_finish = ValueList({"Gyp", "None"}, selected="Gyp")
building = GhPythonScript(
    city=cities.city,
    znames=filter_4,
    wwr=parameters.wwr,
    height=filter_5,
    floor_surfaces=join_6,
    ceiling_surfaces=join_5,
    facade_cladding=facade_cladding,
    external_insulation=parameters.ext_ins_mat,
    insulation_thickness=parameters.ext_ins_t,
    interior_insul_mat=parameters.int_ins_mat,
    int_ins_thickness=parameters.int_ins_t,
    ewall_framing=parameters.frame,
    int_finish=interior_finish,
    glazing_system=parameters.glazing,
    simulation_name=parameters.filename,
    zone_program=list,
    weather_file=cities.weather_file,
    csv=panel_11,
    sql_path=panel_7,
    simulation_folder=panel,
    run_simulation=check_previous.run,
    columns=columns_2,
    beams_x=beams_x_2,
    beams_y=beams_y_2,
    cores=core,
    building_type=building_type,
    num_floors_above=num_floors_above,
    composite_slab=composite_slab,
    kgco2e_kwh=cities.kgCo2e_kwh,
    context=entwine_5,
    win_geometry=rotate.Geometry,
    total_shade_len=total_shade_len.tsl,
    inf_rate=parameters.inf_rate)  # -> out, building; inputs znames: tree, wwr: tree, shade_gc: tree, shade_depth_h: tree, shade_depth_v1: tree, shade_depth_v2: tree, exterior_walls_n: tree, exterior_walls_s: tree, exterior_walls_e: tree, exterior_walls_w: tree, adiabatic_walls: tree, floor_surfaces: tree, ceiling_surfaces: tree, columns: list, beams_x: list, beams_y: list, cores: list, context: list, win_geometry: list
# ---------- building: Python ----------
from studio2021.datastructures import building
reload(building)
from studio2021.datastructures.building import Building
import rhinoscriptsyntax as rs


columns = [[rs.CurveStartPoint(c), rs.CurveEndPoint(c)] for c in columns]
beams_x = [[rs.CurveStartPoint(b), rs.CurveEndPoint(b)] for b in beams_x]
beams_y = [[rs.CurveStartPoint(b), rs.CurveEndPoint(b)] for b in beams_y]
cores   = [rs.PolylineVertices(core) for core in cores]

context_ = []
for guid in context:
    if rs.IsSurface(guid):
        pt = [list(p) for p in rs.SurfacePoints(guid)]
        context_.append((pt[0], pt[1], pt[3], pt[2]))
    elif rs.IsBrep(guid):
        srfs = rs.ExplodePolysurfaces(guid)
        for srf in srfs:
            pt = [list(p) for p in rs.SurfacePoints(srf)]
            context_.append((pt[0], pt[1], pt[3], pt[2]))

if win_geometry[0]:
    win_geometry_ = []
    for guid in win_geometry:
        if rs.IsSurface(guid):
            pt = [list(p) for p in rs.SurfacePoints(guid)]
            win_geometry_.append((pt[0], pt[1], pt[3], pt[2]))
else:
    win_geometry_ = []


data = {'city': city,
        'znames': znames,
        'exterior_walls_n': exterior_walls_n,
        'exterior_walls_s': exterior_walls_s,
        'exterior_walls_e': exterior_walls_e,
        'exterior_walls_w': exterior_walls_w,
        'adiabatic_walls': adiabatic_walls,
        'floor_surfaces': floor_surfaces,
        'ceiling_surfaces': ceiling_surfaces,
        'wwr':wwr,
        'height': height,
        'shade_gc':shade_gc,
        'shade_depth_h':shade_depth_h,
        'shade_depth_v1':shade_depth_v1,
        'shade_depth_v2':shade_depth_v2,
        'facade_cladding':facade_cladding,
        'external_insulation':external_insulation,
        'insulation_thickness':insulation_thickness,
        'interior_insul_mat':interior_insul_mat,
        'int_ins_thickness':int_ins_thickness,
        'ewall_framing':ewall_framing,
        'int_finish':int_finish,
        'glazing_system':glazing_system,
        'simulation_name': simulation_name,
        'zone_program': zone_program,
        'weather_file': weather_file,
        'csv':csv,
        'sql_path': sql_path,
        'simulation_folder': simulation_folder,
        'run_simulation': run_simulation,
        'columns': columns,
        'beams_x': beams_x,
        'beams_y': beams_y,
        'cores':cores,
        'building_type':building_type,
        'num_floors_above':num_floors_above,
        'composite_slab':composite_slab,
        'ceiling_condition': ceiling_condition,
        'floor_condition': floor_condition,
        'kgco2e_kwh': kgco2e_kwh,
        'context':context_,
        'win_geometry': win_geometry_,
        'total_shade_len':total_shade_len,
        'inf_rate':inf_rate,
        }

building = Building.from_gh_data(data)
# ---------- end building ----------
vizbytype = HBVisualizeByType(hb_objs=solveadj.adj_rooms)  # -> walls, interior_walls, roofs, ceilings, exterior_floors, interior_floors, air_walls, apertures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; plug-in component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
lablefaces = HBLabelFaces(hb_objs=flatten(solveadj.adj_rooms))  # -> label_text, base_pts, labels, wire_frame; plug-in component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
panel_24 = Panel(building.out)
data = Data(vizbytype.walls)
embodied = GhPythonScript(building=[embodied.building, building.building])  # -> out, building, envelope_report
# ---------- embodied: Python ----------
__author__ = "tmendeze"

import rhinoscriptsyntax as rs

building.compute_structure_embodied()
building.compute_envelope_embodied()

envelope_report = building.envelope.env_strings

area = building.floor_area
win  = building.envelope.window_embodied
wall = building.envelope.wall_embodied
win /= area
wall/= area
# ---------- end embodied ----------
panel_25 = Panel(embodied.out)
panel_26 = Panel(embodied.envelope_report)
trees_from_building = GhPythonScript(building=building.building)  # -> out, zones, facade_area_n, facade_area_s, facade_area_e, facade_area_w, window_areas_n, window_areas_s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
# ---------- trees_from_building: Python ----------
import rhinoscriptsyntax as rs
import ghpythonlib.treehelpers as th

data = building.to_gh_data()

zones                   = data['zones']
facade_area_n           = data['facade_areas']['n']
facade_area_s           = data['facade_areas']['s']
facade_area_e           = data['facade_areas']['e']
facade_area_w           = data['facade_areas']['w']
exterior_walls_n        = data['exterior_walls']['n']
exterior_walls_s        = data['exterior_walls']['s']
exterior_walls_e        = data['exterior_walls']['e']
exterior_walls_w        = data['exterior_walls']['w']
adiabatic_walls         = data['adiabatic_walls']
floor_surfaces          = data['floor_surfaces']
ceiling_surfaces        = data['ceiling_surfaces']
window_areas_n          = data['window_areas']['n']
window_areas_s          = data['window_areas']['s']
window_areas_e          = data['window_areas']['e']
window_areas_w          = data['window_areas']['w']
opaque_areas_n          = data['opaque_areas']['n']
opaque_areas_s          = data['opaque_areas']['s']
opaque_areas_e          = data['opaque_areas']['e']
opaque_areas_w          = data['opaque_areas']['w']
shade_gc                = data['shade_gc']
shade_depth_h           = data['shade_depth_h']
shade_depth_v1          = data['shade_depth_v1']
shade_depth_v2          = data['shade_depth_v2']
facade_cladding         = data['facade_cladding']
facade_cladding         = data['facade_cladding']
external_insulation     = data['external_insulation'] 
insulation_thickness    = data['insulation_thickness']
ewall_framing           = data['ewall_framing']
int_finish              = data['int_finish']
glazing_system          = data['glazing_system']
simulation_name         = data['simulation_name']
zone_program            = data['zone_program']
weather_file            = data['weather_file']
sql_path                = data['sql_path']
simulation_folder       = data['simulation_folder']
run_simulation          = data['run_simulation']
wwr                     = data['wwr'] 
ceiling_condition       = data['ceiling_condition']
floor_condition         = data['floor_condition']
height                  = data['height']
interior_insul_mat      = data['interior_insul_mat']
int_ins_thick           = data['int_ins_thickness']
context                 = data['context']
inf_rate                = data['inf_rate']
# ---------- end trees_from_building ----------
panel_27 = Panel(trees_from_building.out)
bang_2 = ExplodeTree(Data=trees_from_building.shade_gc)  # -> flatten(Branch0), Branch1, Branch2, Branch3
bang_3 = ExplodeTree(Data=trees_from_building.zones)  # -> flatten(Branch0), Branch1, Branch2, Branch3
bang_4 = ExplodeTree(Data=trees_from_building.wwr)  # -> flatten(Branch0), Branch1, Branch2, Branch3
subtraction_3 = Subtraction(A=trees_from_building.height, B=Slider(2, range=0..10))  # -> flatten(Result)
multiplication_3 = Multiplication(A=bang_4.Branch0, B=100)
subtraction_4 = Subtraction(A=multiplication_3, B=20)
division_6 = Division(A=subtraction_4, B=20)
importglazing = GhPythonScript(glazing_name=trees_from_building.glazing_system)  # -> flatten(frame_type), glass_type, flatten(u_value), flatten(t_vis), embodied_carbon_metric, embodied_carbon_imperial
# ---------- importglazing: Python ----------
__author__ = "preston"

import rhinoscriptsyntax as rs
import sys

studiopath = "/Users/preston/Documents/GitHub/studio2021/src"
sys.path.append(studiopath)
import studio2021

from studio2021.functions import read_glazing

glazing = read_glazing(glazing_name)

print(glazing.keys())

frame_type = glazing['frame_type']
glass_type = glazing['glass_type']
u_value = glazing['u_value']
t_vis = glazing['t_vis']
embodied_carbon_metric = glazing['embodied_carbon_metric']
embodied_carbon_imperial = glazing['embodied_carbon_imperial']
# ---------- end importglazing ----------
assembly = Assembly(
    material_name_5=trees_from_building.facade_cladding,
    material_name_3=trees_from_building.external_insulation,
    B_2=trees_from_building.insulation_thickness,
    A_2=trees_from_building.insulation_thickness,
    material_name=trees_from_building.external_insulation,
    material_name_2=trees_from_building.interior_insul_mat,
    B=trees_from_building.int_ins_thick,
    A=trees_from_building.zone_program,
    material_name_4=trees_from_building.int_finish)  # -> y, constr
r_value_of_wall_construction = Panel(assembly.y)
item_15 = ListItem(List=importglazing.u_value, Index=0, Wrap=True)
item_16 = ListItem(List=importglazing.frame_type, Index=0, Wrap=True)
item_17 = ListItem(List=importglazing.t_vis, Index=0, Wrap=True)
equals_3 = Equality(FirstNumber=division_6, SecondNumber=-1)  # -> Equality, Inequality
multiplication_4 = Multiplication(A=item_15, B=Slider(5.678, range=0..10))
windowmat = HBWindowMaterial(name=item_16, u_factor=multiplication_4, shgc=bang_2.Branch0, t_vis=item_17)  # -> mat; plug-in component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
windowconstr = HBWindowConstruction(name="NGlass", materials=flatten(windowmat))  # -> constr; plug-in component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
clean = CleanTree(
    RemoveNulls=True,
    RemoveInvalid=True,
    RemoveEmpty=True,
    Tree=[trees_from_building.exterior_walls_s, trees_from_building.exterior_walls_n, trees_from_building.exterior_walls_e, trees_from_building.exterior_walls_w])
aperturesbyratio_2 = HBAperturesByRatio()  # -> report, hb_objs; plug-in component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
face = HBFace(geo=clean, name="ExWall", type="Wall", bc="Outdoors", ep_constr=assembly.constr)  # -> report, flatten(faces); plug-in component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
aperture = HBAperture(geo=rotate.Geometry, ep_constr=windowconstr)  # -> report, apertures; plug-in component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

face_2 = HBFace(name="RoofCeiling", type="RoofCeiling")  # -> report, flatten(faces); plug-in component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
face_3 = HBFace(name="Adiabatic Wall", type="Wall", bc="Adiabatic")  # -> report, flatten(faces); plug-in component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

face_4 = HBFace(
    geo=trees_from_building.floor_surfaces,
    name="Floor",
    type="Floor",
    bc=trees_from_building.floor_condition,
    ep_constr=opaqueconstr_2)  # -> report, flatten(faces); plug-in component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
face_5 = HBFace(geo=trees_from_building.adiabatic_walls, name="Adiabatic Wall", type="Wall", bc="Adiabatic")  # -> report, flatten(faces); plug-in component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
face_6 = HBFace(
    geo=trees_from_building.ceiling_surfaces,
    name="RoofCeiling",
    type="RoofCeiling",
    bc=trees_from_building.ceiling_condition,
    ep_constr=opaqueconstr)  # -> report, flatten(faces); plug-in component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
room = HBRoom(name=bang_3.Branch0, program=trees_from_building.zone_program, conditioned=True)  # -> report, room; plug-in component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
room_2 = HBRoom(faces=[face_3.faces, face_2.faces, face.faces], conditioned=True)  # -> report, room; plug-in component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
panel_28 = Panel("""False
False""")
panel_29 = Panel("""True
True""")
panel_30 = Panel("""True
True""")
division_7 = Division(A=parameters.shading, B=12)
addsubface = HBAddSubface(hb_obj=flatten(room_2.room), sub_faces=flatten(aperture.apertures))  # -> hb_obj; plug-in component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
filter_10 = StreamFilter(Gate=parameters.orientation, Stream2=panel_28, Stream3=panel_29, Stream4=panel_30)
split = SplitList(List=filter_10, Index=1)  # -> ListA, ListB
equals_4 = Equality(FirstNumber=division_7, SecondNumber=0)  # -> Equality, Inequality
louvershades = HBLouverShades(hb_objs=flatten(addsubface), depth=division_7, vertical=split.ListA, flip_start=split.ListB)  # -> report, hb_objs; plug-in component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
shade = HBShade(geo=trees_from_building.context)  # -> report, shades; plug-in component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
filter_11 = StreamFilter(Gate=equals_4.Equality, Stream0=louvershades.hb_objs, Stream1=addsubface)
filter_12 = StreamFilter(Gate=equals_3.Equality, Stream0=filter_11, Stream1=room_2.room)
clean_2 = CleanTree(RemoveNulls=True, RemoveInvalid=True, RemoveEmpty=False, Tree=shade.shades)
clean_3 = CleanTree(RemoveNulls=True, RemoveInvalid=True, RemoveEmpty=False, Tree=filter_12)  # -> flatten(Tree)
applyloadvals = HBApplyLoadValues(room_or_program=flatten(clean_3), infilt_per_exterior=trees_from_building.inf_rate)  # -> report, mod_obj; plug-in component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
cluster = Cluster(rooms_model=clean_3, G=trees_from_building.floor_surfaces)

# ----
# View Zones
vizbytype_2 = HBVisualizeByType(hb_objs=filter_12)  # -> walls, interior_walls, roofs, ceilings, exterior_floors, interior_floors, air_walls, apertures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; plug-in component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

simoutput = HBSimulationOutput(zone_energy_use=Toggle(True), gains_and_losses=Toggle(True))  # -> report, sim_output; plug-in component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
faceenergyattr = HBFaceEnergyAttributes({"Construction": "properties.energy.construction.display_name", "Materials": "properties.energy.construction.layers", "R-Value": "properties.energy.construction.r_value", "U-Value": "properties.energy.construction.u_value", "U-Factor": "properties.energy.construction.u_factor", "Solar Transmitance [Unshaded]": "properties.energy.construction.solar_transmittance", "Solar Reflectance [Outside]": "properties.energy.construction.outside_solar_reflectance", "Solar Reflectance [Inside]": "properties.energy.construction.inside_solar_reflectance", "Fraction Area Operable": "properties.energy.vent_opening.fraction_area_operable", "Fraction Height Operable": "properties.energy.vent_opening.fraction_height_operable", "Discharge Coefficient": "properties.energy.vent_opening.discharge_coefficient", "Cross Ventilation": "properties.energy.vent_opening.wind_cross_vent"}, selected="Construction")
filter_13 = StreamFilter(
    Gate=parameters.orientation,
    Stream1=Slider(0, range=0..100),
    Stream2=Slider(180, range=0..1000),
    Stream3=Slider(270, range=0..270),
    Stream4=Slider(90, range=0..1000))
simpar = HBSimulationParameter(north=filter_13, output=simoutput.sim_output, timestep=6)  # -> sim_par; plug-in component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
model = HBModel(rooms=flatten(applyloadvals.mod_obj), shades=flatten(clean_2), name=trees_from_building.simulation_name)  # -> report, model; plug-in component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
lablefaces_2 = HBLabelFaces(hb_objs=flatten(clean_3), attribute=faceenergyattr)  # -> label_text, base_pts, labels, wire_frame; plug-in component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
filter_14 = StreamFilter(Gate=parameters.site)
list_5 = ItemSelector(lablefaces_2.label_text)
modeltoosm = HBModelToOSM(
    model=model.model,
    epw_file=trees_from_building.weather_file,
    sim_par=simpar,
    add_str=cluster,
    folder=trees_from_building.simulation_folder,
    write=trees_from_building.run_simulation,
    run=trees_from_building.run_simulation)  # -> report, jsons, osw, osm, idf, sql, zsz, rdd, html; plug-in component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
decnstrconstr = HBDeconstructConstruction(constr=list_5)  # -> materials, layers, r_val_si, r_val_ip, u_fac_si, u_fac_ip, shgc, t_sol, t_vis; plug-in component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
roomenergyresult = HBReadRoomEnergyResult(sql=modeltoosm.sql)  # -> cooling, heating, lighting, electric_equip, gas_equip, process, hot_water, fan_electric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; plug-in component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
add_euis = GhPythonScript(
    building=trees_from_building.building,
    cooling=roomenergyresult.cooling,
    heating=roomenergyresult.heating,
    lighting=roomenergyresult.lighting,
    equipment=roomenergyresult.electric_equip,
    hot_water=roomenergyresult.hot_water,
    solar_gain=roomenergyresult.solar_gain,
    wall_r=assembly.y,
    window_u=item_15)  # -> out, building; inputs cooling: list, heating: list, lighting: list, equipment: list, hot_water: list
# ---------- add_euis: Python ----------
__author__ = "tmendeze"

building.add_eui_results(cooling,
                         heating,
                         lighting,
                         equipment,
                         hot_water,
                         solar_gain,
                         wall_r,
                         window_u,
                         hourly=False)
# ---------- end add_euis ----------
panel_31 = Panel(add_euis.out)
write_results = GhPythonScript(building=add_euis.building)  # -> out
# ---------- write_results: Python ----------
__author__ = "tmendeze"

building.write_results(csv=False, delete=True)
#csv : write csv also or not
#delete : deletes honeybee files
# ---------- end write_results ----------
panel_32 = Panel(write_results)

# ==== cluster Assembly
material_name = ClusterInput()
python = GhPythonScript(material_name=material_name)  # -> out, a
# ---------- python: Python ----------
__author__ = "preston"

import rhinoscriptsyntax as rs
import sys

studiopath = "/Users/preston/Documents/GitHub/studio2021/src"
sys.path.append(studiopath)
import studio2021

from studio2021.functions import read_materials

material = read_materials(material_name)

print(material.keys())

r_per_in = material["r_per_in"]
embodied_carbon = material["embodied_carbon"]
type = material["mtype"]
density = material["density"]
sp_heat = material["sp_heat"]
thickness_in = material["thickness_in"]
thickness_m = material["thickness_m"]
r_value = material["r_value"]
conductivity = material["conductivity"]
# ---------- end python ----------
A = ClusterInput()
material_name_2 = ClusterInput()
material_name_3 = ClusterInput()
subset = SubSet(SetA=A, SetB="2013::MediumOffice::OpenOffice")
importmaterial = GhPythonScript(material_name=material_name_2)  # -> r_per_in, embodied_carbon, type, thickness_in, thickness_m, conductivity, density, sp_heat, r_value; same code as python
importmaterial_2 = GhPythonScript(material_name=material_name_3)  # -> r_per_in, embodied_carbon, type, thickness_in, thickness_m, conductivity, density, sp_heat, r_value; same code as python
panel = Panel(python.out)
panel_2 = Panel(subset)
filter = StreamFilter(Gate=subset, Stream0="0.906", Stream1="1")
B = ClusterInput()
material_name_4 = ClusterInput()
material_name_5 = ClusterInput()
B_2 = ClusterInput()
multiplication = Multiplication(A=importmaterial.r_per_in, B=B)
importmaterial_3 = GhPythonScript(material_name=material_name_4)  # -> r_per_in, embodied_carbon, type, thickness_in, thickness_m, conductivity, density, sp_heat, r_value; same code as python
importmaterial_4 = GhPythonScript(material_name=material_name_5)  # -> r_per_in, embodied_carbon, type, thickness_in, thickness_m, conductivity, density, sp_heat, r_value; same code as python
A_2 = ClusterInput()
multiplication_2 = Multiplication(A=importmaterial_2.r_per_in, B=B_2)
division = Division(A=multiplication, B=5.67826)
equals = Equality(FirstNumber=A_2, SecondNumber=0)  # -> Equality, Inequality
division_2 = Division(A=multiplication_2, B=5.67826)
division_3 = Division(A=Slider(1, range=0..1), B=5.67826)
division_4 = Division(A="0.63", B=5.67826)
multiplication_3 = Multiplication(A=division, B=filter)
opaquematnomass = HBOpaqueMaterialNoMass(name="ContExtInsulation", r_value=division_2)  # -> mat; plug-in component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
division_5 = Division(A=importmaterial_4.r_value, B=5.67826)
opaquemat = HBOpaqueMaterial(
    name="InteriorFinish",
    thickness=importmaterial_3.thickness_m,
    conductivity=importmaterial_3.conductivity,
    density=importmaterial_3.density,
    spec_heat=importmaterial_3.sp_heat)  # -> mat; plug-in component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
opaquematnomass_2 = HBOpaqueMaterialNoMass(name="AirGap", r_value=division_3)  # -> flatten(mat); plug-in component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
opaquematnomass_3 = HBOpaqueMaterialNoMass(name="1/2\" Plywood", r_value=division_4)  # -> mat; plug-in component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
opaquematnomass_4 = HBOpaqueMaterialNoMass(name="IntInsulation", r_value=multiplication_3)  # -> mat; plug-in component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
opaquematnomass_5 = HBOpaqueMaterialNoMass(name="FacadeCladding", r_value=division_5)  # -> flatten(mat); plug-in component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
filter_2 = StreamFilter(Gate=equals.Equality, Stream0=opaquematnomass)
clean = CleanTree(
    RemoveNulls=True,
    RemoveInvalid=True,
    RemoveEmpty=False,
    Tree=flatten([opaquematnomass_5, opaquematnomass_2, filter_2, opaquematnomass_3, opaquematnomass_4, opaquemat]))
opaqueconstr = HBOpaqueConstruction(name="ExteriorWall", materials=clean)  # -> constr; plug-in component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
constr = ClusterOutput(opaqueconstr)
decnstrconstr = HBDeconstructConstruction(constr=opaqueconstr)  # -> materials, layers, r_val_si, r_val_ip, u_fac_si, u_fac_ip, t_sol, t_vis; plug-in component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
decnstrmat = HBDeconstructMaterial(mat=opaqueconstr)  # -> values, attr_names, r_val_si, r_val_ip; plug-in component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
one_over_x = OneOverX(Value=decnstrconstr.u_fac_ip)
y = ClusterOutput(one_over_x)

# ==== cluster Cluster
G = ClusterInput()
roomattr = HBRoomAttributes({"Display Name": "display_name", "Simulation Name (Identifier)": "identifier", "Multiplier": "multiplier", "Story": "story", "Volume": "volume", "Gross Floor Area": "floor_area", "Exposed Area": "exposed_area", "Exterior Wall Area": "exterior_wall_area", "Exterior Aperture Area": "exterior_aperture_area", "Average Floor Elevation": "average_floor_height"}, selected="Simulation Name (Identifier)")
area = Area(Geometry=G)  # -> Area, Centroid
panel = Panel("""  Daylighting:Controls,
  Test,     		   !- Name
  Zone_Name,               !- Zone Name
  SplitFlux,               !- Daylighting Method
  ,                        !- Availability Schedule Name
  Continuous,              !- Lighting Control Type
  0.3,                     !- Minimum Input Power Fraction for Continuous or ContinuousOff Dimming Control
  0.2,                     !- Minimum Light Output Fraction for Continuous or ContinuousOff Dimming Control
  ,                        !- Number of Stepped Control Steps
  1.0,                     !- Probability Lighting will be Reset When Needed in Manual Stepped Control
  DaylRefPt1,              !- Glare Calculation Daylighting Reference Point Name
  180.0,                   !- Glare Calculation Azimuth Angle of View Direction Clockwise from Zone y-Axis {deg}
  20.0,                    !- Maximum Allowable Discomfort Glare Index
  ,                        !- DElight Gridding Resolution {m2}
  DaylRefPt1,              !- Daylighting Reference Point 1 Name
  1.0,                     !- Fraction of Zone Controlled by Reference Point 1
  500.;                    !- Illuminance Setpoint at Reference Point 1 {lux}""")
rooms_model = ClusterInput()
labelrooms = HBLabelRooms(rooms_model=flatten(rooms_model), attribute=roomattr)  # -> graft(label_text), base_pts, labels, wire_frame; plug-in component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
move = Move(Geometry=area.Centroid, Motion="{0,0,3}")  # -> Geometry, Transform
pdecon = Deconstruct(Point=move.Geometry)  # -> XComponent, YComponent, ZComponent
lng = ListLength(List=flatten(labelrooms.label_text))
clean = CleanTree(RemoveNulls=True, RemoveInvalid=True, RemoveEmpty=True, Tree=pdecon.XComponent)
clean_2 = CleanTree(RemoveNulls=True, RemoveInvalid=True, RemoveEmpty=True, Tree=pdecon.ZComponent)
panel_2 = Panel("""  Daylighting:ReferencePoint,
  DaylRefPt1,              !- Name
  Zone_Name,               !- Zone Name
  point1_x,                !- X-Coordinate of Reference Point {m}
  point1_y,                !- Y-Coordinate of Reference Point {m}
  point1_z;                !- Z-Coordinate of Reference Point {m}""")
panel_3 = Panel(lng)
clean_3 = CleanTree(RemoveNulls=True, RemoveInvalid=True, RemoveEmpty=True, Tree=pdecon.YComponent)
panel_4 = Panel("""Run1
Run2
Run3
Run4
Run5""")
split = SplitList(List=panel_4, Index=panel_3)  # -> ListA, ListB
panel_5 = Panel("""Point1
Point2
Point3
Point4
Point5""")
rep = ReplaceText(Text=panel, Find="Zone_Name", Replace=simplify(labelrooms.label_text), RecursiveReplace=False)
rep_2 = ReplaceText(Text=rep, Find="Test", Replace=graft(split.ListA), RecursiveReplace=False)
split_2 = SplitList(List=panel_5, Index=panel_3)  # -> ListA, ListB
rep_3 = ReplaceText(Text=panel_2, Find="Zone_Name", Replace=simplify(labelrooms.label_text), RecursiveReplace=False)
rep_4 = ReplaceText(Text=rep_2, Find="DaylRefPt1", Replace=graft(split_2.ListA), RecursiveReplace=False)  # -> flatten(Result)
rep_5 = ReplaceText(Text=rep_3, Find="DaylRefPt1", Replace=graft(split_2.ListA), RecursiveReplace=False)
rep_6 = ReplaceText(Text=rep_5, Find="point1_x", Replace=clean, RecursiveReplace=False)
rep_7 = ReplaceText(Text=rep_6, Find="point1_y", Replace=clean_3, RecursiveReplace=False)
rep_8 = ReplaceText(Text=rep_7, Find="point1_z", Replace=clean_2, RecursiveReplace=False)  # -> flatten(Result)
join = TextJoin(Text=rep_4)
join_2 = TextJoin(Text=rep_8)
join_3 = TextJoin(Text=[join, join_2])
R = ClusterOutput(join_3)
