# Grasshopper definition dwelling_energy_sim.gh (Grasshopper 1.0.7)
# plug-ins: MetaHopper

# ----
# Run Energy
# Simulation
run_energy_simulation = BooleanToggle(True)

# ----
# select inches of polyiso insulation
number_slider = Slider(8, range=0..10)

# ----
# Simulation Inputs
# paste the path to the .epw file for your site's climate
# Paste the path to the folder you would like to save your results to
# toggle this to true when you are happy with your simulation inputs
# Simulation Outputs
# Output Folder Name:
panel = Panel("sim_1")
panel_2 = Panel("/Users/prxsto/Documents/GitHub/msdc-thesis/data/USA_WA_Seattle-Tacoma.Intl.AP.727930_TMY3.epw")
panel_3 = Panel("/Users/prxsto/Desktop/test")
panel_4 = Panel("Name your simulation")
csv_path = GhPythonScript(path=panel_3, sim_name=panel)  # -> out, csv_path
# ---------- csv_path: Python ----------
__author__ = "tmendeze"
__version__ = "2021.03.02"

import rhinoscriptsyntax as rs
import os
csv_path = os.path.join(path, sim_name+".csv")
# ---------- end csv_path ----------
panel_5 = Panel(csv_path.csv_path)

# ----
# set this to the solids representing your design. one solid per zone.
# set this to the surfaces representing your windows
# set this to the solids/surfaces representing context, site, foliage, etc. (for shading)
srf = Surface([<surface referenced from the Rhino model> x2])
brep = Brep([<brep referenced from the Rhino model> x9])
# choose "select multiple" on these components while having the geometry you want selected in Rhino. you can hide the Rhino geometry afterwards
brep_2 = Brep(<brep referenced from the Rhino model>)

# ----
# select inches of polyiso insulation
panel_6 = Panel("Polyiso")
panel_7 = Panel("Cellulose")
multiplication = Multiplication(A="3.7", B=number_slider)
panel_8 = Panel("Fiber Cement Panel")
multiplication_2 = Multiplication(A="7", B=Slider(0.8, range=0..1))
division = Division(A=multiplication, B=5.67826)
panel_9 = Panel("Gyp")
division_2 = Division(A=multiplication_2, B=5.67826)
division_3 = Division(A=Slider(1, range=0..1), B=5.67826)
division_4 = Division(A="0.63", B=5.67826)
multiplication_3 = Multiplication(A=division, B="0.906")
opaquematnomass = HBOpaqueMaterialNoMass(name="ContExtInsulation", r_value=division_2)  # -> mat; plug-in component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
division_5 = Division(A="0.6", B=5.67826)
opaquemat = HBOpaqueMaterial(name="InteriorFinish", thickness=".0254", conductivity=".036", density="40", spec_heat="1210")  # -> mat; plug-in component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
opaquematnomass_2 = HBOpaqueMaterialNoMass(name="AirGap", r_value=division_3)  # -> flatten(mat); plug-in component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
opaquematnomass_3 = HBOpaqueMaterialNoMass(name="Plywood Studs", r_value=division_4)  # -> mat; plug-in component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
opaquematnomass_4 = HBOpaqueMaterialNoMass(name="IntInsulation", r_value=multiplication_3)  # -> mat; plug-in component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
opaquematnomass_5 = HBOpaqueMaterialNoMass(name="FacadeCladding", r_value=division_5)  # -> flatten(mat); plug-in component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

connected = GetConnectedObjects(Objects=<missing>)
connected_2 = GetConnectedObjects(Objects=<missing>)
set_slider = SetSliderProperties(Slider=connected_2, Range=<missing>)
python = GhPythonScript(filename=panel, filepath=panel_5, kgCO2e=Slider(0.135669, range=0..1))  # -> out, adu
# ---------- python: Python ----------
__author__ = "papep"
__version__ = "2022.01.25"

import rhinoscriptsyntax as rs

class ADU(object):
    
    def __init__(self, filename, filepath, kgCO2e):
       self.filename            = filename
       self.filepath            = filepath
       self.kgCO2e              = kgCO2e
       self.m2                  = None
       self.assembly_r          = None
       self.cool                = None
       self.heat                = None
       self.light               = None
       self.eq                  = None
       self.dhw                 = None
       self.eui_kwh             = None
       self.eui_kbtu            = None
       self.carbon              = None

    def write_csv(self):
        fh = open(self.filepath, 'w') # write but do not overwrite filename if it exists
        fh.write("{}, {}, {}, {}, {}, {}, {}, {}, {}, {}, {}, {}, \n".format("filename", 
        "m2_area", "r-wall", "eui_cool", "eui_heat", "eui_light", "eui_eq", "eui_dhw", 
        "eui_kwh", "eui_kbtu", "carbon", "kgCO2e"))
        fh.write("{}, {}, {}, {}, {}, {}, {}, {}, {}, {}, {}, {}".format(
        self.filename, self.m2, self.assembly_r, self.cool, self.heat, self.light, self.eq,
        self.dhw, self.eui_kwh, self.eui_kbtu, self.carbon, self.kgCO2e))
        fh.close()

    def add_eui_results(self, cool, heat, light, eq, dhw):
    
            totals = 0
            cool_tot = 0
            heat_tot = 0
            light_tot = 0
            eq_tot = 0
            dhw_tot = 0
            for i in range(len(cool)):
                c = sum(cool[i])
                h = sum(heat[i])
                l = sum(light[i])
                e = sum(eq[i])
                w = sum(dhw[i])
                tot = sum([c, h, l, e, w])
                cool_tot += c
                heat_tot += h
                light_tot += l
                eq_tot += e
                dhw_tot += w
                totals += tot

            self.eui_kbtu   = float(totals) * 3.41214 / self.m2 * 0.092903 
            self.cool       = float(cool_tot) * 3.41214 / self.m2 * 0.092903
            self.heat       = float(heat_tot) * 3.41214 / self.m2 * 0.092903 / 6.651431696550647 
            # this is the difference factor between correct results and what this has been giving 
            # need to figure out real solution
            self.light      = float(light_tot) * 3.41214 / self.m2 * 0.092903
            self.eq         = float(eq_tot) * 3.41214 / self.m2 * 0.092903
            self.dhw        = float(dhw_tot) * 3.41214 / self.m2 * 0.092903
            self.eui_kbtu   = self.cool + self.heat + self.light + self.eq + self.dhw

    def calc_carbon(self, eui_kwh):
        self.eui_kwh = eui_kwh / 6.651431696550647
        if self.eui_kwh != None:
            self.carbon = self.eui_kwh * self.kgCO2e * self.m2
        else:
            self.carbon = None

adu = ADU(filename, filepath, kgCO2e)

print "filename:", adu.filename
print "filepath:", adu.filepath
print "kgCO2e:", adu.kgCO2e
# ---------- end python ----------
python_2 = GhPythonScript(adu=python.adu)  # -> out, adu, filename, kgCO2e
# ---------- python_2: Python ----------
__author__ = "papep"
__version__ = "2022.01.26"

import rhinoscriptsyntax as rs

filename = adu.filename
filepath = adu.filepath
kgCO2e = adu.kgCO2e

print "filename:", adu.filename
print "filepath:", adu.filepath
print "kgCO2e:", adu.kgCO2e
# ---------- end python_2 ----------
cluster = Cluster_2(
    geo=srf,
    geo_2=brep,
    epw_file=panel_2,
    solids=brep_2,
    folder=panel_3,
    write=run_energy_simulation,
    run=run_energy_simulation,
    T=[opaquematnomass_5, opaquematnomass_2, opaquematnomass, opaquematnomass_3, opaquematnomass_4, opaquemat],
    adu=python_2.adu)  # -> rooms, adu_2

# ----
# Use this to visualize your Honeybee model in your Rhino window
faceattr = HBFaceAttributes({"Display Name": "display_name", "Simulation Name (Identifier)": "identifier", "Boundary Condition": "boundary_condition", "Has Parent": "has_parent", "Parent": "parent", "Area": "area", "Perimeter": "perimeter", "Face Type": "type", "Aperture Is Operable": "is_operable", "Door Is Glass": "is_glass"}, selected="Boundary Condition")
lablefaces = HBLabelFaces(hb_objs=flatten(cluster.rooms), attribute=faceattr)  # -> label_text, base_pts, labels, wire_frame; plug-in component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
vizbytype = HBVisualizeByType(hb_objs=cluster.rooms)  # -> walls, interior_walls, roofs, ceilings, exterior_floors, interior_floors, air_walls, apertures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; plug-in component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
panel_10 = Panel(lablefaces.label_text)
data = Data(vizbytype.apertures)

write_csv = GhPythonScript(adu=cluster.adu_2, location=panel_3)  # -> out
# ---------- write_csv: Python ----------
__author__ = "papep"
__version__ = "2022.01.26"

import rhinoscriptsyntax as rs
import os
import glob

# write csv
if adu.eui_kbtu != None:
    adu.write_csv()

print "filepath:", adu.filepath
print "filename:", adu.filename
print "r-assembly:", adu.assembly_r
print "kgCO2e:", adu.kgCO2e
print "eui_kwh:", adu.eui_kwh
print "eui_kbtu:", adu.eui_kbtu
print "eui_heat:", adu.heat
print "eui_cool:", adu.cool
print "eui_eq:", adu.light
print "eui_heat:", adu.eq
print "eui_dhw:", adu.dhw
print "carbon:", adu.carbon
print "\n"
print "eui values by end use are in units kBTU/ft2"
print "eui_kbtu (3.0 COP):", adu.eui_kbtu / 3.0
# ---------- end write_csv ----------
# heat EUI is ideal air loads, meaning you can divide by a COP (coefficient of performance) value specific to your HVAC system for a more accurate result. COP of 3 is common for heat pump systems in the PNW.
panel_11 = Panel(write_csv)

# ==== cluster Cluster_2
T = ClusterInput()
adu = ClusterInput()
geo = ClusterInput()
geo_2 = ClusterInput()
solids = ClusterInput()
epw_file = ClusterInput()
folder = ClusterInput()
write = ClusterInput()
run = ClusterInput()
cluster = Cluster(T=T, adu=adu)  # -> adu_2, constr_set, constr
aperture = HBAperture(geo=geo, ep_constr=cluster.constr)  # -> report, apertures; plug-in component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

bldgprograms = HBBuildingPrograms({"LargeOffice", "MediumOffice", "SmallOffice", "MidriseApartment", "HighriseApartment", "Retail", "StripMall", "PrimarySchool", "SecondarySchool", "SmallHotel", "LargeHotel", "Hospital", "Outpatient", "Laboratory", "Warehouse", "SuperMarket", "FullServiceRestaurant", "QuickServiceRestaurant", "Courthouse", "LargeDataCenterHighITE", "LargeDataCenterLowITE", "SmallDataCenterHighITE", "SmallDataCenterLowITE"}, selected="MidriseApartment")
intsolid = HBIntersectSolids(solids=flatten(solids), run=Toggle(True))  # -> int_solids; plug-in component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
searchprog = HBSearchPrograms(bldg_prog=bldgprograms, keywords="Apartment")  # -> room_prog; plug-in component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
list = ItemSelector(searchprog, {"2019::MidriseApartment::Apartment"}, selected="2019::MidriseApartment::Apartment")
roomsolid = HBRoomFromSolid(geo=flatten(intsolid), constr_set=cluster.constr_set, program=list, conditioned=True)  # -> report, rooms; plug-in component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
toggle = BooleanToggle(True)
solveadj = HBSolveAdjacency(rooms=flatten(roomsolid.rooms), adiabatic=toggle, run=toggle)  # -> report, adj_rooms; plug-in component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
shade = HBShade(geo=geo_2)  # -> report, shades; plug-in component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
clean = CleanTree(RemoveNulls=True, RemoveInvalid=True, RemoveEmpty=False, Tree=shade.shades)

addsubface = HBAddSubface(hb_obj=flatten(solveadj.adj_rooms), sub_faces=flatten(aperture.apertures))  # -> hb_obj; plug-in component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

applyloadvals = HBApplyLoadValues(room_or_program=flatten(addsubface), infilt_per_exterior=Slider(0.0059, range=0..0.01))  # -> report, mod_obj; plug-in component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
daylightcontrol = HBApplyDaylightControl(rooms=flatten(applyloadvals.mod_obj))  # -> report, rooms; plug-in component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
model = HBModel(rooms=flatten(daylightcontrol.rooms), shades=flatten(clean))  # -> report, model; plug-in component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

rooms = ClusterOutput(daylightcontrol.rooms)

# ---- group: run sim
simoutput = HBSimulationOutput(zone_energy_use=Toggle(True), gains_and_losses=Toggle(True))  # -> report, sim_output; plug-in component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
simpar = HBSimulationParameter(north=Slider(0, range=0..100), output=simoutput.sim_output, timestep=6)  # -> sim_par; plug-in component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
modeltoosm = HBModelToOSM(model=model.model, epw_file=epw_file, sim_par=simpar, folder=folder, write=write, run=run)  # -> report, jsons, osw, osm, idf, sql, zsz, rdd, html; plug-in component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
panel = Panel(modeltoosm.html)
roomenergyresult = HBReadRoomEnergyResult(sql=modeltoosm.sql)  # -> cooling, heating, lighting, electric_equip, gas_equip, process, hot_water, fan_electric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; plug-in component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
eui = HBEndUseIntensity(sql=modeltoosm.sql, ip=Toggle(False))  # -> eui, eui_end_use, end_uses, gross_floor; plug-in component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

# ----
eui_2 = HBEndUseIntensity(sql=modeltoosm.sql, ip=Toggle(True))  # -> eui, eui_end_use, end_uses, gross_floor; plug-in component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
python = GhPythonScript(
    adu=cluster.adu_2,
    cool=roomenergyresult.cooling,
    heat=roomenergyresult.heating,
    light=roomenergyresult.lighting,
    eq=roomenergyresult.electric_equip,
    dhw=roomenergyresult.hot_water,
    eui_kwh=eui.eui,
    m2=eui.gross_floor)  # -> out, adu; inputs cool: list, heat: list, light: list, eq: list, dhw: list
# ---------- python: Python ----------
__author__ = "papep"
__version__ = "2022.02.07"

import rhinoscriptsyntax as rs

adu.m2 = m2

adu.add_eui_results(cool, heat, light, eq, dhw)
adu.calc_carbon(eui_kwh)

print "\n"
print "heat:", adu.heat
print "cool:", adu.cool
print "light:", adu.light
print "eq:", adu.eq
print "dhw:", adu.dhw
print "eui_kwh:", adu.eui_kwh
print "eui_kbtu:", adu.eui_kbtu
print "carbon:", adu.carbon
# ---------- end python ----------
adu_2 = ClusterOutput(python.adu)
panel_2 = Panel(python.out)

# ==== cluster Cluster
T = ClusterInput()

searchmats = HBSearchMaterials(keywords="air")  # -> opaque_mats, window_mats; plug-in component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
searchmats_2 = HBSearchMaterials(keywords="carpet")  # -> opaque_mats, window_mats; plug-in component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
searchmats_3 = HBSearchMaterials(keywords="gypsum")  # -> opaque_mats, window_mats; plug-in component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
clean = CleanTree(RemoveNulls=True, RemoveInvalid=True, RemoveEmpty=False, Tree=flatten(T))
list = ItemSelector(
    searchmats_3.opaque_mats,
    {"1/2 in. Gypsum Board", "1/2IN Gypsum", "5/8 in. Gypsum Board", "G01 13mm gypsum board", "G01a 19mm gypsum board", "Generic Gypsum Board", "Gypsum Board - 1/2 in. CBES", "Gypsum Or Plaster Board - 3/8 in.", "NACM_Gypsum Board 5/8in"}, selected="1/2 in. Gypsum Board")
list_2 = ItemSelector(
    searchmats.opaque_mats,
    {"F04 Wall air space resistance", "F05 Ceiling air space resistance", "Generic Ceiling Air Gap", "Generic Wall Air Gap", "Typical Air Wall"}, selected="F04 Wall air space resistance")
list_3 = ItemSelector(
    searchmats_2.opaque_mats,
    {"CP02 CARPET PAD", "Carpet - 3/4 in. CBES", "NACM_Carpet 3/4in", "Typical Carpet Pad"}, selected="CP02 CARPET PAD")
panel = Panel("2.2712")
opaqueconstr = HBOpaqueConstruction(name="ExteriorWall", materials=clean)  # -> constr; plug-in component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
windowmat = HBWindowMaterial(name="aluminum", u_factor=flatten("1.98"), shgc=flatten(0.25), t_vis=flatten("0.63"))  # -> mat; plug-in component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
decnstrconstr = HBDeconstructConstruction(constr=opaqueconstr)  # -> materials, layers, r_val_si, r_val_ip, u_fac_si, u_fac_ip, t_sol, t_vis; plug-in component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
panel_2 = Panel(decnstrconstr.materials)
opaqueconstr_2 = HBOpaqueConstruction(name="Floor_Residential", materials=[list, list_2, list_3])  # -> constr; plug-in component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
opaqueconstr_3 = HBOpaqueConstruction(name="Ceiling_Residential", materials=[list_3, list_2, list])  # -> constr; plug-in component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
panel_3 = Panel([opaqueconstr_3, opaqueconstr_2])
windowconstr = HBWindowConstruction(name="NGlass", materials=flatten(windowmat))  # -> constr; plug-in component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
one_over_x = OneOverX(Value=decnstrconstr.u_fac_ip)
searchconstrset = HBSearchConstructionSets()  # -> constr_sets; plug-in component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
panel_4 = Panel([opaqueconstr, one_over_x])
list_4 = ItemSelector(
    searchconstrset,
    {"1980_2004::ClimateZone1::Mass", "1980_2004::ClimateZone1::Metal Building", "1980_2004::ClimateZone1::SteelFramed", "1980_2004::ClimateZone1::WoodFramed", "1980_2004::ClimateZone2::Mass", "1980_2004::ClimateZone2::Metal Building"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}, selected="2019::ClimateZone4::WoodFramed")
interiorsubset = HBInteriorConstructionSubset(ceiling=opaqueconstr_3, interior_floor=opaqueconstr_2)  # -> interior_set; plug-in component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
exteriorsubset = HBExteriorConstructionSubset(exterior_wall=opaqueconstr, exposed_floor=opaqueconstr_2)  # -> exterior_set; plug-in component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
subfacesubset = HBSubfaceSubset(window=windowconstr, skylight=windowconstr, operable=windowconstr)  # -> subface_set; plug-in component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
groundsubset = HBGroundConstructionSubset(ground_floor=opaqueconstr_2)  # -> ground_set; plug-in component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
panel_5 = Panel(exteriorsubset)
constructionset = HBConstructionSet(
    name="dadu_assembly",
    base_constr_set=list_4,
    exterior_subset=exteriorsubset,
    ground_subset=groundsubset,
    interior_subset=interiorsubset,
    subface_subset=subfacesubset)  # -> constr_set; plug-in component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
decnstrconstrset = HBDeconstructConstructionSet(constr_set=list_4)  # -> exterior_wall, exterior_roof, exposed_floor, ground_wall, ground_roof, ground_floor, window, skylight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; plug-in component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
decnstrconstr_2 = HBDeconstructConstruction(constr=decnstrconstrset.exposed_floor)  # -> materials, layers, r_val_si, r_val_ip, u_fac_si, u_fac_ip, shgc, t_sol, t_vis; plug-in component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
panel_6 = Panel(decnstrconstr_2.materials)

constr = ClusterOutput(windowconstr)
constr_set = ClusterOutput(constructionset)
adu = ClusterInput()
python = GhPythonScript(adu=adu, assembly_r=one_over_x)  # -> out, adu
# ---------- python: Python ----------
__author__ = "papep"
__version__ = "2022.01.25"

import rhinoscriptsyntax as rs

adu.assembly_r = assembly_r

print "assembly_r:", adu.assembly_r
# ---------- end python ----------
panel_7 = Panel(python.out)
adu_2 = ClusterOutput(python.adu)
