# Grasshopper definition sim_gen_1.5.0.gh (Grasshopper 1.0.7)
# plug-ins: Human, MetaHopper, Pufferfish, PTComponentLibrary, LunchBox

number_slider = Slider(0, range=0..10)
connected = GetConnectedObjects(Objects=number_slider)
panel = Panel("C:\Users\papep\Documents\GitHub\msdc-thesis\!tool\temp")
connected_2 = GetConnectedObjects(Objects=Slider(4, range=0..10000))
bslider = BatchSlider(BatchVariable=number_slider, Steps=5)
set_slider = SetSliderProperties(Slider=connected, Range=Slider(10, range=0..10000))
set_slider_2 = GhPythonScript(slider=connected_2, iterations="5", toggle=Button())  # -> out; inputs iterations: Int32
# ---------- set_slider_2: Python ----------
__author__ = "papep"
__version__ = "2022.01.23"

import rhinoscriptsyntax as rs
import Grasshopper as gh

iterations = range(iterations)

if toggle:
    for i in iterations:
        slider.Slider.Value = iterations[i]
        print i
        slider.ExpireSolution(True)
# ---------- end set_slider_2 ----------
batchdriver = BatchDriver(Run=Toggle(True), FilePath="test", Name="test", ValuesI=bslider)  # -> Path, ValuesI
panel_2 = Panel(set_slider_2)
R = Reset()  # inputs Sliders: list, Values: list
# ---------- R: Python ----------
""" Reset named sliders """

import Grasshopper as gh

if Toggle:
    
    # Get to the GH objects
    ghObjects = ghenv.Component.OnPingDocument().Objects
    
    # Iterate the GH objects
    for obj in ghObjects:
        
        # Set the named slider values
        if obj.NickName in Sliders:
            if type(obj) is gh.Kernel.Special.GH_NumberSlider:
                obj.Slider.Value = Values[Sliders.index(obj.NickName)]
                obj.ExpireSolution(True)
# ---------- end R ----------
parameter_generator = GhPythonScript()  # -> out, param
# ---------- parameter_generator: Python ----------
__author__ = "tmendeze, ppape"

import rhinoscriptsyntax as rs

sizes           = [0, 1, 2, 3, 4]
orientation     = [1, 2, 3, 4] #orientation of existing dwelling to dadu
wwr             = [10, 20, 30, 40, 50, 60]
assemblies      = [0, 1, 2, 3, 4, 5] #cut down to half? or 3?
infiltration    = [0, 1]
sites           = [0, 1, 2, 3] #four site combinations **tie floor area to site
#0:infill alley
#1:infill no alley
#2:corner alley
#3:corner no alley
# model all site ideas for next week
setbacks        = [0, 1] #use existing, consult rick for options to test
stories         = [1, 2] #one or two stories - currently adiabatic
units           = [1, 2]

#run two sims 40% on one facade (on each direction) vs 40% on all facades. keep glazing area equivalent
#test adiabatic vs nonadiabatic roof impact (1 vs 2 stories)
#test 4 different sizes/volumes to see impact of non-adiabtic surface-volume ratios
#test impact of shading on energy
#include these impacts in thesis, document as i go

param = []
for s in sizes:
    for o in orientation:
        for w in wwr:
            for a in assemblies:
                for i in infiltration:
                    for si in sites:
                        for sb in setbacks:
                            for st in stories:
                                for u in units:
                                    param.append([s, o, w, a, i, si, sb, st, u])
print(len(param))
#print(param)

# size, orientation, wwr, assemblies, infiltration, sites, setbacks, stories, units
# ---------- end parameter_generator ----------
number_slider_2 = Slider(0, range=0..9999)
number_slider_3 = Slider(10000, range=10000..19999)
number_slider_4 = Slider(11336, range=0..20000)
number_slider_5 = Slider(6336, range=0..10000)

# ---- group: floor + ceiling construction
searchmats = HBSearchMaterials(keywords="air")  # -> opaque_mats, window_mats; plug-in component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
searchmats_2 = HBSearchMaterials(keywords="carpet")  # -> opaque_mats, window_mats; plug-in component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
searchmats_3 = HBSearchMaterials(keywords="gypsum")  # -> opaque_mats, window_mats; plug-in component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
list = ItemSelector(
    searchmats_3.opaque_mats,
    {"1/2 in. Gypsum Board", "1/2IN Gypsum", "5/8 in. Gypsum Board", "G01 13mm gypsum board", "G01a 19mm gypsum board", "Generic Gypsum Board", "Gypsum Board - 1/2 in. CBES", "Gypsum Or Plaster Board - 3/8 in.", "NACM_Gypsum Board 5/8in"}, selected="1/2 in. Gypsum Board")
list_2 = ItemSelector(
    searchmats.opaque_mats,
    {"F04 Wall air space resistance", "F05 Ceiling air space resistance", "Generic Ceiling Air Gap", "Generic Wall Air Gap", "Typical Air Wall"}, selected="F04 Wall air space resistance")
list_3 = ItemSelector(
    searchmats_2.opaque_mats,
    {"CP02 CARPET PAD", "Carpet - 3/4 in. CBES", "NACM_Carpet 3/4in", "Typical Carpet Pad"}, selected="CP02 CARPET PAD")
opaqueconstr = HBOpaqueConstruction(name="Ceiling_Residential", materials=[list_2, list])  # -> constr; plug-in component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
opaqueconstr_2 = HBOpaqueConstruction(name="Floor_Residential", materials=[list_2, list_3])  # -> constr; plug-in component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

# ---- group: zone_program
bldgprograms = HBBuildingPrograms({"LargeOffice", "MediumOffice", "SmallOffice", "MidriseApartment", "HighriseApartment", "Retail", "StripMall", "PrimarySchool", "SecondarySchool", "SmallHotel", "LargeHotel", "Hospital", "Outpatient", "Laboratory", "Warehouse", "SuperMarket", "FullServiceRestaurant", "QuickServiceRestaurant", "Courthouse", "LargeDataCenterHighITE", "LargeDataCenterLowITE", "SmallDataCenterHighITE", "SmallDataCenterLowITE"}, selected="MidriseApartment")
searchprog = HBSearchPrograms(bldg_prog=bldgprograms, keywords="Apartment")  # -> room_prog; plug-in component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
list_4 = ItemSelector(searchprog, {"2019::MidriseApartment::Apartment"}, selected="2019::MidriseApartment::Apartment")

# ----
# !add to parameters component:
# - site type (0,1,2,3 [infill vs corner and alley vs no alley, including context geo)
# - rotation on lot
# - setback options
# - FAR impact on max size
# - orientation of existing house to DADU
panel_3 = Panel(parameter_generator.out)
connected_3 = GetConnectedObjects(Objects=Slider(43755, range=0..46080))
parameters = GhPythonScript(param=parameter_generator.param, i=Slider(10, range=0..10))  # -> out, orientation, shading, wwr, glazing, shgc, ext_ins_mat, ext_ins_t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; inputs param: list, i: Int32
# ---------- parameters: Python ----------
__author__ = "tmendeze, ppape"


assemblies = {
    0: {'frame':'2x4 Wood Studs',  'cellulose':0.00, 'polyiso':1.},
    1: {'frame':'2x4 Wood Studs',  'cellulose':3.50, 'polyiso':0.},
    2: {'frame':'2x6 Wood Studs',  'cellulose':5.50, 'polyiso':0.},
    3: {'frame':'2x8 Wood Studs',  'cellulose':7.25, 'polyiso':0.},
    4: {'frame':'2x10 Wood Studs', 'cellulose':9.25, 'polyiso':0.},
    5: {'frame':'2x10 Wood Studs', 'cellulose':9.25, 'polyiso':1.}}

setbackd = {
    0:{
        0: {'rear':0, 'side':5, 'structure':5},  #existing infill/alley
        1: {'rear':5, 'side':5, 'structure':5},  #existing infill/no alley
        2: {'rear':0, 'side':5, 'structure':5},  #existing corner/alley - ***HOW DOES THIS WORK?***
        3: {'rear':5, 'side':5, 'structure':5}}, #existing corner/no alley
    1:{
        0: {'rear':0, 'side':5, 'structure':5},  #potential infill/alley
        1: {'rear':0, 'side':5, 'structure':5},  #potential infill/no alley
        2: {'rear':0, 'side':5, 'structure':5},  #potential corner/alley
        3: {'rear':0, 'side':5, 'structure':5}}} #potential corner/no alley

#assemblies = {
#    0: {'frame':'2x4 Wood Studs',  'cellulose':0.00, 'polyiso':0.},
#    1: {'frame':'2x4 Wood Studs',  'cellulose':0.00, 'polyiso':0.5},
#    2: {'frame':'2x4 Wood Studs',  'cellulose':0.00, 'polyiso':1.},
#    3: {'frame':'2x4 Wood Studs',  'cellulose':3.50, 'polyiso':0.},
#    4: {'frame':'2x6 Wood Studs',  'cellulose':5.50, 'polyiso':0.},
#    5: {'frame':'2x8 Wood Studs',  'cellulose':7.25, 'polyiso':0.},
#    6: {'frame':'2x10 Wood Studs', 'cellulose':9.25, 'polyiso':0.},
#    7: {'frame':'2x10 Wood Studs', 'cellulose':9.25, 'polyiso':1.},
#    8: {'frame':'2x10 Wood Studs', 'cellulose':9.25, 'polyiso':2.},
#    9: {'frame':'2x10 Wood Studs', 'cellulose':9.25, 'polyiso':3.},
#    10:{'frame':'2x10 Wood Studs', 'cellulose':9.25, 'polyiso':4.},
#    11:{'frame':'2x10 Wood Studs', 'cellulose':9.25, 'polyiso':5.}}

infd = {0:.00059, 1:.00015} #cu-m (air)/s*m^2(facade)
dadu_sizes = {
    1:{ 0:200, 1:400, 2:600, 3:800, 4:1000},
    2:{ 0:600, 1:700, 2:800, 3:900, 4:1000}}

p = param[i]
print p

orientation     = p[1]
wwr             = p[2] / 100.
assembly        = assemblies[p[3]]
inf_rate        = infd[p[4]]
site            = p[5]
setbacks        = p[6]
num_stories     = p[7]
size            = dadu_sizes[num_stories][p[0]]
num_dadus       = p[8]

if num_stories == 1:
    height = 10
    footprint = size
else:
    height = 20
    footprint = size / 2.

shading         = 0
glazing         = 'Aluminum Double'
shgc            = .25
ext_ins_mat     = 'Polyiso'
ext_ins_t       = assembly['polyiso']
int_ins_mat     = 'Cellulose'
int_ins_t       = assembly['cellulose']
frame           = assembly['frame']

setback         = setbackd[setbacks][site]
rear_setback    = setback['rear']
side_setback    = setback['side']
structure_setback = setback['structure']


odict = {1:'n', 2:'s', 3:'e', 4:'w'}

filename = '{}_'.format(odict[orientation])
for n in p[2:-1]:
    filename += str(n) +'_'
filename = filename[:-1]

print 'size', size
print 'orientation', odict[orientation]
print 'wwr', wwr 
print 'assembly', assembly 
print 'inf_rate', inf_rate
print 'site', site
print 'setback', setbacks
print 'rear_setback', rear_setback
print 'side_setback', side_setback
print 'structure_setback', structure_setback
print 'num_stories', num_stories
print 'num_dadus', num_dadus
# ---------- end parameters ----------
rear_setback = Number(parameters.rear_setback)
side_setback = Number(parameters.side_setback)
structure_setback = Number(parameters.structure_setback)

# ---- group: znames
entwine = Entwine(Branch00="zone1", Branch01="zone2", FlattenInputs=True)
filter = StreamFilter(Gate=parameters.num_stories, Stream1="zone1", Stream2=entwine)

# ---- group: site
pipeline = GeometryPipeline(
    GroupByLayer=False,
    GroupByType=False,
    IncludeHidden=True,
    IncludeLocked=True,
    LayerFilter="sites::1-infill_no-alley::existing",
    NameFilter="*",
    SublayerFiltering=True,
    TypeFilter=1073741848)
pipeline_2 = GeometryPipeline(
    GroupByLayer=False,
    GroupByType=False,
    IncludeHidden=True,
    IncludeLocked=True,
    LayerFilter="sites::3-corner_no-alley::context",
    NameFilter="*",
    SublayerFiltering=True,
    TypeFilter=1073741848)
pipeline_3 = GeometryPipeline(
    GroupByLayer=False,
    GroupByType=False,
    IncludeHidden=True,
    IncludeLocked=True,
    LayerFilter="sites::1-infill_no-alley::lot_line",
    NameFilter="*",
    SublayerFiltering=True,
    TypeFilter=4)
pipeline_4 = GeometryPipeline(
    GroupByLayer=False,
    GroupByType=False,
    IncludeHidden=True,
    IncludeLocked=True,
    LayerFilter="sites::1-infill_no-alley::context",
    NameFilter="*",
    SublayerFiltering=True,
    TypeFilter=1073741848)
pipeline_5 = GeometryPipeline(
    GroupByLayer=False,
    GroupByType=False,
    IncludeHidden=True,
    IncludeLocked=True,
    LayerFilter="sites::3-corner_no-alley::existing",
    NameFilter="*",
    SublayerFiltering=True,
    TypeFilter=1073741848)
pipeline_6 = GeometryPipeline(
    GroupByLayer=False,
    GroupByType=False,
    IncludeHidden=True,
    IncludeLocked=True,
    LayerFilter="sites::3-corner_no-alley::lot_line",
    NameFilter="*",
    SublayerFiltering=True,
    TypeFilter=4)
pipeline_7 = GeometryPipeline(
    GroupByLayer=False,
    GroupByType=False,
    IncludeHidden=True,
    IncludeLocked=True,
    LayerFilter="sites::0-infill_alley::existing",
    NameFilter="*",
    SublayerFiltering=True,
    TypeFilter=1073741848)
pipeline_8 = GeometryPipeline(
    GroupByLayer=False,
    GroupByType=False,
    IncludeHidden=True,
    IncludeLocked=True,
    LayerFilter="sites::2-corner_alley::existing",
    NameFilter="*",
    SublayerFiltering=True,
    TypeFilter=1073741848)
pipeline_9 = GeometryPipeline(
    GroupByLayer=False,
    GroupByType=False,
    IncludeHidden=True,
    IncludeLocked=True,
    LayerFilter="sites::0-infill_alley::lot_line",
    NameFilter="*",
    SublayerFiltering=True,
    TypeFilter=4)
pipeline_10 = GeometryPipeline(
    GroupByLayer=False,
    GroupByType=False,
    IncludeHidden=True,
    IncludeLocked=True,
    LayerFilter="sites::2-corner_alley::lot_line",
    NameFilter="*",
    SublayerFiltering=True,
    TypeFilter=4)
pipeline_11 = GeometryPipeline(
    GroupByLayer=False,
    GroupByType=False,
    IncludeHidden=True,
    IncludeLocked=True,
    LayerFilter="sites::0-infill_alley::context",
    NameFilter="*",
    SublayerFiltering=True,
    TypeFilter=1073741848)
pipeline_12 = GeometryPipeline(
    GroupByLayer=False,
    GroupByType=False,
    IncludeHidden=True,
    IncludeLocked=True,
    LayerFilter="sites::2-corner_alley::context",
    NameFilter="*",
    SublayerFiltering=True,
    TypeFilter=1073741848)
entwine_2 = Entwine(Branch00=pipeline_2, Branch01=pipeline_6, Branch02=pipeline_5, FlattenInputs=True)
entwine_3 = Entwine(Branch00=pipeline_12, Branch01=pipeline_10, Branch02=pipeline_8, FlattenInputs=True)
entwine_4 = Entwine(Branch00=pipeline_11, Branch01=pipeline_9, Branch02=pipeline_7, FlattenInputs=True)
entwine_5 = Entwine(Branch00=pipeline_4, Branch01=pipeline_3, Branch02=pipeline, FlattenInputs=True)
filter_2 = StreamFilter(Gate=parameters.site, Stream0=entwine_4, Stream1=entwine_5, Stream2=entwine_3, Stream3=entwine_2)
panel_4 = Panel(filter_2)
bang = ExplodeTree(Data=filter_2)  # -> Branch0, Branch1, Branch2
entwine_6 = Entwine(Branch00=bang.Branch0, Branch01=bang.Branch2, FlattenInputs=True)  # -> flatten(Result)

# ---- group: buildable area on lot
explode = Explode(Curve=bang.Branch1, Recursive=True)  # -> Segments, Vertices
item = ListItem(List=explode.Segments, Index=Slider(0, range=0..3), Wrap=True)
midpt = CurveMiddle(Curve=item)
brep_cp = BrepClosestPoint(Point=midpt, Brep=bang.Branch2)  # -> Point, Normal, Distance
dist = Distance(PointA=brep_cp.Point, PointB=midpt)
item_2 = ListItem(List=explode.Segments, Index=Slider(1, range=0..3), Wrap=True)
item_3 = ListItem(List=explode.Segments, Index=Slider(3, range=0..3), Wrap=True)
subtraction = Subtraction(A=dist, B=structure_setback)
X = UnitX(Factor=side_setback)  # -> expr("-x", UnitVector)
X_2 = UnitX(Factor=side_setback)
Y = UnitY(Factor=subtraction)
Y_2 = UnitY(Factor=rear_setback)
move = Move(Geometry=item, Motion=Y)  # -> Geometry, Transform
move_2 = Move(Geometry=item_3, Motion=X_2)  # -> Geometry, Transform
move_3 = Move(Geometry=item_2, Motion=X)  # -> Geometry, Transform
move_4 = Move(Geometry=item, Motion=Y_2)  # -> Geometry, Transform
ptuvcrvs = IntersectCurves(CU=[move_2.Geometry, move.Geometry], CV=[move_3.Geometry, move_4.Geometry])  # -> flatten(Grid)
panel_5 = Panel(ptuvcrvs)
item_4 = ListItem(List=flatten(ptuvcrvs), Index=Slider(2, range=0..4), Wrap=True)
item_5 = ListItem(List=flatten(ptuvcrvs), Index=Slider(1, range=0..4), Wrap=True)
rec_2pt = Rectangle2Pt(Plane=PlaneXY(0, 0, 0), PointA=item_4, PointB=item_5, Radius=0)  # -> Rectangle, Length
area = Area(Geometry=rec_2pt.Rectangle)  # -> Area, Centroid
explode_2 = Explode(Curve=rec_2pt.Rectangle, Recursive=True)  # -> Segments, Vertices
panel_6 = Panel(rec_2pt.Rectangle)
panel_7 = Panel(area.Area)
item_6 = ListItem(List=explode_2.Segments, Index=Slider(0, range=0..3), Wrap=True)
item_7 = ListItem(List=explode_2.Segments, Index=Slider(1, range=0..3), Wrap=True)
len = Length(Curve=item_6)
len_2 = Length(Curve=item_7)
division = Division(A=len, B=len_2)

# ----
# Simulation Inputs
# Simulation Folder Name:
# Simulation Name:
# .sql Filepath:
path = GhPythonScript()  # -> out, path
# ---------- path: Python ----------
__author__ = "tmendeze"


import studio2021

path = studio2021.TEMP
# ---------- end path ----------
panel_8 = Panel(parameters.filename)
csv_path = GhPythonScript(path=panel, sim_name=parameters.filename)  # -> out, sql_path
# ---------- csv_path: Python ----------
__author__ = "tmendeze"
__version__ = "2021.03.02"

import rhinoscriptsyntax as rs
import os
sql = os.path.join('OpenStudio','run','eplusout.sql')
sql_path = os.path.join(path, sim_name, sql)
# ---------- end csv_path ----------
panel_9 = Panel(path.path)
panel_10 = Panel(csv_path.sql_path)

# ----
# Simulation Outputs
# Output Folder Name:
csv_path_2 = GhPythonScript(path=panel, sim_name=parameters.filename)  # -> out, csv_path
# ---------- csv_path_2: Python ----------
__author__ = "tmendeze"
__version__ = "2021.03.02"

import rhinoscriptsyntax as rs
import os
csv_path = os.path.join(path, sim_name+".csv")
# ---------- end csv_path_2 ----------
panel_11 = Panel(csv_path_2.csv_path)

# ----
# reads parameter comination from generator then sends specified comination of data to black box component to simulate
cities = GhPythonScript(city=0)  # -> out, city, weather_file, kgCo2e_kwh
# ---------- cities: Python ----------
__author__ = "tmendeze"

import rhinoscriptsyntax as rs

from studio2021.functions import city_carbon
reload(city_carbon)
from studio2021.functions.city_carbon import city_EUI
from studio2021.functions.city_carbon import weather

cities = {0: 'Seattle'}

city = cities[city]
kgCo2e_kwh = city_EUI(city)['kg/kWh']
weather_file = weather(city)
# ---------- end cities ----------
set_slider_3 = SetSliderProperties(Slider=connected_3, Range=panel_3)
panel_13 = Panel(cities.city)
panel_14 = Panel(parameters.out)
panel_15 = Panel(filter)
python = GhPythonScript(
    filename=parameters.filename,
    filepath=panel_11,
    site=parameters.site,
    size=parameters.size,
    footprint=parameters.footprint,
    height=parameters.height,
    num_dadus=parameters.num_dadus,
    num_stories=parameters.num_stories,
    inf_rate=parameters.inf_rate,
    orientation=parameters.orientation,
    WWR=parameters.wwr,
    frame=parameters.frame,
    polyiso_t=parameters.ext_ins_t,
    cellulose_t=parameters.int_ins_t,
    setback=parameters.setbacks,
    rear_setback=parameters.rear_setback,
    side_setback=parameters.side_setback,
    structure_setback=parameters.structure_setback,
    kgCO2e=cities.kgCo2e_kwh)  # -> out, adu
# ---------- python: Python ----------
__author__ = "papep"
__version__ = "2022.01.25"

import rhinoscriptsyntax as rs

class ADU(object):
    
    def __init__(self, filename, filepath, site, size, footprint, height, num_dadus, num_stories, inf_rate,
                orientation, WWR, frame, polyiso_t, cellulose_t, setback, rear_setback, side_setback, structure_setback,
                kgCO2e):
       self.filename = filename
       self.filepath = filepath
       self.site = site
       self.size = size
       self.footprint = footprint
       self.height = height
       self.num_dadus = num_dadus
       self.num_stories = num_stories
       self.inf_rate = inf_rate
       self.orientation = orientation
       self.WWR = WWR
       self.frame = frame
       self.polyiso_t = polyiso_t
       self.cellulose_t = cellulose_t
       self.setback = setback
       self.rear_setback = rear_setback
       self.side_setback = side_setback
       self.structure_setback = structure_setback
       self.kgCO2e = kgCO2e
       self.num_adiabatic = None
       self.surf_area = None
       self.volume = None
       self.site_buildable = None
       self.eui = None
       self.carbon = None

    def write_csv(self):
        fh = open(self.filepath, 'w') # write but do not overwrite filename if it exists
        
        fh.write("{}, {}, {}, {}, {}, {}, {}, {}, {}, {}, {}, {}, {}, {}, {}, {}, {}, {}, {}, {}, {}".format(
        self.filename, self.site, self.size, self.footprint, self.height, self.num_dadus, 
        self.num_stories, self.num_adiabatic, self.inf_rate, self.orientation, self.WWR, self.frame, 
        self.polyiso_t, self.cellulose_t, self.setback, self.rear_setback, self.side_setback, 
        self.structure_setback, self.site_buildable, self.surf_area, self.volume, self.EUI, self.carbon, self.kgCO2e))
        
        fh.close()

    def calc_carbon(self):
        self.carbon = self.EUI * self.size * self.kgCO2e

adu = ADU(filename, filepath, site, size, footprint, height, num_dadus, num_stories, inf_rate,
                orientation, WWR, frame, polyiso_t, cellulose_t, setback, rear_setback, side_setback, 
                structure_setback, kgCO2e)

print "filename:", filename
print "site:", site
print "size:", size
print "footprint:", footprint
print "height:", height
print "num_dadus:", num_dadus
print "num_stories:", num_stories
print "inf_rate:", inf_rate
print "orientation:", orientation
print "wwr:", WWR
print "frame:", frame
print "polyiso_t", polyiso_t
print "cellulose_t:", cellulose_t
print "setback:", setback
print "rear_setback", rear_setback
print "side_setback:", side_setback
print "structure_setback:", structure_setback
print "kgCO2e:", kgCO2e
# ---------- end python ----------
panel_16 = Panel(python.out)
python_2 = GhPythonScript()  # -> out, adu
# ---------- python_2: Python ----------
__author__ = "papep"
__version__ = "2022.01.25"

import rhinoscriptsyntax as rs

adu.num_adiabatic = num_adiabatic
# ---------- end python_2 ----------

# ---- group: generate massing by area and stories
consarearec = ConstrainedAreaRectangle(Plane=PlaneXY(0, 0, 0), Area=parameters.footprint, FactorX=division, FactorY=Slider(1, range=0..1))  # -> Rectangle, DimensionX, DimensionY
area_2 = Area(Geometry=consarearec.Rectangle)  # -> Area, Centroid
move2pt = MoveToPoint(Geometry=consarearec.Rectangle, PointA=area_2.Centroid, PointB=area.Centroid)  # -> Moved, Vector, Transform
panel_17 = Panel(area_2.Area)
debrep = DeconstructBrep(Brep=move2pt.Moved)  # -> Faces, Edges, Vertices
boundary = BoundarySurfaces(FloorCrvs=debrep.Edges)  # -> simplify(Surfaces)
division_2 = Division(A=parameters.height, B=Slider(2, range=0..10))
filter_3 = StreamFilter(Gate=parameters.num_stories, Stream1=parameters.height, Stream2=division_2)
Z = UnitZ(Factor=filter_3)
extr = Extrude(Base=boundary, Direction=Z)
move_5 = Move(Geometry=extr, Motion=Z)  # -> Geometry, Transform

# ----
panel_18 = Panel(python_2.out)
sunion = SolidUnion(Breps=[move_5.Geometry, extr])
volume = Volume(Geometry=sunion)  # -> expr("x*2", Volume), Centroid
area_3 = Area(Geometry=sunion)  # -> Area, Centroid
panel_19 = Panel("filename, site, size, footprint, height, num_dadus, num_stories, num_adiabatic, inf_rate, orientation, WWR, frame, polyiso_t, cellulose_t, setback, rear_setback, side_setback, structure_setback, EUI, embodied_carbon")
# create one csv/text file for each sim
# 
# then combine(in case of crash)
# 
# can add column "num_adiabatic": all 0 to make compatible with future datasets
csv = CreateCSV(DataGridHeaders=panel_19, Delimiter=",")

# ----
# Run Energy
# Simulation
run_energy_simulation = BooleanToggle(False)

check_previous = GhPythonScript(filename=parameters.filename, run=run_energy_simulation)  # -> out, run
# ---------- check_previous: Python ----------
__author__ = "tmendeze"

import rhinoscriptsyntax as rs

import studio2021
import os


files = []
for f in os.listdir(os.path.join(studio2021.TEMP)):#change dir
    if f.endswith('.csv'):
        files.append(f)

fn = filename + '.csv'

if fn in files:
    run = False
# ---------- end check_previous ----------
panel_20 = Panel(check_previous.out)

# ---- group: visualization
faceattr = HBFaceAttributes({"Display Name": "display_name", "Simulation Name (Identifier)": "identifier", "Boundary Condition": "boundary_condition", "Has Parent": "has_parent", "Parent": "parent", "Area": "area", "Perimeter": "perimeter", "Face Type": "type", "Aperture Is Operable": "is_operable", "Door Is Glass": "is_glass"}, selected="Boundary Condition")

# ---- group: create hb model
num_stories = Number(parameters.num_stories)
filter_4 = StreamFilter(Gate=num_stories, Stream1=extr, Stream2=[move_5.Geometry, extr])
toggle = BooleanToggle(True)
shade = HBShade(geo=entwine_6)  # -> report, shades; plug-in component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
clean = CleanTree(RemoveNulls=True, RemoveInvalid=True, RemoveEmpty=False, Tree=shade.shades)

# ----
intsolid = HBIntersectSolids(solids=flatten(filter_4), run=Toggle(True))  # -> int_solids; plug-in component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

# ---- group: create hb model (continued)
roomsolid = HBRoomFromSolid(geo=flatten(intsolid), name=filter, program=list_4, conditioned=True)  # -> report, rooms; plug-in component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
flatten = FlattenTree(Tree=roomsolid.rooms, Path="{0}")
panel_21 = Panel(roomsolid.rooms)
item_8 = ListItem(List=flatten, Index=0, Wrap=True)
item_9 = ListItem(List=flatten, Index=Slider(3, range=0..10), Wrap=True)
filter_5 = StreamFilter(Gate=num_stories, Stream1=roomsolid.rooms, Stream2=[item_9, item_8])
aperturesbyratio = HBAperturesByRatio(hb_objs=flatten(filter_5), ratio=parameters.wwr)  # -> report, hb_objs; plug-in component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
solveadj = HBSolveAdjacency(rooms=flatten(aperturesbyratio.hb_objs), adiabatic=toggle, run=toggle)  # -> report, adj_rooms; plug-in component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
applyloadvals = HBApplyLoadValues(room_or_program=flatten(solveadj.adj_rooms))  # -> report, mod_obj; plug-in component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
daylightcontrol = HBApplyDaylightControl(rooms=flatten(applyloadvals.mod_obj))  # -> report, rooms; plug-in component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
model = HBModel(rooms=flatten(daylightcontrol.rooms), shades=flatten(clean))  # -> report, model; plug-in component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

# ---- group: visualization (continued)
vizbytype = HBVisualizeByType(hb_objs=solveadj.adj_rooms)  # -> walls, interior_walls, roofs, ceilings, exterior_floors, interior_floors, air_walls, apertures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; plug-in component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
lablefaces = HBLabelFaces(hb_objs=flatten(solveadj.adj_rooms), attribute=faceattr)  # -> label_text, base_pts, labels, wire_frame; plug-in component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
panel_22 = Panel(lablefaces.label_text)
python_3 = GhPythonScript(labels=lablefaces.label_text)  # -> out, num_adiabatic
# ---------- python_3: Python ----------
__author__ = "papep"
__version__ = "2022.01.23"

import rhinoscriptsyntax as rs


num_adiabatic = 0
if labels == "Adiabatic":
    num_adiabatic += 1
# ---------- end python_3 ----------
data = Data(vizbytype.interior_floors)
equals = Equality(FirstNumber=python_3.num_adiabatic, SecondNumber=Slider(1, range=0..1))  # -> Equality, Inequality
panel_23 = Panel(python_3.num_adiabatic)
cull = CullPattern(List=python_3.num_adiabatic, CullPattern=equals.Equality)
lng = ListLength(List=cull)

# ----
mesh = Mesh(vizbytype.interior_floors)
panel_24 = Panel(mesh)
panel_25 = Panel(solveadj.report)
run_sim = Run_sim(
    model=model.model,
    epw_file=cities.weather_file,
    G=parameters.orientation,
    folder=panel_9,
    write=run_energy_simulation,
    run=run_energy_simulation)
calccarbon = GhPythonScript(adu=python_2.adu, EUI=run_sim)  # -> out, adu
# ---------- calccarbon: Python ----------
__author__ = "papep"
__version__ = "2022.01.25"

import rhinoscriptsyntax as rs

adu.EUI = EUI
adu.calc_carbon()
# ---------- end calccarbon ----------
panel_26 = Panel(calccarbon.out)
# compare euis between components
write_csv = GhPythonScript(adu=calccarbon.adu)  # -> out
# ---------- write_csv: Python ----------
__author__ = "papep"
__version__ = "2022.01.26"

import rhinoscriptsyntax as rs

adu.write_csv()

print "filename:", adu.filename
print "site:", adu.site
print "size:", adu.size
print "footprint:", adu.footprint
print "height:", adu.height
print "num_dadus:", adu.num_dadus
print "num_stories:", adu.num_stories
print "num_adiabatic:", adu.num_adiabatic
print "inf_rate:", adu.inf_rate
print "orientation:", adu.orientation
print "wwr:", adu.WWR
print "frame:", adu.frame
print "polyiso_t", adu.polyiso_t
print "cellulose_t:", adu.cellulose_t
print "setback:", adu.setback
print "rear_setback", adu.rear_setback
print "side_setback:", adu.side_setback
print "structure_setback:", adu.structure_setback
print "site_buildable:", adu.site_buildable
print "surf_area:", adu.surf_area
print "volume:", adu.volume
print "kgCO2e:", adu.kgCO2e
print "eui:", adu.EUI
print "carbon:", adu.carbon
print "
# ---------- end write_csv ----------
panel_27 = Panel(write_csv)

# ==== cluster Run_sim
simoutput = HBSimulationOutput(zone_energy_use=Toggle(True), gains_and_losses=Toggle(True))  # -> report, sim_output; plug-in component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
G = ClusterInput()
filter = StreamFilter(
    Gate=G,
    Stream1=Slider(0, range=0..100),
    Stream2=Slider(180, range=0..1000),
    Stream3=Slider(270, range=0..270),
    Stream4=Slider(90, range=0..1000))
simpar = HBSimulationParameter(north=filter, output=simoutput.sim_output, timestep=6)  # -> sim_par; plug-in component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
model = ClusterInput()
epw_file = ClusterInput()
folder = ClusterInput()
write = ClusterInput()
run = ClusterInput()
modeltoosm = HBModelToOSM(model=model, epw_file=epw_file, sim_par=simpar, folder=folder, write=write, run=run)  # -> report, jsons, osw, osm, idf, sql, zsz, rdd, html; plug-in component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
panel = Panel(modeltoosm.html)
roomenergyresult = HBReadRoomEnergyResult(sql=modeltoosm.sql)  # -> cooling, heating, lighting, electric_equip, gas_equip, process, hot_water, fan_electric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; plug-in component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
eui = HBEndUseIntensity(sql=modeltoosm.sql, ip=Toggle(False))  # -> eui, eui_end_use, end_uses, gross_floor; plug-in component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
eui_2 = ClusterOutput(eui.eui)
