# Grasshopper definition sim_gen_comp_analysis_fleming_2s2z.gh (Grasshopper 1.0.7)
# plug-ins: Human

panel = Panel("AREA: 1144.30908")
# CEDAR A:
# SITE: 2
# SIZE: 476
# FOOTPRINT: 476
# HEIGHT: 11.1
# NUM_STORIES: 1
# NUM_ZONES: 1
# INF_RATE: .00059
# ORIENTATION: N
# WWR: 0.206
# FRAME: 2X6
# POLYISO_T: 0
# CELLULOSE_T: 6
# REAR: 0
# SIDE: 5
# STRUCTURE: 5
panel_2 = Panel("WIN_AREA: 236.23976")

bldgprograms = HBBuildingPrograms({"LargeOffice", "MediumOffice", "SmallOffice", "MidriseApartment", "HighriseApartment", "Retail", "StripMall", "PrimarySchool", "SecondarySchool", "SmallHotel", "LargeHotel", "Hospital", "Outpatient", "Laboratory", "Warehouse", "SuperMarket", "FullServiceRestaurant", "QuickServiceRestaurant", "Courthouse", "LargeDataCenterHighITE", "LargeDataCenterLowITE", "SmallDataCenterHighITE", "SmallDataCenterLowITE"}, selected="MidriseApartment")
searchprog = HBSearchPrograms(bldg_prog=bldgprograms, keywords="Apartment")  # -> room_prog; plug-in component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
list = ItemSelector(searchprog, {"2019::MidriseApartment::Apartment"}, selected="2019::MidriseApartment::Apartment")
panel_3 = Panel("shading - CONTEXT")
panel_4 = Panel("zones")
panel_5 = Panel("roof")
panel_6 = Panel("windows")
brep = Brep([<brep referenced from the Rhino model> x12])
brep_2 = Brep([<brep referenced from the Rhino model> x6])
brep_3 = Brep([<brep referenced from the Rhino model> x2])
brep_4 = Brep(<brep referenced from the Rhino model>)

panel_7 = Panel("C:\Users\papep\Documents\GitHub\msdc-thesis\data\USA_WA_Seattle-Tacoma.Intl.AP.727930_TMY3.epw")
panel_8 = Panel("AREA: 1497.06")
# CEDAR B:
# SITE: 2
# SIZE: 636
# FOOTPRINT: 636
# HEIGHT: 12.4
# NUM_STORIES: 1
# NUM_ZONES: 2
# INF_RATE: .00059
# ORIENTATION: N
# WWR: 0.1986
# FRAME: 2X6
# POLYISO_T: 0
# CELLULOSE_T: 6
# REAR: 0
# SIDE: 5
# STRUCTURE: 5
panel_9 = Panel("WIN_AREA: 297.35221")
panel_10 = Panel("AREA: 2085.6")
# FLEMING:
# SITE: 2
# SIZE: 1221.8
# FOOTPRINT: 549.4
# HEIGHT: 19.7
# NUM_STORIES: 2
# NUM_ZONES: 2
# INF_RATE: .00059
# ORIENTATION: N
# WWR: .1646
# FRAME:
# POLYISO_T:
# CELLULOSE_T:
# REAR: 0
# SIDE: 5
# STRUCTURE: 5
panel_11 = Panel("WIN_AREA: 343.2")

# ----
# Run Energy
# Simulation
run_energy_simulation = BooleanToggle(False)

number_slider = Slider(5, range=0..10)
number_slider_2 = Slider(0.00059, range=0..0.01)
number_slider_3 = Slider(0, range=0..100)
panel_12 = Panel("C:\Users\papep\Documents\GitHub\msdc-thesis\results\comp_analysis\FLEMING-2S2Z.csv")
python = GhPythonScript(
    site=Slider(2, range=0..10),
    size="1221.8",
    footprint="549.4",
    height="19.7",
    num_units=Slider(2, range=1..2),
    num_stories=Slider(2, range=1..2),
    inf_rate=number_slider_2,
    orientation="N",
    WWR=".1646",
    frame="2x6",
    polyiso_t=Slider(0, range=0..100),
    cellulose_t=Slider(6, range=0..10),
    setback=number_slider_3,
    rear_setback=number_slider_3,
    side_setback=number_slider,
    structure_setback=number_slider,
    kgCO2e=Slider(0.096116, range=0..1))  # -> out, adu
# ---------- python: Python ----------
__author__ = "papep"
__version__ = "2022.01.25"

import rhinoscriptsyntax as rs

class ADU(object):
    
    def __init__(self, site, size, footprint, height, num_stories, num_units, inf_rate,
                orientation, WWR, frame, polyiso_t, cellulose_t, setback, rear_setback, side_setback, structure_setback,
                kgCO2e):
       self.filepath            = None
       self.site                = site
       self.size                = float(size)
       self.footprint           = float(footprint)
       self.height              = height
       self.num_stories         = num_stories
       self.num_units           = num_units
       self.inf_rate            = inf_rate
       self.orientation         = orientation
       self.WWR                 = float(WWR)
       self.frame               = frame
       self.polyiso_t           = polyiso_t
       self.cellulose_t         = cellulose_t
       self.setback             = setback
       self.rear_setback        = rear_setback
       self.side_setback        = side_setback
       self.structure_setback   = structure_setback
       self.kgCO2e              = kgCO2e
       self.assembly_r          = None
       self.cool                = None
       self.heat                = None
       self.light               = None
       self.eq                  = None
       self.dhw                 = None
       self.eui_kwh             = None
       self.eui_kbtu            = None
       self.carbon              = None

    def write_csv(self):
        fh = open(self.filepath, 'w') # write but do not overwrite filename if it exists
        
        fh.write("{}, {}, {}, {}, {}, {}, {}, {}, {}, {}, {}, {}, {}, {}, {}, {}, {}, {}, {}, {}, {}, {}, {}, {}, {}".format(
        "site", "size", "footprint", "height", "num_stories", "num_zones", "inf_rate", "orientation", "WWR", "frame",
        "polyiso_t", "cellulose_t", "setback", "rear_setback", "side_setback", "structure setback", "assembly_r",
        "cool", "heat", "light", "eq", "dhw", "eui_kwh", "eui_kbtu", "carbon", "kgCO2e"))
        fh.write("\n")
        fh.write("{}, {}, {}, {}, {}, {}, {}, {}, {}, {}, {}, {}, {}, {}, {}, {}, {}, {}, {}, {}, {}, {}, {}, {}, {}".format(
        self.site, self.size, self.footprint, self.height,  
        self.num_stories, self.num_units, self.inf_rate, self.orientation, self.WWR, self.frame, 
        self.polyiso_t, self.cellulose_t, self.setback, self.rear_setback, self.side_setback, self.structure_setback, 
        self.assembly_r, self.cool, self.heat, self.light, self.eq,
        self.dhw, self.eui_kwh, self.eui_kbtu, self.carbon, self.kgCO2e))

        fh.close()

    def add_eui_results(self, cool, heat, light, eq, dhw):
    
            cool_tot = 0
            heat_tot = 0
            light_tot = 0
            eq_tot = 0
            dhw_tot = 0
            for i in range(len(cool)):
                c = sum(cool[i])
                h = sum(heat[i])
                l = sum(light[i])
                e = sum(eq[i])
                w = sum(dhw[i])
                cool_tot += c
                heat_tot += h
                light_tot += l
                eq_tot += e
                dhw_tot += w

            self.cool       = cool_tot * 3.41214 / self.size
            self.heat       = heat_tot * 3.41214 / self.size / 3.5
            self.light      = light_tot * 3.41214 / self.size
            self.eq         = eq_tot * 3.41214 / self.size
            self.dhw        = dhw_tot * 3.41214 / self.size
            self.eui_kbtu   = self.cool + self.heat + self.light + self.eq + self.dhw

    def calc_carbon(self, m2):
        self.eui_kwh = self.eui_kbtu * 3.2
        if self.eui_kwh != None:
            self.carbon = self.eui_kwh * self.kgCO2e * m2
#            self.eui_kwh = self.eui_kwh * 10.764 / self.size 
        else:
            self.carbon = None

adu = ADU(site, size, footprint, height, num_stories, num_units, inf_rate,
                orientation, WWR, frame, polyiso_t, cellulose_t, setback, rear_setback, side_setback, 
                structure_setback, kgCO2e)

print "site:", adu.site
print "size:", adu.size
print "footprint:", adu.footprint
print "height:", adu.height
print "num_stories:", adu.num_stories
print "num_units:", adu.num_units
print "inf_rate:", adu.inf_rate
print "orientation:", adu.orientation
print "wwr:", adu.WWR
print "frame:", adu.frame
print "polyiso_t", adu.polyiso_t
print "cellulose_t:", adu.cellulose_t
print "setback:", adu.setback
print "rear_setback", adu.rear_setback
print "side_setback:", adu.side_setback
print "structure_setback:", adu.structure_setback
print "kgCO2e:", adu.kgCO2e
# ---------- end python ----------
panel_13 = Panel(python.out)
faceenergyattr = HBFaceEnergyAttributes({"Construction": "properties.energy.construction.display_name", "Materials": "properties.energy.construction.layers", "Thickness [m]": "properties.energy.construction.thickness", "Density [kg/m2]": "properties.energy.construction.mass_area_density", "Heat Capacity [kg/K-m2]": "properties.energy.construction.area_heat_capacity", "R-Value [m2-K/W]": "properties.energy.construction.r_value", "U-Value [W/m2-K]": "properties.energy.construction.u_value", "U-Factor [W/m2-K]": "properties.energy.construction.u_factor", "SHGC [Unshaded]": "properties.energy.construction.shgc", "Solar Transmitance [Unshaded]": "properties.energy.construction.solar_transmittance", "Visible Transmitance [Unshaded]": "properties.energy.construction.visible_transmittance", "Solar Reflectance [Outside]": "properties.energy.construction.outside_solar_reflectance", "Solar Reflectance [Inside]": "properties.energy.construction.inside_solar_reflectance", "Fraction Area Operable": "properties.energy.vent_opening.fraction_area_operable", "Fraction Height Operable": "properties.energy.vent_opening.fraction_height_operable", "Discharge Coefficient": "properties.energy.vent_opening.discharge_coefficient"}, selected="Construction")
faceattr = HBFaceAttributes({"Display Name": "display_name", "Simulation Name (Identifier)": "identifier", "Boundary Condition": "boundary_condition", "Has Parent": "has_parent", "Parent": "parent", "Area": "area", "Perimeter": "perimeter", "Face Type": "type", "Aperture Is Operable": "is_operable", "Door Is Glass": "is_glass"}, selected="Display Name")

# ----
# fiber cement panel
# air barrier
# r-10 rigid ins.
# 1/2" plywood sheathing
# 2x6 wood studs
# r-21 batt ins.
# 1/2" gyp
number_slider_4 = Slider(3.7, range=0..10)
panel_14 = Panel("Cellulose")
panel_15 = Panel("Polyiso")
multiplication = Multiplication(A=number_slider_4, B=Slider(6, range=0..10))
panel_16 = Panel("Wood")
division = Division(A=Slider(21, range=0..100), B=5.67826)
windowmat = HBWindowMaterial(name="aluminum", u_factor=flatten("1.98"), shgc=flatten(0.25), t_vis=flatten("0.63"))  # -> mat; plug-in component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
multiplication_2 = Multiplication(A=Slider(7, range=0..10), B=Slider(0, range=0..1))
panel_17 = Panel("Gyp")
division_2 = Division(A=Slider(1, range=0..1), B=5.67826)
division_3 = Division(A="0.63", B=5.67826)
division_4 = Division(A=Slider(10, range=0..10), B=5.67826)
multiplication_3 = Multiplication(A=division, B="0.906")
windowconstr = HBWindowConstruction(name="NGlass", materials=flatten(windowmat))  # -> constr; plug-in component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
division_5 = Division(A=Slider(0.93, range=0..1), B=5.67826)
opaquemat = HBOpaqueMaterial(
    name="InteriorFinish",
    thickness=Slider(0.0127, range=0..0.1),
    conductivity=Slider(0.16, range=0..1),
    density=Slider(800, range=0..1000),
    spec_heat=Slider(109, range=0..1000))  # -> mat; plug-in component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
opaquematnomass = HBOpaqueMaterialNoMass(name="AirGap", r_value=division_2)  # -> flatten(mat); plug-in component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
opaquematnomass_2 = HBOpaqueMaterialNoMass(name="1/2\" Plywood", r_value=division_3)  # -> mat; plug-in component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
opaquematnomass_3 = HBOpaqueMaterialNoMass(name="ContExtInsulation", r_value=division_4)  # -> mat; plug-in component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
opaquematnomass_4 = HBOpaqueMaterialNoMass(name="IntInsulation", r_value=multiplication_3)  # -> mat; plug-in component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
opaquematnomass_5 = HBOpaqueMaterialNoMass(name="FacadeCladding", r_value=division_5)  # -> flatten(mat); plug-in component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

cluster = Cluster(
    geo_2=brep_4,
    brep_2=brep_2,
    brep=brep_3,
    program=list,
    adu=python.adu,
    epw_file=panel_7,
    infilt_per_exterior=number_slider_2,
    north=Slider(0, range=0..100),
    write=run_energy_simulation,
    run=run_energy_simulation,
    filepath=panel_12,
    geo=brep,
    ep_constr=windowconstr,
    T=[opaquematnomass_5, opaquematnomass, opaquematnomass_3, opaquematnomass_4, opaquemat],
    mat=opaquemat)  # -> model_2, out, r_val_ip, panel_6

panel_18 = Panel([cluster.r_val_ip, cluster.panel_6])

panel_19 = Panel(cluster.out)
vizbytype = HBVisualizeByType(hb_objs=cluster.model_2)  # -> walls, interior_walls, roofs, ceilings, exterior_floors, interior_floors, air_walls, apertures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; plug-in component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
lablefaces = HBLabelFaces(hb_objs=flatten(cluster.model_2), attribute=faceattr, sub_faces=Toggle(False))  # -> label_text, base_pts, labels, wire_frame; plug-in component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
panel_20 = Panel(lablefaces.label_text)
data = Data(vizbytype.ceilings)

# ==== cluster Cluster
mat = ClusterInput()
searchmats = HBSearchMaterials(keywords="air")  # -> opaque_mats, window_mats; plug-in component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
searchmats_2 = HBSearchMaterials(keywords="carpet")  # -> opaque_mats, window_mats; plug-in component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
searchmats_3 = HBSearchMaterials(keywords="gypsum")  # -> opaque_mats, window_mats; plug-in component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
decnstrmat = HBDeconstructMaterial(mat=mat)  # -> values, attr_names, r_val_si, r_val_ip; plug-in component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
T = ClusterInput()
panel = Panel(decnstrmat.r_val_si)
clean = CleanTree(RemoveNulls=True, RemoveInvalid=True, RemoveEmpty=False, Tree=flatten(T))
list = ItemSelector(
    searchmats_3.opaque_mats,
    {"1/2 in. Gypsum Board", "1/2IN Gypsum", "5/8 in. Gypsum Board", "G01 13mm gypsum board", "G01a 19mm gypsum board", "Generic Gypsum Board", "Gypsum Board - 1/2 in. CBES", "Gypsum Or Plaster Board - 3/8 in.", "NACM_Gypsum Board 5/8in"}, selected="1/2 in. Gypsum Board")
list_2 = ItemSelector(
    searchmats.opaque_mats,
    {"F04 Wall air space resistance", "F05 Ceiling air space resistance", "Generic Ceiling Air Gap", "Generic Wall Air Gap", "Typical Air Wall"}, selected="F04 Wall air space resistance")
list_3 = ItemSelector(
    searchmats_2.opaque_mats,
    {"CP02 CARPET PAD", "Carpet - 3/4 in. CBES", "NACM_Carpet 3/4in", "Typical Carpet Pad"}, selected="CP02 CARPET PAD")
brep = ClusterInput()
opaqueconstr = HBOpaqueConstruction(name="ExteriorWall", materials=clean)  # -> constr; plug-in component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
planarize = HBPlanarizeBrep(brep=brep)  # -> report, pl_brep; plug-in component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
intsolid = HBIntersectSolids(solids=flatten(planarize.pl_brep), run=Toggle(True))  # -> int_solids; plug-in component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
opaqueconstr_2 = HBOpaqueConstruction(name="Floor_Residential", materials=[list, list_2, list_3])  # -> constr; plug-in component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
decnstrconstr = HBDeconstructConstruction(constr=opaqueconstr)  # -> materials, layers, r_val_si, r_val_ip, u_fac_si, u_fac_ip, t_sol, t_vis; plug-in component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
panel_2 = Panel(decnstrconstr.materials)
opaqueconstr_3 = HBOpaqueConstruction(name="Ceiling_Residential", materials=[list_3, list_2, list])  # -> constr; plug-in component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
panel_3 = Panel([opaqueconstr_3, opaqueconstr_2])
planarize_2 = HBPlanarizeBrep(brep=intsolid)  # -> report, pl_brep; plug-in component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
program = ClusterInput()
one_over_x = OneOverX(Value=decnstrconstr.u_fac_ip)
searchconstrset = HBSearchConstructionSets()  # -> constr_sets; plug-in component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
toggle = BooleanToggle(True)
groundsubset = HBGroundConstructionSubset(ground_floor=opaqueconstr_2)  # -> ground_set; plug-in component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
interiorsubset = HBInteriorConstructionSubset(ceiling=opaqueconstr_3, interior_floor=opaqueconstr_2)  # -> interior_set; plug-in component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
exteriorsubset = HBExteriorConstructionSubset(exterior_wall=opaqueconstr, exposed_floor=opaqueconstr_2)  # -> exterior_set; plug-in component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
panel_4 = Panel([opaqueconstr, one_over_x])
list_4 = ItemSelector(
    searchconstrset,
    {"1980_2004::ClimateZone1::Mass", "1980_2004::ClimateZone1::Metal Building", "1980_2004::ClimateZone1::SteelFramed", "1980_2004::ClimateZone1::WoodFramed", "1980_2004::ClimateZone2::Mass", "1980_2004::ClimateZone2::Metal Building"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}, selected="2019::ClimateZone4::WoodFramed")
panel_5 = Panel(exteriorsubset)
brep_2 = ClusterInput()
infilt_per_exterior = ClusterInput()
planarize_3 = HBPlanarizeBrep(brep=brep_2)  # -> report, pl_brep; plug-in component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
constructionset = HBConstructionSet(
    name="dadu_assembly",
    base_constr_set=list_4,
    exterior_subset=exteriorsubset,
    ground_subset=groundsubset,
    interior_subset=interiorsubset)  # -> constr_set; plug-in component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
roomsolid = HBRoomFromSolid(
    geo=flatten(planarize_2.pl_brep),
    constr_set=constructionset,
    program=program,
    conditioned=True,
    roof_angle=Slider(40, range=0..100))  # -> report, rooms; plug-in component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
solveadj = HBSolveAdjacency(rooms=flatten(roomsolid.rooms), adiabatic=toggle, run=toggle)  # -> report, adj_rooms; plug-in component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
decnstrconstrset = HBDeconstructConstructionSet(constr_set=constructionset)  # -> exterior_wall, exterior_roof, exposed_floor, ground_wall, ground_roof, ground_floor, window, skylight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; plug-in component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
geo = ClusterInput()
ep_constr = ClusterInput()
geo_2 = ClusterInput()
aperture = HBAperture(geo=geo, operable=Toggle(False), ep_constr=ep_constr)  # -> report, apertures; plug-in component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
addsubface = HBAddSubface(hb_obj=flatten(solveadj.adj_rooms), sub_faces=flatten(aperture.apertures))  # -> b, hb_obj; plug-in component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
data = Data(addsubface.b)
applyloadvals = HBApplyLoadValues(room_or_program=flatten(addsubface.hb_obj), infilt_per_exterior=infilt_per_exterior)  # -> report, mod_obj; plug-in component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
shade = HBShade(geo=geo_2)  # -> report, shades; plug-in component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
shade_2 = HBShade(geo=planarize_3.pl_brep)  # -> report, shades; plug-in component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
daylightcontrol = HBApplyDaylightControl(rooms=flatten(applyloadvals.mod_obj))  # -> report, rooms; plug-in component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
decnstrconstr_2 = HBDeconstructConstruction(constr=decnstrconstrset.exterior_wall)  # -> materials, layers, r_val_si, r_val_ip, u_fac_si, u_fac_ip, shgc, t_sol, t_vis; plug-in component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
clean_2 = CleanTree(RemoveNulls=True, RemoveInvalid=True, RemoveEmpty=False, Tree=[shade_2.shades, shade.shades])
r_val_ip = ClusterOutput(decnstrconstr_2.r_val_ip)
panel_6 = ClusterOutput("exterior wall")
model = HBModel(rooms=flatten(daylightcontrol.rooms), shades=flatten(clean_2))  # -> report, model; plug-in component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
model_2 = ClusterOutput(model.model)
panel_7 = Panel("C:\Users\papep\Documents\GitHub\msdc-thesis\results\comp_analysis")
simoutput = HBSimulationOutput(zone_energy_use=Toggle(True), gains_and_losses=Toggle(True))  # -> report, sim_output; plug-in component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
shadowcalc = HBShadowCalculation(calc_method="PixelCounting")  # -> shadow_calc; plug-in component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
north = ClusterInput()
simpar = HBSimulationParameter(north=north, output=simoutput.sim_output, timestep=6, shadow_calc=shadowcalc)  # -> sim_par; plug-in component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
epw_file = ClusterInput()
write = ClusterInput()
run = ClusterInput()
modeltoosm = HBModelToOSM(model=model.model, epw_file=epw_file, sim_par=simpar, folder=panel_7, write=write, run=run)  # -> report, jsons, osw, osm, idf, sql, zsz, rdd, html; plug-in component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
panel_8 = Panel(modeltoosm.html)
roomenergyresult = HBReadRoomEnergyResult(sql=modeltoosm.sql)  # -> cooling, heating, lighting, electric_equip, gas_equip, process, hot_water, fan_electric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; plug-in component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
eui = HBEndUseIntensity(sql=modeltoosm.sql, ip=Toggle(True))  # -> eui, eui_end_use, end_uses, gross_floor; plug-in component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
eui_2 = HBEndUseIntensity(sql=modeltoosm.sql, ip=Toggle(False))  # -> eui, eui_end_use, end_uses, gross_floor; plug-in component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
adu = ClusterInput()
panel_9 = Panel([eui.eui, eui.gross_floor])
python = GhPythonScript(
    adu=adu,
    cool=roomenergyresult.cooling,
    heat=roomenergyresult.heating,
    light=roomenergyresult.lighting,
    eq=roomenergyresult.electric_equip,
    dhw=roomenergyresult.hot_water,
    eui_kwh=eui_2.eui,
    m2=eui_2.gross_floor)  # -> out, adu; inputs cool: list, heat: list, light: list, eq: list, dhw: list
# ---------- python: Python ----------
__author__ = "papep"
__version__ = "2022.02.07"

import rhinoscriptsyntax as rs

adu.add_eui_results(cool, heat, light, eq, dhw)
adu.calc_carbon(m2)

print "kgCO2e:", adu.kgCO2e
print "eui_kwh:", adu.eui_kwh
print "eui_kbtu:", adu.eui_kbtu
print "heat:", adu.heat
print "cool:", adu.cool
print "light:", adu.light
print "eq:", adu.eq
print "dhw:", adu.dhw
# ---------- end python ----------
filepath = ClusterInput()
panel_10 = Panel(python.out)
python_2 = GhPythonScript(adu=python.adu, filepath=filepath, assembly_r=decnstrconstr_2.r_val_ip)  # -> out
# ---------- python_2: Python ----------
__author__ = "papep"
__version__ = "2022.05.17"

import rhinoscriptsyntax as rs

if adu.eui_kbtu != 0:
    adu.filepath = filepath
    adu.assembly_r = assembly_r
    adu.write_csv()
    print ".csv written"
# ---------- end python_2 ----------
out = ClusterOutput(python_2)
