# Grasshopper definition sim_gen_1.3.0 - individual test cases.gh (Grasshopper 1.0.7)
# plug-ins: Human, Pufferfish

# ---- group: zone_program
bldgprograms = HBBuildingPrograms({"LargeOffice", "MediumOffice", "SmallOffice", "MidriseApartment", "HighriseApartment", "Retail", "StripMall", "PrimarySchool", "SecondarySchool", "SmallHotel", "LargeHotel", "Hospital", "Outpatient", "Laboratory", "Warehouse", "SuperMarket", "FullServiceRestaurant", "QuickServiceRestaurant", "Courthouse", "LargeDataCenterHighITE", "LargeDataCenterLowITE", "SmallDataCenterHighITE", "SmallDataCenterLowITE"}, selected="MidriseApartment")
searchprog = HBSearchPrograms(bldg_prog=bldgprograms, keywords="Apartment")  # -> room_prog; plug-in component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
list = ItemSelector(searchprog, {"2019::MidriseApartment::Apartment"}, selected="2019::MidriseApartment::Apartment")

# ----
panel = Panel("""rotation:
1 - north
2 - south
3 - east
4 - west""")

# ---- group: floor + ceiling construction
searchmats = HBSearchMaterials(keywords="air")  # -> opaque_mats, window_mats; plug-in component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
searchmats_2 = HBSearchMaterials(keywords="carpet")  # -> opaque_mats, window_mats; plug-in component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
searchmats_3 = HBSearchMaterials(keywords="gypsum")  # -> opaque_mats, window_mats; plug-in component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
list_2 = ItemSelector(
    searchmats_3.opaque_mats,
    {"1/2 in. Gypsum Board", "1/2IN Gypsum", "5/8 in. Gypsum Board", "G01 13mm gypsum board", "G01a 19mm gypsum board", "Generic Gypsum Board", "Gypsum Board - 1/2 in. CBES", "Gypsum Or Plaster Board - 3/8 in.", "NACM_Gypsum Board 5/8in"}, selected="1/2 in. Gypsum Board")
list_3 = ItemSelector(
    searchmats.opaque_mats,
    {"F04 Wall air space resistance", "F05 Ceiling air space resistance", "Generic Ceiling Air Gap", "Generic Wall Air Gap", "Typical Air Wall"}, selected="F04 Wall air space resistance")
list_4 = ItemSelector(
    searchmats_2.opaque_mats,
    {"CP02 CARPET PAD", "Carpet - 3/4 in. CBES", "NACM_Carpet 3/4in", "Typical Carpet Pad"}, selected="CP02 CARPET PAD")
opaqueconstr = HBOpaqueConstruction(name="Ceiling_Residential", materials=[list_3, list_2])  # -> constr; plug-in component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
opaqueconstr_2 = HBOpaqueConstruction(name="Floor_Residential", materials=[list_3, list_4])  # -> constr; plug-in component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

# ----
sim_name = Panel("""400sqft_80sqftglaz_s_site1
400sqft_80sqftglaz_e_site1
400sqft_80sqftglaz_n_site1
400sqft_80sqftglaz_w_site1
400sqft_80sqftglaz_all_site1
400sqft_320sqftglaz_all_site1
400sqft_2wwr_all_site0
400sqft_2wwr_all_site1
400sqft_2wwr_all_site2
400sqft_2wwr_all_site3
400sqft_2wwr_all_site1_1story
400sqft_2wwr_all_site1_2story""")
sim_name_2 = Panel("500sqft_2wwr_all_site1_1story")

# ----
# Simulation Outputs
# Output Folder Name:
panel_2 = Panel("C:\Users\papep\Documents\GitHub\msdc-thesis\!tool\sim_output")
csv_path = GhPythonScript(path=panel_2, sim_name=sim_name_2)  # -> out, csv_path
# ---------- csv_path: Python ----------
__author__ = "tmendeze"
__version__ = "2021.03.02"

import rhinoscriptsyntax as rs
import os
csv_path = os.path.join(path, sim_name+".csv")
# ---------- end csv_path ----------
panel_3 = Panel(csv_path.csv_path)

python = GhPythonScript(material_name="Polyiso")  # -> out, a
# ---------- python: Python ----------
__author__ = "preston"

import rhinoscriptsyntax as rs
import sys

studiopath = "/Users/preston/Documents/GitHub/studio2021/src"
sys.path.append(studiopath)
import studio2021

from studio2021.functions import read_materials

material = read_materials(material_name)

print(material.keys())

r_per_in = material["r_per_in"]
embodied_carbon = material["embodied_carbon"]
type = material["mtype"]
density = material["density"]
sp_heat = material["sp_heat"]
thickness_in = material["thickness_in"]
thickness_m = material["thickness_m"]
r_value = material["r_value"]
conductivity = material["conductivity"]
# ---------- end python ----------
num_stories = Slider(2, range=1..2)

# ---- group: znames
entwine = Entwine(Branch00="zone1", Branch01="zone2", FlattenInputs=True)
filter = StreamFilter(Gate=num_stories, Stream1="zone1", Stream2=entwine)

# ----
dir_glazing = Slider(4, range=0..5)
site = Slider(1, range=0..3)

# ---- group: site
pipeline = GeometryPipeline(
    GroupByLayer=False,
    GroupByType=False,
    IncludeHidden=True,
    IncludeLocked=True,
    LayerFilter="sites::1-infill_no-alley::existing",
    NameFilter="*",
    SublayerFiltering=True,
    TypeFilter=1073741848)
pipeline_2 = GeometryPipeline(
    GroupByLayer=False,
    GroupByType=False,
    IncludeHidden=True,
    IncludeLocked=True,
    LayerFilter="sites::3-corner_no-alley::context",
    NameFilter="*",
    SublayerFiltering=True,
    TypeFilter=1073741848)
pipeline_3 = GeometryPipeline(
    GroupByLayer=False,
    GroupByType=False,
    IncludeHidden=True,
    IncludeLocked=True,
    LayerFilter="sites::1-infill_no-alley::lot_line",
    NameFilter="*",
    SublayerFiltering=True,
    TypeFilter=4)
pipeline_4 = GeometryPipeline(
    GroupByLayer=False,
    GroupByType=False,
    IncludeHidden=True,
    IncludeLocked=True,
    LayerFilter="sites::1-infill_no-alley::context",
    NameFilter="*",
    SublayerFiltering=True,
    TypeFilter=1073741848)
pipeline_5 = GeometryPipeline(
    GroupByLayer=False,
    GroupByType=False,
    IncludeHidden=True,
    IncludeLocked=True,
    LayerFilter="sites::3-corner_no-alley::existing",
    NameFilter="*",
    SublayerFiltering=True,
    TypeFilter=1073741848)
pipeline_6 = GeometryPipeline(
    GroupByLayer=False,
    GroupByType=False,
    IncludeHidden=True,
    IncludeLocked=True,
    LayerFilter="sites::3-corner_no-alley::lot_line",
    NameFilter="*",
    SublayerFiltering=True,
    TypeFilter=4)
pipeline_7 = GeometryPipeline(
    GroupByLayer=False,
    GroupByType=False,
    IncludeHidden=True,
    IncludeLocked=True,
    LayerFilter="sites::0-infill_alley::existing",
    NameFilter="*",
    SublayerFiltering=True,
    TypeFilter=1073741848)
pipeline_8 = GeometryPipeline(
    GroupByLayer=False,
    GroupByType=False,
    IncludeHidden=True,
    IncludeLocked=True,
    LayerFilter="sites::2-corner_alley::existing",
    NameFilter="*",
    SublayerFiltering=True,
    TypeFilter=1073741848)
pipeline_9 = GeometryPipeline(
    GroupByLayer=False,
    GroupByType=False,
    IncludeHidden=True,
    IncludeLocked=True,
    LayerFilter="sites::0-infill_alley::lot_line",
    NameFilter="*",
    SublayerFiltering=True,
    TypeFilter=4)
pipeline_10 = GeometryPipeline(
    GroupByLayer=False,
    GroupByType=False,
    IncludeHidden=True,
    IncludeLocked=True,
    LayerFilter="sites::2-corner_alley::lot_line",
    NameFilter="*",
    SublayerFiltering=True,
    TypeFilter=4)
pipeline_11 = GeometryPipeline(
    GroupByLayer=False,
    GroupByType=False,
    IncludeHidden=True,
    IncludeLocked=True,
    LayerFilter="sites::0-infill_alley::context",
    NameFilter="*",
    SublayerFiltering=True,
    TypeFilter=1073741848)
pipeline_12 = GeometryPipeline(
    GroupByLayer=False,
    GroupByType=False,
    IncludeHidden=True,
    IncludeLocked=True,
    LayerFilter="sites::2-corner_alley::context",
    NameFilter="*",
    SublayerFiltering=True,
    TypeFilter=1073741848)
entwine_2 = Entwine(Branch00=pipeline_2, Branch01=pipeline_6, Branch02=pipeline_5, FlattenInputs=True)
entwine_3 = Entwine(Branch00=pipeline_12, Branch01=pipeline_10, Branch02=pipeline_8, FlattenInputs=True)
entwine_4 = Entwine(Branch00=pipeline_11, Branch01=pipeline_9, Branch02=pipeline_7, FlattenInputs=True)
entwine_5 = Entwine(Branch00=pipeline_4, Branch01=pipeline_3, Branch02=pipeline, FlattenInputs=True)
filter_2 = StreamFilter(Gate=site, Stream0=entwine_4, Stream1=entwine_5, Stream2=entwine_3, Stream3=entwine_2)
panel_4 = Panel(filter_2)
bang = ExplodeTree(Data=filter_2)  # -> Branch0, Branch1, Branch2
entwine_6 = Entwine(Branch00=bang.Branch0, Branch01=bang.Branch2, FlattenInputs=True)  # -> flatten(Result)

# ---- group: height
filter_3 = StreamFilter(Gate=Toggle(False), Stream0=Slider(10, range=0..10), Stream1=Slider(20, range=0..100))

# ----
filter_4 = StreamFilter(
    Gate=Slider(1, range=1..4),
    Stream1=Slider(0, range=0..100),
    Stream2=Slider(180, range=0..1000),
    Stream3=Slider(270, range=0..270),
    Stream4=Slider(90, range=0..1000))
wwr = ItemSelector(
    [Slider(0.1, range=0..0.1), Slider(0.2, range=0..1), Slider(0.3, range=0..1), Slider(0.4, range=0..1), Slider(0.5, range=0..1), Slider(0.6, range=0..1), Slider(0.7, range=0..1), Slider(0.8, range=0..1)],
    {"0.1", "0.2", "0.3", "0.4", "0.5", "0.6", "0.7", "0.8"}, selected="0.2")
panel_5 = Panel("dadu geo")
crv = Curve(<curve referenced from the Rhino model>)
geometry = Brep(<brep referenced from the Rhino model>)
importmaterial = GhPythonScript(material_name="Cellulose")  # -> r_per_in, embodied_carbon, type, thickness_in, thickness_m, conductivity, density, sp_heat, r_value; same code as python
importmaterial_2 = GhPythonScript(material_name="Polyiso")  # -> r_per_in, embodied_carbon, type, thickness_in, thickness_m, conductivity, density, sp_heat, r_value; same code as python
panel_6 = Panel(python.out)
area = Area(Geometry=crv)  # -> Area, Centroid
panel_7 = Panel([filter, filter_3])

# ----
# Run Energy
# Simulation
run_energy_simulation = BooleanToggle(False)

panel_8 = Panel(area.Area)
multiplication = Multiplication(A=importmaterial.r_per_in, B=Slider(3.5, range=0..10))
importmaterial_3 = GhPythonScript(material_name="Gyp")  # -> r_per_in, embodied_carbon, type, thickness_in, thickness_m, conductivity, density, sp_heat, r_value; same code as python
importmaterial_4 = GhPythonScript(material_name="Aluminum")  # -> r_per_in, embodied_carbon, type, thickness_in, thickness_m, conductivity, density, sp_heat, r_value; same code as python
multiplication_2 = Multiplication(A=importmaterial_2.r_per_in, B=Slider(0, range=0..100))
division = Division(A=multiplication, B=5.67826)
division_2 = Division(A=multiplication_2, B=5.67826)
division_3 = Division(A=Slider(1, range=0..1), B=5.67826)
division_4 = Division(A="0.63", B=5.67826)
multiplication_3 = Multiplication(A=division, B=Slider(0.906, range=0..1))
opaquematnomass = HBOpaqueMaterialNoMass(name="ContExtInsulation", r_value=division_2)  # -> mat; plug-in component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
division_5 = Division(A=importmaterial_4.r_value, B=5.67826)
sim_name_3 = Panel(sim_name_2)
opaquemat = HBOpaqueMaterial(
    name="InteriorFinish",
    thickness=importmaterial_3.thickness_m,
    conductivity=importmaterial_3.conductivity,
    density=importmaterial_3.density,
    spec_heat=importmaterial_3.sp_heat)  # -> mat; plug-in component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
opaquematnomass_2 = HBOpaqueMaterialNoMass(name="AirGap", r_value=division_3)  # -> flatten(mat); plug-in component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
opaquematnomass_3 = HBOpaqueMaterialNoMass(name="1/2\" Plywood", r_value=division_4)  # -> mat; plug-in component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
opaquematnomass_4 = HBOpaqueMaterialNoMass(name="IntInsulation", r_value=multiplication_3)  # -> mat; plug-in component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
opaquematnomass_5 = HBOpaqueMaterialNoMass(name="FacadeCladding", r_value=division_5)  # -> flatten(mat); plug-in component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

debrep = DeconstructBrep(Brep=geometry)  # -> Faces, Edges, Vertices
item = ListItem(List=debrep.Faces, Index=Slider(0, range=0..5), Wrap=True)
item_2 = ListItem(List=debrep.Faces, Index=Slider(4, range=0..5), Wrap=True)
item_3 = ListItem(List=debrep.Faces, Index=Slider(2, range=0..5), Wrap=True)
drec = DeconstuctRectangle(Rectangle=item_2)  # -> BasePlane, XInterval, YInterval
area_2 = Area(Geometry=item_2)  # -> Area, Centroid
consarearec = ConstrainedAreaRectangle(Plane=PlaneXY(0, 0, 0), Area=Slider(400, range=0..1000), FactorX=drec.YInterval, FactorY=drec.XInterval)  # -> Rectangle, DimensionX, DimensionY
panel_9 = Panel(area_2.Area)
area_3 = Area(Geometry=consarearec.Rectangle)  # -> Area, Centroid
move2pt = MoveToPoint(Geometry=consarearec.Rectangle, PointA=area_3.Centroid, PointB=area_2.Centroid)  # -> Moved, Vector, Transform
Z = UnitZ(Factor=Slider(10, range=0..10))
extr = Extrude(Base=move2pt.Moved, Direction=Z)
area_4 = Area(Geometry=item_3)  # -> Area, Centroid
area_5 = Area(Geometry=item)  # -> Area, Centroid
cap = CapHoles(Brep=extr)
pi = Pi(Factor=1)
ln = Line(StartPoint=area_5.Centroid, EndPoint=area_4.Centroid)
rotax = RotateAxis(Geometry=cap, Angle=pi, Axis=ln)  # -> Geometry, Transform

filter_5 = StreamFilter(Gate=Slider(0, range=0..100), Stream0=opaquematnomass)
area_6 = Area(Geometry=consarearec.Rectangle)  # -> Area, Centroid
clean = CleanTree(
    RemoveNulls=True,
    RemoveInvalid=True,
    RemoveEmpty=False,
    Tree=flatten([opaquematnomass_5, opaquematnomass_2, filter_5, opaquematnomass_3, opaquematnomass_4, opaquemat]))
panel_10 = Panel(area_6.Area)
opaqueconstr_3 = HBOpaqueConstruction(name="ExteriorWall", materials=clean)  # -> constr; plug-in component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
decnstrconstr = HBDeconstructConstruction(constr=opaqueconstr_3)  # -> materials, layers, r_val_si, r_val_ip, u_fac_si, u_fac_ip, t_sol, t_vis; plug-in component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
decnstrmat = HBDeconstructMaterial(mat=opaqueconstr_3)  # -> values, attr_names, r_val_si, r_val_ip; plug-in component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
one_over_x = OneOverX(Value=decnstrconstr.u_fac_ip)
y = Result(one_over_x)
debrep_2 = DeconstructBrep(Brep=geometry)  # -> Faces, Edges, Vertices
panel_11 = Panel("south")
panel_12 = Panel("roof")
panel_13 = Panel("east")
panel_14 = Panel("west")
panel_15 = Panel("north")
panel_16 = Panel("floor")
item_4 = ListItem(List=debrep_2.Faces, Index=0, Wrap=True)
item_5 = ListItem(List=debrep_2.Faces, Index=5, Wrap=True)
item_6 = ListItem(List=debrep_2.Faces, Index=1, Wrap=True)
item_7 = ListItem(List=debrep_2.Faces, Index=2, Wrap=True)
item_8 = ListItem(List=debrep_2.Faces, Index=3, Wrap=True)
item_9 = ListItem(List=debrep_2.Faces, Index=4, Wrap=True)
face = HBFace(geo=item_6, name="east facade", type="Wall", bc="Outdoors", ep_constr=opaqueconstr_3)  # -> report, flatten(faces); plug-in component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
face_2 = HBFace(geo=item_4, name="south facade", type="Wall", bc="Outdoors", ep_constr=opaqueconstr_3)  # -> report, flatten(faces); plug-in component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
face_3 = HBFace(geo=item_7, name="north facade", type="Wall", bc="Outdoors", ep_constr=opaqueconstr_3)  # -> report, flatten(faces); plug-in component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
number_slider = Slider(20, range=0..100)
face_4 = HBFace(geo=item_8, name="west facade", type="Wall", bc="Outdoors", ep_constr=opaqueconstr_3)  # -> report, flatten(faces); plug-in component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
face_5 = HBFace(geo=item_9, name="Floor", type="Floor", ep_constr=opaqueconstr_2)  # -> report, flatten(faces); plug-in component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
face_6 = HBFace(geo=item_5, name="RoofCeiling", type="RoofCeiling", ep_constr=opaqueconstr)  # -> report, flatten(faces); plug-in component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
windowmat = HBWindowMaterial(u_factor=Slider(2.271, range=0..10), shgc=Slider(0.3, range=0..1), t_vis=Slider(0.63, range=0..1))  # -> mat; plug-in component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
Z_2 = UnitZ(Factor=Slider(10, range=0..10))
extr_2 = Extrude(Base=crv, Direction=Z_2)
windowconstr = HBWindowConstruction(name="NGlass", materials=flatten(windowmat))  # -> constr; plug-in component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
cap_2 = CapHoles(Brep=extr_2)
move = Move(Geometry=cap_2, Motion=Vector(0, 0, 10))  # -> Geometry, Transform
python_2 = GhPythonScript(index=dir_glazing)  # -> gate
# ---------- python_2: Python ----------
__author__ = "papep"
__version__ = "2022.01.23"

import rhinoscriptsyntax as rs

if index < 5:
    gate = 0
else:
    gate = 1
# ---------- end python_2 ----------
filter_6 = StreamFilter(
    Gate=dir_glazing,
    Stream0=face_2.faces,
    Stream1=face.faces,
    Stream2=face_3.faces,
    Stream3=face_4.faces,
    Stream4=[face_2.faces, face.faces, face_3.faces, face_4.faces],
    Stream5=[face_2.faces, face.faces, face_3.faces, face_4.faces])
roomsolid = HBRoomFromSolid(geo=flatten([cap_2, move.Geometry]), conditioned=True)  # -> report, rooms; plug-in component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
panel_17 = Panel(filter_6)
gate = StreamGate(Stream=filter_6, Gate=python_2)  # -> Target0, Target1
toggle = BooleanToggle(True)
aperturesbyratio = HBAperturesByRatio(hb_objs=flatten(gate.Target0), ratio=wwr)  # -> report, hb_objs; plug-in component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
aperturesbyratio_2 = HBAperturesByRatio(hb_objs=flatten(gate.Target1), ratio=Slider(0.1, range=0..0.1))  # -> report, hb_objs; plug-in component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
solveadj = HBSolveAdjacency(rooms=flatten(roomsolid.rooms), adiabatic=toggle, run=toggle)  # -> report, adj_rooms; plug-in component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
aperturesbyratio_3 = HBAperturesByRatio(hb_objs=flatten(solveadj.adj_rooms), ratio=wwr)  # -> report, hb_objs; plug-in component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
filter_7 = StreamFilter(
    Gate=dir_glazing,
    Stream0=[face.faces, face_3.faces, face_4.faces, face_5.faces, face_6.faces, aperturesbyratio.hb_objs],
    Stream1=[aperturesbyratio.hb_objs, face_2.faces, face_3.faces, face_4.faces, face_5.faces, face_6.faces],
    Stream2=[aperturesbyratio.hb_objs, face_2.faces, face.faces, face_4.faces, face_5.faces, face_6.faces],
    Stream3=[aperturesbyratio.hb_objs, face_2.faces, face.faces, face_3.faces, face_5.faces, face_6.faces],
    Stream4=[aperturesbyratio.hb_objs, face_5.faces, face_6.faces],
    Stream5=[aperturesbyratio_2.hb_objs, face_5.faces, face_6.faces])
room = HBRoom(faces=flatten(filter_7), program=list, conditioned=True)  # -> report, room; plug-in component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
filter_8 = StreamFilter(Gate=num_stories, Stream1=room.room, Stream2=aperturesbyratio_3.hb_objs)
faceattr = HBFaceAttributes({"Display Name": "display_name", "Simulation Name (Identifier)": "identifier", "Boundary Condition": "boundary_condition", "Has Parent": "has_parent", "Parent": "parent", "Area": "area", "Perimeter": "perimeter", "Face Type": "type", "Aperture Is Operable": "is_operable", "Door Is Glass": "is_glass"}, selected="Area")
lablefaces = HBLabelFaces(hb_objs=flatten(filter_8), attribute=faceattr, sub_faces=Toggle(True))  # -> label_text, base_pts, labels, wire_frame; plug-in component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
vizbytype = HBVisualizeByType(hb_objs=filter_8)  # -> walls, interior_walls, roofs, ceilings, exterior_floors, interior_floors, air_walls, apertures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; plug-in component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
shade = HBShade(geo=entwine_6)  # -> report, shades; plug-in component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
ma = MassAddition(Input=lablefaces.label_text)  # -> Result, PartialResults
data = Data(vizbytype.ceilings)
panel_18 = Panel(ma.Result)
applyloadvals = HBApplyLoadValues(room_or_program=flatten(filter_8))  # -> report, mod_obj; plug-in component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
simoutput = HBSimulationOutput(zone_energy_use=Toggle(True), gains_and_losses=Toggle(True))  # -> report, sim_output; plug-in component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
panel_19 = Panel("http://climate.onebuilding.org/WMO_Region_4_North_and_Central_America/USA_United_States_of_America/WA_Washington/USA_WA_Seattle-Tacoma.Intl.AP.727930_TMY3.zip")

epwmap = LBEPWmap(epw_map=Toggle(False))  # -> report; plug-in component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

downloadepw = LBDownloadWeather(weather_URL=panel_19)  # -> epw_file, stat_file, ddy_file; plug-in component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
simpar = HBSimulationParameter(north=filter_4, output=simoutput.sim_output, timestep=6)  # -> sim_par; plug-in component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
model = HBModel(rooms=flatten(applyloadvals.mod_obj), shades=flatten(shade.shades))  # -> report, model; plug-in component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
cluster = Cluster(rooms_model=filter_8, G=item_9)
modeltoosm = HBModelToOSM(
    model=model.model,
    epw_file=downloadepw.epw_file,
    sim_par=simpar,
    add_str=cluster,
    folder=panel_2,
    write=Toggle(True),
    run=run_energy_simulation)  # -> report, jsons, osw, osm, idf, sql, zsz, rdd, html; plug-in component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
eui = HBEndUseIntensity(sql=modeltoosm.sql, ip=Toggle(False))  # -> eui, eui_end_use, end_uses, gross_floor; plug-in component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
panel_20 = Panel(eui.end_uses)
panel_21 = Panel(eui.eui)
panel_22 = Panel(eui.eui_end_use)
roomenergyresult = HBReadRoomEnergyResult(sql=modeltoosm.sql)  # -> cooling, heating, lighting, electric_equip, gas_equip, process, hot_water, fan_electric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; plug-in component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
add_euis = GhPythonScript(
    cooling=roomenergyresult.cooling,
    heating=roomenergyresult.heating,
    lighting=roomenergyresult.lighting,
    equipment=roomenergyresult.electric_equip,
    hot_water=roomenergyresult.hot_water,
    solar_gain=roomenergyresult.solar_gain)  # -> out, building; inputs cooling: list, heating: list, lighting: list, equipment: list, hot_water: list
# ---------- add_euis: Python ----------
__author__ = "tmendeze"

building.add_eui_results(cooling,
                         heating,
                         lighting,
                         equipment,
                         hot_water,
                         solar_gain,
                         wall_r,
                         window_u,
                         hourly=False)
# ---------- end add_euis ----------
panel_23 = Panel(add_euis.out)
write_results = GhPythonScript(building=add_euis.building)  # -> out
# ---------- write_results: Python ----------
__author__ = "tmendeze"

building.write_results(csv=False, delete=True)
#csv : write csv also or not
#delete : deletes honeybee files
# ---------- end write_results ----------
panel_24 = Panel(write_results)

# ==== cluster Cluster
G = ClusterInput()
roomattr = HBRoomAttributes({"Display Name": "display_name", "Simulation Name (Identifier)": "identifier", "Multiplier": "multiplier", "Story": "story", "Volume": "volume", "Gross Floor Area": "floor_area", "Exposed Area": "exposed_area", "Exterior Wall Area": "exterior_wall_area", "Exterior Aperture Area": "exterior_aperture_area", "Average Floor Elevation": "average_floor_height"}, selected="Simulation Name (Identifier)")
area = Area(Geometry=G)  # -> Area, Centroid
panel = Panel("""  Daylighting:Controls,
  Test,     		   !- Name
  Zone_Name,               !- Zone Name
  SplitFlux,               !- Daylighting Method
  ,                        !- Availability Schedule Name
  Continuous,              !- Lighting Control Type
  0.3,                     !- Minimum Input Power Fraction for Continuous or ContinuousOff Dimming Control
  0.2,                     !- Minimum Light Output Fraction for Continuous or ContinuousOff Dimming Control
  ,                        !- Number of Stepped Control Steps
  1.0,                     !- Probability Lighting will be Reset When Needed in Manual Stepped Control
  DaylRefPt1,              !- Glare Calculation Daylighting Reference Point Name
  180.0,                   !- Glare Calculation Azimuth Angle of View Direction Clockwise from Zone y-Axis {deg}
  20.0,                    !- Maximum Allowable Discomfort Glare Index
  ,                        !- DElight Gridding Resolution {m2}
  DaylRefPt1,              !- Daylighting Reference Point 1 Name
  1.0,                     !- Fraction of Zone Controlled by Reference Point 1
  500.;                    !- Illuminance Setpoint at Reference Point 1 {lux}""")
rooms_model = ClusterInput()
labelrooms = HBLabelRooms(rooms_model=flatten(rooms_model), attribute=roomattr)  # -> graft(label_text), base_pts, labels, wire_frame; plug-in component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
move = Move(Geometry=area.Centroid, Motion="{0,0,3}")  # -> Geometry, Transform
pdecon = Deconstruct(Point=move.Geometry)  # -> XComponent, YComponent, ZComponent
lng = ListLength(List=flatten(labelrooms.label_text))
clean = CleanTree(RemoveNulls=True, RemoveInvalid=True, RemoveEmpty=True, Tree=pdecon.XComponent)
clean_2 = CleanTree(RemoveNulls=True, RemoveInvalid=True, RemoveEmpty=True, Tree=pdecon.ZComponent)
panel_2 = Panel("""  Daylighting:ReferencePoint,
  DaylRefPt1,              !- Name
  Zone_Name,               !- Zone Name
  point1_x,                !- X-Coordinate of Reference Point {m}
  point1_y,                !- Y-Coordinate of Reference Point {m}
  point1_z;                !- Z-Coordinate of Reference Point {m}""")
panel_3 = Panel(lng)
clean_3 = CleanTree(RemoveNulls=True, RemoveInvalid=True, RemoveEmpty=True, Tree=pdecon.YComponent)
panel_4 = Panel("""Run1
Run2
Run3
Run4
Run5""")
split = SplitList(List=panel_4, Index=panel_3)  # -> ListA, ListB
panel_5 = Panel("""Point1
Point2
Point3
Point4
Point5""")
rep = ReplaceText(Text=panel, Find="Zone_Name", Replace=simplify(labelrooms.label_text), RecursiveReplace=False)
rep_2 = ReplaceText(Text=rep, Find="Test", Replace=graft(split.ListA), RecursiveReplace=False)
split_2 = SplitList(List=panel_5, Index=panel_3)  # -> ListA, ListB
rep_3 = ReplaceText(Text=panel_2, Find="Zone_Name", Replace=simplify(labelrooms.label_text), RecursiveReplace=False)
rep_4 = ReplaceText(Text=rep_2, Find="DaylRefPt1", Replace=graft(split_2.ListA), RecursiveReplace=False)  # -> flatten(Result)
rep_5 = ReplaceText(Text=rep_3, Find="DaylRefPt1", Replace=graft(split_2.ListA), RecursiveReplace=False)
rep_6 = ReplaceText(Text=rep_5, Find="point1_x", Replace=clean, RecursiveReplace=False)
rep_7 = ReplaceText(Text=rep_6, Find="point1_y", Replace=clean_3, RecursiveReplace=False)
rep_8 = ReplaceText(Text=rep_7, Find="point1_z", Replace=clean_2, RecursiveReplace=False)  # -> flatten(Result)
join = TextJoin(Text=rep_4)
join_2 = TextJoin(Text=rep_8)
join_3 = TextJoin(Text=[join, join_2])
R = ClusterOutput(join_3)
