# Grasshopper definition sim_gen_1.8.0_IDL.gh (Grasshopper 1.0.7)
# plug-ins: MetaHopper, Bifocals

panel = Panel("C:\Users\ppape\Documents\GitHub\msdc-thesis\tool\temp")

connected = GetConnectedObjects(Objects=Slider(4, range=0..10000))
set_slider = GhPythonScript(slider=connected, iterations="5", toggle=Button())  # -> out; inputs iterations: Int32
# ---------- set_slider: Python ----------
__author__ = "papep"
__version__ = "2022.01.23"

import rhinoscriptsyntax as rs
import Grasshopper as gh

iterations = range(iterations)

if toggle:
    for i in iterations:
        slider.Slider.Value = iterations[i]
        print i
        slider.ExpireSolution(True)
# ---------- end set_slider ----------
panel_2 = Panel(set_slider)

number_slider = Slider(1138, range=0..2999)
number_slider_2 = Slider(24560, range=24560..34560)
number_slider_3 = Slider(1000, range=1000..9999)

# ----
# Run Energy
# Simulation
run_energy_simulation = BooleanToggle(False)

# ----
# 1/25/22
# 2 story empty box is more accurate simulating a loft
# can be more accurate by simulating empty 2 story box with 3/4 floor being zone 2, zone 1 being bottom floor + 1/4 of 2nd story
# 2 story, 1 zone box not accurate for either 2 story or 2 story loft because all of the loads applied to calculation by energyplus are square footage-dependent- need sqft to be 99% accurate
# 
# todo:
# [x] implement num_dadu geometry
# [x] autodelete screenshots from animation
# [] assemble many csv into pd dataframe - finish script to concatenate csv files
# [] simulate ~3000 at random to train ML models
# [x] look at mean absolute error instead of rmse
# [] pytorch neural network mode
# [x] scikitlearn random forest or adaboost, etc..
# [x] subface construction - include window variables from generator
# [?] apply loads - use numbers more accurate of dadus
# Screenshots Folder (Will be deleted):
panel_3 = Panel("animation_images")

# ---- group: visualization
faceattr = HBFaceAttributes({"Display Name": "display_name", "Simulation Name (Identifier)": "identifier", "Boundary Condition": "boundary_condition", "Has Parent": "has_parent", "Parent": "parent", "Area": "area", "Perimeter": "perimeter", "Face Type": "type", "Aperture Is Operable": "is_operable", "Door Is Glass": "is_glass"}, selected="Boundary Condition")

# ----
R = Reset()  # inputs Sliders: list, Values: list
# ---------- R: Python ----------
""" Reset named sliders """

import Grasshopper as gh

if Toggle:
    
    # Get to the GH objects
    ghObjects = ghenv.Component.OnPingDocument().Objects
    
    # Iterate the GH objects
    for obj in ghObjects:
        
        # Set the named slider values
        if obj.NickName in Sliders:
            if type(obj) is gh.Kernel.Special.GH_NumberSlider:
                obj.Slider.Value = Values[Sliders.index(obj.NickName)]
                obj.ExpireSolution(True)
# ---------- end R ----------
parameter_generator = GhPythonScript()  # -> out, param, param_sample
# ---------- parameter_generator: Python ----------
__author__ = "tmendeze, ppape"

import rhinoscriptsyntax as rs
import random

sizes           = [0, 1, 2, 3, 4]
orientation     = [1, 2, 3, 4] #orientation of existing dwelling to dadu
wwr             = [10, 20, 30, 40, 50, 60]
assemblies      = [0, 1, 2, 3, 4, 5] #cut down to half? or 3?
infiltration    = [0, 1]
sites           = [0, 1, 2, 3] #four site combinations **tie floor area to site
# model all site ideas for next week
setbacks        = [0, 1] #use existing, consult rick for options to test
#stories         = [1, 2] #one or two stories - currently adiabatic

param = []
combos = [[1, 1], [1, 2], [2, 1]]
for s in sizes:
    for o in orientation:
        for w in wwr:
            for a in assemblies:
                for i in infiltration:
                    for si in sites:
                        for sb in setbacks:
                            for c in combos:
                                param.append([s, o, w, a, i, si, sb, c[0], c[1]])

k = 3000
param_sample = random.sample(param, k)

#param = []
#for s in sizes:
#    for o in orientation:
#        for w in wwr:
#            for a in assemblies:
#                for i in infiltration:
#                    for si in sites:
#                        for sb in setbacks:
#                            for st in stories:
#                                    param.append([s, o, w, a, i, si, sb, st])

#print(param)

# size, orientation, wwr, assemblies, infiltration, sites, setbacks, stories, units


print(len(param))
print "param_sample length:", len(param_sample)
print param[3]
# ---------- end parameter_generator ----------
number_slider_4 = Slider(18316, range=0..20000)
number_slider_5 = Slider(6336, range=0..10000)
number_slider_6 = Slider(10000, range=10000..19999)
number_slider_7 = Slider(10, range=0..10)
panel_4 = Panel(parameter_generator.out)
connected_2 = GetConnectedObjects(Objects=Slider(6587, range=0..34560))
parameters = GhPythonScript(param=parameter_generator.param, i=Slider(0, range=0..9999))  # -> out, orientation, shading, wwr, ext_ins_t, int_ins_t, inf_rate, frame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; inputs param: list, i: Int32
# ---------- parameters: Python ----------
__author__ = "tmendeze, ppape"


assemblies = {
    0: {'frame':0,  'cellulose':0.00, 'polyiso':1.},
    1: {'frame':0,  'cellulose':3.50, 'polyiso':0.},
    2: {'frame':1,  'cellulose':5.50, 'polyiso':0.},
    3: {'frame':2,  'cellulose':7.25, 'polyiso':0.},
    4: {'frame':3, 'cellulose':9.25, 'polyiso':0.},
    5: {'frame':3, 'cellulose':9.25, 'polyiso':1.}}

setbackd = {
    0:{
        0: {'rear':0, 'side':5, 'structure':5},  #existing infill/alley
        1: {'rear':5, 'side':5, 'structure':5},  #existing infill/no alley
        2: {'rear':0, 'side':5, 'structure':5},  #existing corner/alley - ***HOW DOES THIS WORK?***
        3: {'rear':5, 'side':5, 'structure':5}}, #existing corner/no alley
    1:{
        0: {'rear':0, 'side':5, 'structure':5},  #potential infill/alley
        1: {'rear':0, 'side':5, 'structure':5},  #potential infill/no alley
        2: {'rear':0, 'side':5, 'structure':5},  #potential corner/alley
        3: {'rear':0, 'side':5, 'structure':5}}} #potential corner/no alley

infd = {0:.00059, 1:.00015} #cu-m (air)/s*m^2(facade)
dadu_sizes = {
    1:{ 0:400, 1:600, 2:700, 3:800, 4:1000},
    2:{ 0:600, 1:700, 2:800, 3:900, 4:1000}}

p = param[i]
print p

orientation     = p[1]
wwr             = p[2] / 100.
assembly        = assemblies[p[3]]
inf_rate        = infd[p[4]]
site            = p[5]
setbacks        = p[6]
num_stories     = p[7]
num_units       = p[8]
size            = dadu_sizes[num_stories][p[0]]


if num_stories == 1:
    height = 10
    footprint = size
else:
    height = 20
    footprint = size / 2.

shading         = 0
glazing         = 'Aluminum Double'
shgc            = .25
ext_ins_mat     = 'Polyiso'
ext_ins_t       = assembly['polyiso']
int_ins_mat     = 'Cellulose'
int_ins_t       = assembly['cellulose']
frame           = assembly['frame']

setback         = setbackd[setbacks][site]
rear_setback    = setback['rear']
side_setback    = setback['side']
structure_setback = setback['structure']


odict = {1:'n', 2:'s', 3:'e', 4:'w'}

filename = str(i) + '_{}_'.format(odict[orientation])
for n in p[2:]:
    filename += str(n) +'_'
filename = filename[:-1]

print 'filename', filename
print 'size', size
print 'orientation', odict[orientation]
print 'wwr', wwr 
print 'assembly', assembly
print '(frame 0 = 2x4 Wood Studs, 1 = 2x6 Wood Studs, 2 = 2x8, 3 = 2x10)' 
print 'inf_rate', inf_rate
print 'site', site
print 'setback', setbacks
print 'rear_setback', rear_setback
print 'side_setback', side_setback
print 'structure_setback', structure_setback
print 'num_stories', num_stories
print 'num_units', num_units
# ---------- end parameters ----------
cities = GhPythonScript(city=0)  # -> out, city, weather_file, kgCo2e_kwh
# ---------- cities: Python ----------
__author__ = "tmendeze"

import rhinoscriptsyntax as rs

kgCo2e_kwh = 0.135669
weather_file = 'https://energyplus-weather.s3.amazonaws.com/north_and_central_america_wmo_region_4/USA/WA/USA_WA_Seattle-Tacoma.Intl.AP.727930_TMY3/USA_WA_Seattle-Tacoma.Intl.AP.727930_TMY3.zip'
# ---------- end cities ----------
panel_5 = Panel(parameters.out)

item = ListItem(List=panel_4, Index=0, Wrap=True)

set_slider_2 = SetSliderProperties(Slider=connected_2, Range=item)

# ----
# Simulation Inputs
# Simulation Folder Name:
# Simulation Name:
# .sql Filepath:
path = GhPythonScript()  # -> out, path
# ---------- path: Python ----------
__author__ = "tmendeze"


import studio2021

path = "C:\Users\papep\Documents\GitHub\msdc-thesis\tool\temp"
# ---------- end path ----------
panel_6 = Panel(parameters.filename)
csv_path = GhPythonScript(path=panel, sim_name=parameters.filename)  # -> out, sql_path
# ---------- csv_path: Python ----------
__author__ = "tmendeze"
__version__ = "2021.03.02"

import rhinoscriptsyntax as rs
import os
sql = os.path.join('OpenStudio','run','eplusout.sql')
sql_path = os.path.join(path, sim_name, sql)
# ---------- end csv_path ----------
panel_7 = Panel(csv_path.sql_path)

# ----
# Simulation Outputs
# Output Folder Name:
csv_path_2 = GhPythonScript(path=panel, sim_name=parameters.filename)  # -> out, csv_path
# ---------- csv_path_2: Python ----------
__author__ = "tmendeze"
__version__ = "2021.03.02"

import rhinoscriptsyntax as rs
import os
csv_path = os.path.join(path, sim_name+".csv")
# ---------- end csv_path_2 ----------
panel_8 = Panel(csv_path_2.csv_path)

downloadepw = LBDownloadWeather(weather_URL=cities.weather_file)  # -> epw_file, stat_file, ddy_file; plug-in component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
python = GhPythonScript(
    filename=parameters.filename,
    filepath=panel_8,
    site=parameters.site,
    size=parameters.size,
    footprint=parameters.footprint,
    height=parameters.height,
    num_units=parameters.num_units,
    num_stories=parameters.num_stories,
    inf_rate=parameters.inf_rate,
    orientation=parameters.orientation,
    WWR=parameters.wwr,
    frame=parameters.frame,
    polyiso_t=parameters.ext_ins_t,
    cellulose_t=parameters.int_ins_t,
    setback=parameters.setbacks,
    rear_setback=parameters.rear_setback,
    side_setback=parameters.side_setback,
    structure_setback=parameters.structure_setback,
    kgCO2e=cities.kgCo2e_kwh)  # -> out, adu
# ---------- python: Python ----------
__author__ = "papep"
__version__ = "2022.01.25"

import rhinoscriptsyntax as rs

class ADU(object):
    
    def __init__(self, filename, filepath, site, size, footprint, height, num_stories, num_units, inf_rate,
                orientation, WWR, frame, polyiso_t, cellulose_t, setback, rear_setback, side_setback, structure_setback,
                kgCO2e):
       self.filename            = filename
       self.filepath            = filepath
       self.site                = site
       self.size                = size
       self.footprint           = footprint
       self.height              = height
       self.num_stories         = num_stories
       self.num_units           = num_units
       self.inf_rate            = inf_rate
       self.orientation         = orientation
       self.WWR                 = WWR
       self.frame               = frame
       self.polyiso_t           = polyiso_t
       self.cellulose_t         = cellulose_t
       self.setback             = setback
       self.rear_setback        = rear_setback
       self.side_setback        = side_setback
       self.structure_setback   = structure_setback
       self.kgCO2e              = kgCO2e
       self.assembly_r          = None
       self.area_buildable      = None
       self.num_adiabatic       = None
       self.surf_area           = None
       self.volume              = None
       self.surf_vol_ratio      = None
       self.cool                = None
       self.heat                = None
       self.light               = None
       self.eq                  = None
       self.dhw                 = None
       self.eui_kwh             = None
       self.eui_kbtu            = None
       self.carbon              = None

    def write_csv(self):
        fh = open(self.filepath, 'w') # write but do not overwrite filename if it exists
        
        fh.write("{}, {}, {}, {}, {}, {}, {}, {}, {}, {}, {}, {}, {}, {}, {}, {}, {}, {}, {}, {}, {}, {}, {}, {}, {}, {}, {}, {}, {}, {}, {}, {}".format(
        self.filename, self.site, self.size, self.footprint, self.height,  
        self.num_stories, self.num_units, self.num_adiabatic, self.inf_rate, self.orientation, self.WWR, self.frame, 
        self.polyiso_t, self.cellulose_t, self.setback, self.rear_setback, self.side_setback, self.structure_setback, 
        self.assembly_r, self.area_buildable, self.surf_area, self.volume, self.surf_vol_ratio, self.cool, self.heat, self.light, self.eq,
        self.dhw, self.eui_kwh, self.eui_kbtu, self.carbon, self.kgCO2e))

        fh.close()

    def add_eui_results(self, cool, heat, light, eq, dhw):
    
            totals = 0
            cool_tot = 0
            heat_tot = 0
            light_tot = 0
            eq_tot = 0
            dhw_tot = 0
            for i in range(len(cool)):
                c = sum(cool[i])
                h = sum(heat[i])
                l = sum(light[i])
                e = sum(eq[i])
                w = sum(dhw[i])
                tot = sum([c, h, l, e, w])
                cool_tot += c
                heat_tot += h
                light_tot += l
                eq_tot += e
                dhw_tot += w
                totals += tot

            self.eui_kbtu   = totals * 3.41214 / self.size
            self.cool       = cool_tot * 3.41214 / self.size
            self.heat       = heat_tot * 3.41214 / self.size
            self.light      = light_tot * 3.41214 / self.size
            self.eq         = eq_tot * 3.41214 / self.size
            self.dhw        = dhw_tot * 3.41214 / self.size

    def calc_carbon(self, eui_kwh, size_m2):
        self.eui_kwh = eui_kwh
        if self.eui_kwh != None:
            self.carbon = self.eui_kwh * self.kgCO2e * size_m2
#            self.eui_kwh = self.eui_kwh * 10.764 / self.size 
        else:
            self.carbon = None

adu = ADU(filename, filepath, site, size, footprint, height, num_stories, num_units, inf_rate,
                orientation, WWR, frame, polyiso_t, cellulose_t, setback, rear_setback, side_setback, 
                structure_setback, kgCO2e)

print "filename:", adu.filename
print "site:", adu.site
print "size:", adu.size
print "footprint:", adu.footprint
print "height:", adu.height
print "num_stories:", adu.num_stories
print "num_units:", adu.num_units
print "inf_rate:", adu.inf_rate
print "orientation:", adu.orientation
print "wwr:", adu.WWR
print "frame:", adu.frame
print "polyiso_t", adu.polyiso_t
print "cellulose_t:", adu.cellulose_t
print "setback:", adu.setback
print "rear_setback", adu.rear_setback
print "side_setback:", adu.side_setback
print "structure_setback:", adu.structure_setback
print "kgCO2e:", adu.kgCO2e
# ---------- end python ----------
panel_9 = Panel(python.out)
python_2 = GhPythonScript(adu=python.adu)  # -> out, adu, filename, site, size, footprint, height, num_stories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
# ---------- python_2: Python ----------
__author__ = "papep"
__version__ = "2022.01.26"

import rhinoscriptsyntax as rs

framed = {
    0:"2x4 Wood Studs", 
    1:"2x6 Wood Studs",
    2:"2x8 Wood Studs",
    3:"2x10 Wood Studs",
}

filename = adu.filename
site = adu.site
size = adu.size
footprint = adu.footprint
height = adu.height
num_stories = adu.num_stories
num_units = adu.num_units
inf_rate = adu.inf_rate
orientation = adu.orientation
WWR = adu.WWR
frame = framed[adu.frame]
polyiso_t = adu.polyiso_t
cellulose_t = adu.cellulose_t
rear_setback = adu.rear_setback
side_setback = adu.side_setback
structure_setback = adu.structure_setback
kgCO2e = adu.kgCO2e

print "filename:", adu.filename
print "site:", adu.site
print "size:", adu.size
print "footprint:", adu.footprint
print "height:", adu.height
print "num_stories:", adu.num_stories
print "num_units:", adu.num_units
print "inf_rate:", adu.inf_rate
print "orientation:", adu.orientation
print "wwr:", adu.WWR
print "frame:", frame
print "polyiso_t", adu.polyiso_t
print "cellulose_t:", adu.cellulose_t
print "setback:", adu.setback
print "rear_setback", adu.rear_setback
print "side_setback:", adu.side_setback
print "structure_setback:", adu.structure_setback
print "kgCO2e:", adu.kgCO2e

print"\n", adu.frame
# ---------- end python_2 ----------
panel_10 = Panel(python_2.out)
cluster = Cluster(
    B_2=python_2.polyiso_t,
    B=python_2.cellulose_t,
    num_stories=python_2.num_stories,
    num_units=python_2.num_units,
    adu=python_2.adu,
    rear_setback=python_2.rear_setback,
    side_setback=python_2.side_setback,
    G_2=python_2.num_stories,
    structure_setback=python_2.structure_setback,
    _1=python_2.height,
    A_2=python_2.height,
    A=python_2.footprint,
    G=python_2.site)  # -> constr_set, s_1, out, adu_2, E, R, G_3, s_0, R_2

brep = Brep(cluster.R_2)
crv = Curve(cluster.R)
cmyk = ColourCMYK(Cyan=0, Magenta=0, Yellow=0, Key=0)
material = CreateMaterial(Diffuse=cmyk, Specular=RGB(255, 255, 255), Emission=RGB(0, 0, 0), Transparency=0, Shine=0)
preview = CustomPreview(Geometry=[brep, crv], Material=material)

# ----
# surface area/volume
# lower the better
panel_11 = Panel(cluster.out)

# ---- group: Cluster
hb_model = HbModel(
    geo=cluster.R_2,
    epw_file=downloadepw.epw_file,
    G=python_2.orientation,
    name=cluster.s_1,
    folder=panel,
    write=run_energy_simulation,
    constr_set=cluster.constr_set,
    run=run_energy_simulation,
    infilt_per_exterior=python_2.inf_rate,
    adu=cluster.adu_2,
    _1=cluster.E,
    num_stories=python_2.num_stories,
    _2=[cluster.E, cluster.G_3],
    ratio=python_2.WWR,
    _3=cluster.s_0,
    num_units=python_2.num_units)  # -> adj_rooms, out, adu_2

# ---- group: visualization (continued)
vizbytype = HBVisualizeByType(hb_objs=hb_model.adj_rooms)  # -> walls, interior_walls, roofs, ceilings, exterior_floors, interior_floors, air_walls, apertures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; plug-in component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
lablefaces = HBLabelFaces(hb_objs=flatten(hb_model.adj_rooms), attribute=faceattr)  # -> label_text, base_pts, labels, wire_frame; plug-in component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
panel_12 = Panel(lablefaces.label_text)
data = Data(vizbytype.apertures)

# ----
panel_13 = Panel(hb_model.out)
write_csv = GhPythonScript(adu=hb_model.adu_2, location=panel, dir=panel_3)  # -> out
# ---------- write_csv: Python ----------
__author__ = "papep"
__version__ = "2022.01.26"

import rhinoscriptsyntax as rs
import os
import glob

# write csv
if adu.eui_kbtu != None:
    if adu.area_buildable >= adu.footprint:
        adu.write_csv()

# delete screenshot each simulation
path = os.path.join(location, dir)
files = glob.glob(path + '/*.bmp')
for f in files:
    try:
        os.unlink(f)
    except OSError as e:
        print("Error: %s : %s" % (f, e.strerror))

print "filepath:", adu.filepath
print "filename:", adu.filename
print "site:", adu.site
print "size:", adu.size
print "footprint:", adu.footprint
print "height:", adu.height
print "num_stories:", adu.num_stories
print "num_adiabatic:", adu.num_adiabatic
print "inf_rate:", adu.inf_rate
print "orientation:", adu.orientation
print "wwr:", adu.WWR
print "frame:", adu.frame
print "polyiso_t", adu.polyiso_t
print "cellulose_t:", adu.cellulose_t
print "setback:", adu.setback
print "rear_setback", adu.rear_setback
print "side_setback:", adu.side_setback
print "structure_setback:", adu.structure_setback
print "area_buildable:", adu.area_buildable
print "surf_area:", adu.surf_area
print "volume:", adu.volume
print "kgCO2e:", adu.kgCO2e
print "eui_kwh:", adu.eui_kwh
print "eui_kbtu:", adu.eui_kbtu
print "carbon:", adu.carbon
# ---------- end write_csv ----------
panel_14 = Panel(write_csv)

# ==== cluster HbModel
num_stories = ClusterInput()
num_units = ClusterInput()
python = GhPythonScript(num_stories=num_stories, num_units=num_units)  # -> out, a
# ---------- python: Python ----------
__author__ = "papep"
__version__ = "2022.02.07"

import rhinoscriptsyntax as rs

if num_stories == 1:
    if num_units == 1:
        a = 1
    elif num_units == 2:
        a = 3

if num_stories == 2:
    if num_units == 1:
        a = 2
# ---------- end python ----------

# ---- group: zone_program
bldgprograms = HBBuildingPrograms({"LargeOffice", "MediumOffice", "SmallOffice", "MidriseApartment", "HighriseApartment", "Retail", "StripMall", "PrimarySchool", "SecondarySchool", "SmallHotel", "LargeHotel", "Hospital", "Outpatient", "Laboratory", "Warehouse", "SuperMarket", "FullServiceRestaurant", "QuickServiceRestaurant", "Courthouse", "LargeDataCenterHighITE", "LargeDataCenterLowITE", "SmallDataCenterHighITE", "SmallDataCenterLowITE"}, selected="MidriseApartment")
searchprog = HBSearchPrograms(bldg_prog=bldgprograms, keywords="Apartment")  # -> room_prog; plug-in component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
list = ItemSelector(searchprog, {"2019::MidriseApartment::Apartment"}, selected="2019::MidriseApartment::Apartment")

# ----
_2 = ClusterInput()
_1 = ClusterInput()
_3 = ClusterInput()
name = ClusterInput()
constr_set = ClusterInput()
ratio = ClusterInput()
infilt_per_exterior = ClusterInput()
bldgprograms_2 = HBBuildingPrograms({"LargeOffice", "MediumOffice", "SmallOffice", "MidriseApartment", "HighriseApartment", "Retail", "StripMall", "PrimarySchool", "SecondarySchool", "SmallHotel", "LargeHotel", "Hospital", "Outpatient", "Laboratory", "Warehouse", "SuperMarket", "FullServiceRestaurant", "QuickServiceRestaurant", "Courthouse", "LargeDataCenterHighITE", "LargeDataCenterLowITE", "SmallDataCenterHighITE", "SmallDataCenterLowITE"}, selected="LargeOffice")
geo = ClusterInput()
doas = HBDOASHVACTemplates({"DOAS with fan coil chiller with boiler": "DOAS_FCU_Chiller_Boiler", "DOAS with fan coil chiller with central air source heat pump": "DOAS_FCU_Chiller_ASHP", "DOAS with fan coil chiller with district hot water": "DOAS_FCU_Chiller_DHW", "DOAS with fan coil chiller with baseboard electric": "DOAS_FCU_Chiller_ElectricBaseboard", "DOAS with fan coil chiller with gas unit heaters": "DOAS_FCU_Chiller_GasHeaters", "DOAS with fan coil chiller with no heat": "DOAS_FCU_Chiller", "DOAS with fan coil air-cooled chiller with boiler": "DOAS_FCU_ACChiller_Boiler", "DOAS with fan coil air-cooled chiller with central air source heat pump": "DOAS_FCU_ACChiller_ASHP", "DOAS with fan coil air-cooled chiller with district hot water": "DOAS_FCU_ACChiller_DHW", "DOAS with fan coil air-cooled chiller with baseboard electric": "DOAS_FCU_ACChiller_ElectricBaseboard", "DOAS with fan coil air-cooled chiller with gas unit heaters": "DOAS_FCU_ACChiller_GasHeaters", "DOAS with fan coil air-cooled chiller with no heat": "DOAS_FCU_ACChiller", "DOAS with fan coil district chilled water with boiler": "DOAS_FCU_DCW_Boiler", "DOAS with fan coil district chilled water with central air source heat pump": "DOAS_FCU_DCW_ASHP", "DOAS with fan coil district chilled water with district hot water": "DOAS_FCU_DCW_DHW", "DOAS with fan coil district chilled water with baseboard electric": "DOAS_FCU_DCW_ElectricBaseboard", "DOAS with fan coil district chilled water with gas unit heaters": "DOAS_FCU_DCW_GasHeaters", "DOAS with fan coil district chilled water with no heat": "DOAS_FCU_DCW", "DOAS with VRF": "DOAS_VRF", "DOAS with water source heat pumps fluid cooler with boiler": "DOAS_WSHP_FluidCooler_Boiler", "DOAS with water source heat pumps cooling tower with boiler": "DOAS_WSHP_CoolingTower_Boiler", "DOAS with water source heat pumps with ground source heat pump": "DOAS_WSHP_GSHP", "DOAS with water source heat pumps district chilled water with district hot water": "DOAS_WSHP_DCW_DHW"}, selected="DOAS with VRF")
# ask teresa about this
bldgvintages = HBBuildingVintages({"ASHRAE 90.1 2019  |  IECC 2021": "2019", "ASHRAE 90.1 2016  |  IECC 2018": "2016", "ASHRAE 90.1 2013  |  IECC 2015": "2013", "ASHRAE 90.1 2010  |  IECC 2012": "2010", "ASHRAE 90.1 2007  |  IECC 2009": "2007", "ASHRAE 90.1 2004  |  IECC 2006": "2004", "1980-2004 (CBECS)": "1980_2004", "Pre-1980 (CBECS)": "pre_1980"}, selected="ASHRAE 90.1 2019  |  IECC 2021")
number_slider = Slider(0.8, range=0..1)
G = ClusterInput()
epw_file = ClusterInput()
folder = ClusterInput()
write = ClusterInput()
run = ClusterInput()
adu = ClusterInput()

# ---- group: create hb model
filter = StreamFilter(Gate=python.a, Stream1=_1, Stream2=_2, Stream3=_3)
toggle = BooleanToggle(True)
shade = HBShade(geo=geo)  # -> report, shades; plug-in component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
clean = CleanTree(RemoveNulls=True, RemoveInvalid=True, RemoveEmpty=False, Tree=shade.shades)

# ----
intsolid = HBIntersectSolids(solids=flatten(filter), run=Toggle(True))  # -> int_solids; plug-in component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

# ---- group: create hb model (continued)
roomsolid = HBRoomFromSolid(geo=flatten(intsolid), name=name, constr_set=constr_set, program=list, conditioned=True)  # -> report, rooms; plug-in component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
flatten = FlattenTree(Tree=roomsolid.rooms, Path="{0}")
panel = Panel(roomsolid.report)
item = ListItem(List=flatten, Index=0, Wrap=True)
item_2 = ListItem(List=flatten, Index=Slider(3, range=0..10), Wrap=True)
filter_2 = StreamFilter(Gate=python.a, Stream1=roomsolid.rooms, Stream2=[item_2, item], Stream3=[item, item_2])
solveadj = HBSolveAdjacency(rooms=flatten(filter_2), adiabatic=toggle, run=toggle)  # -> report, adj_rooms; plug-in component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
aperturesbyratio = HBAperturesByRatio(hb_objs=flatten(solveadj.adj_rooms), ratio=ratio)  # -> report, hb_objs; plug-in component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
applyloadvals = HBApplyLoadValues(room_or_program=flatten(aperturesbyratio.hb_objs), infilt_per_exterior=infilt_per_exterior)  # -> report, mod_obj; plug-in component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
daylightcontrol = HBApplyDaylightControl(rooms=flatten(applyloadvals.mod_obj))  # -> report, rooms; plug-in component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

# ----
panel_2 = Panel(solveadj.report)
adj_rooms = ClusterOutput(solveadj.adj_rooms)
doashvac = HBDOASHVAC(rooms=flatten(daylightcontrol.rooms), system_type=doas, vintage=bldgvintages, dcv=Toggle(True))  # -> report, rooms; plug-in component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

# ---- group: create hb model (continued)
model = HBModel(rooms=flatten(doashvac.rooms), shades=flatten(clean))  # -> report, model; plug-in component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

# ---- group: run sim
simoutput = HBSimulationOutput(zone_energy_use=Toggle(True), gains_and_losses=Toggle(True))  # -> report, sim_output; plug-in component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
filter_3 = StreamFilter(
    Gate=G,
    Stream1=Slider(0, range=0..100),
    Stream2=Slider(180, range=0..1000),
    Stream3=Slider(90, range=0..270),
    Stream4=Slider(270, range=0..1000))
simpar = HBSimulationParameter(north=filter_3, output=simoutput.sim_output, timestep=6)  # -> sim_par; plug-in component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
modeltoosm = HBModelToOSM(model=model.model, epw_file=epw_file, sim_par=simpar, folder=folder, write=write, run=run)  # -> report, jsons, osw, osm, idf, sql, zsz, rdd, html; plug-in component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
panel_3 = Panel(modeltoosm.html)
roomenergyresult = HBReadRoomEnergyResult(sql=modeltoosm.sql)  # -> cooling, heating, lighting, electric_equip, gas_equip, process, hot_water, fan_electric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; plug-in component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
eui = HBEndUseIntensity(sql=modeltoosm.sql, ip=Toggle(False))  # -> eui, eui_end_use, end_uses, gross_floor; plug-in component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

# ----
panel_4 = Panel(modeltoosm.report)
eui_2 = HBEndUseIntensity(sql=modeltoosm.sql, ip=Toggle(True))  # -> eui, eui_end_use, end_uses, gross_floor; plug-in component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
python_2 = GhPythonScript(
    adu=adu,
    cool=roomenergyresult.cooling,
    heat=roomenergyresult.heating,
    light=roomenergyresult.lighting,
    eq=roomenergyresult.electric_equip,
    dhw=roomenergyresult.hot_water,
    eui_kwh=eui.eui,
    size_m2=eui.gross_floor)  # -> out, adu; inputs cool: list, heat: list, light: list, eq: list, dhw: list
# ---------- python_2: Python ----------
__author__ = "papep"
__version__ = "2022.02.07"

import rhinoscriptsyntax as rs

adu.add_eui_results(cool, heat, light, eq, dhw)
adu.calc_carbon(eui_kwh, size_m2)

print "kgCO2e:", adu.kgCO2e
print "eui_kwh:", adu.eui_kwh
print "eui_kbtu:", adu.eui_kbtu
print "carbon:", adu.carbon
# ---------- end python_2 ----------
panel_5 = Panel(python_2.out)
adu_2 = ClusterOutput(python_2.adu)
out = ClusterOutput(python_2.out)

# ==== cluster Cluster
rear_setback = ClusterInput()
side_setback = ClusterInput()
structure_setback = ClusterInput()
structure_setback_2 = Number(structure_setback)
rear_setback_2 = Number(rear_setback)
side_setback_2 = Number(side_setback)
G = ClusterInput()

# ---- group: site
pipeline = GeometryPipeline(
    GroupByLayer=False,
    GroupByType=False,
    IncludeHidden=True,
    IncludeLocked=True,
    LayerFilter="sites::1-infill_no-alley::existing",
    NameFilter="*",
    SublayerFiltering=True,
    TypeFilter=1073741848)
pipeline_2 = GeometryPipeline(
    GroupByLayer=False,
    GroupByType=False,
    IncludeHidden=True,
    IncludeLocked=True,
    LayerFilter="sites::3-corner_no-alley::context",
    NameFilter="*",
    SublayerFiltering=True,
    TypeFilter=1073741848)
pipeline_3 = GeometryPipeline(
    GroupByLayer=False,
    GroupByType=False,
    IncludeHidden=True,
    IncludeLocked=True,
    LayerFilter="sites::1-infill_no-alley::lot_line",
    NameFilter="*",
    SublayerFiltering=True,
    TypeFilter=4)
pipeline_4 = GeometryPipeline(
    GroupByLayer=False,
    GroupByType=False,
    IncludeHidden=True,
    IncludeLocked=True,
    LayerFilter="sites::1-infill_no-alley::context",
    NameFilter="*",
    SublayerFiltering=True,
    TypeFilter=1073741848)
pipeline_5 = GeometryPipeline(
    GroupByLayer=False,
    GroupByType=False,
    IncludeHidden=True,
    IncludeLocked=True,
    LayerFilter="sites::3-corner_no-alley::existing",
    NameFilter="*",
    SublayerFiltering=True,
    TypeFilter=1073741848)
pipeline_6 = GeometryPipeline(
    GroupByLayer=False,
    GroupByType=False,
    IncludeHidden=True,
    IncludeLocked=True,
    LayerFilter="sites::3-corner_no-alley::lot_line",
    NameFilter="*",
    SublayerFiltering=True,
    TypeFilter=4)
pipeline_7 = GeometryPipeline(
    GroupByLayer=False,
    GroupByType=False,
    IncludeHidden=True,
    IncludeLocked=True,
    LayerFilter="sites::0-infill_alley::existing",
    NameFilter="*",
    SublayerFiltering=True,
    TypeFilter=1073741848)
pipeline_8 = GeometryPipeline(
    GroupByLayer=False,
    GroupByType=False,
    IncludeHidden=True,
    IncludeLocked=True,
    LayerFilter="sites::2-corner_alley::existing",
    NameFilter="*",
    SublayerFiltering=True,
    TypeFilter=1073741848)
pipeline_9 = GeometryPipeline(
    GroupByLayer=False,
    GroupByType=False,
    IncludeHidden=True,
    IncludeLocked=True,
    LayerFilter="sites::0-infill_alley::lot_line",
    NameFilter="*",
    SublayerFiltering=True,
    TypeFilter=4)
pipeline_10 = GeometryPipeline(
    GroupByLayer=False,
    GroupByType=False,
    IncludeHidden=True,
    IncludeLocked=True,
    LayerFilter="sites::2-corner_alley::lot_line",
    NameFilter="*",
    SublayerFiltering=True,
    TypeFilter=4)
pipeline_11 = GeometryPipeline(
    GroupByLayer=False,
    GroupByType=False,
    IncludeHidden=True,
    IncludeLocked=True,
    LayerFilter="sites::0-infill_alley::context",
    NameFilter="*",
    SublayerFiltering=True,
    TypeFilter=1073741848)
pipeline_12 = GeometryPipeline(
    GroupByLayer=False,
    GroupByType=False,
    IncludeHidden=True,
    IncludeLocked=True,
    LayerFilter="sites::2-corner_alley::context",
    NameFilter="*",
    SublayerFiltering=True,
    TypeFilter=1073741848)
entwine = Entwine(Branch00=pipeline_2, Branch01=pipeline_6, Branch02=pipeline_5, FlattenInputs=True)
entwine_2 = Entwine(Branch00=pipeline_12, Branch01=pipeline_10, Branch02=pipeline_8, FlattenInputs=True)
entwine_3 = Entwine(Branch00=pipeline_11, Branch01=pipeline_9, Branch02=pipeline_7, FlattenInputs=True)
entwine_4 = Entwine(Branch00=pipeline_4, Branch01=pipeline_3, Branch02=pipeline, FlattenInputs=True)
filter = StreamFilter(Gate=G, Stream0=entwine_3, Stream1=entwine_4, Stream2=entwine_2, Stream3=entwine)
panel = Panel(filter)
bang = ExplodeTree(Data=filter)  # -> Branch0, Branch1, Branch2
entwine_5 = Entwine(Branch00=bang.Branch0, Branch01=bang.Branch2, FlattenInputs=True)  # -> flatten(Result)

# ---- group: buildable area on lot
explode = Explode(Curve=bang.Branch1, Recursive=True)  # -> Segments, Vertices
item = ListItem(List=explode.Segments, Index=Slider(0, range=0..3), Wrap=True)
midpt = CurveMiddle(Curve=item)
brep_cp = BrepClosestPoint(Point=midpt, Brep=bang.Branch2)  # -> Point, Normal, Distance
dist = Distance(PointA=brep_cp.Point, PointB=midpt)
item_2 = ListItem(List=explode.Segments, Index=Slider(1, range=0..3), Wrap=True)
item_3 = ListItem(List=explode.Segments, Index=Slider(3, range=0..3), Wrap=True)
subtraction = Subtraction(A=dist, B=structure_setback_2)
X = UnitX(Factor=side_setback_2)  # -> expr("-x", UnitVector)
X_2 = UnitX(Factor=side_setback_2)
Y = UnitY(Factor=subtraction)
Y_2 = UnitY(Factor=rear_setback_2)
move = Move(Geometry=item, Motion=Y)  # -> Geometry, Transform
move_2 = Move(Geometry=item_3, Motion=X_2)  # -> Geometry, Transform
move_3 = Move(Geometry=item_2, Motion=X)  # -> Geometry, Transform
move_4 = Move(Geometry=item, Motion=Y_2)  # -> Geometry, Transform
ptuvcrvs = IntersectCurves(CU=[move_2.Geometry, move.Geometry], CV=[move_3.Geometry, move_4.Geometry])  # -> flatten(Grid)
panel_2 = Panel(ptuvcrvs)
item_4 = ListItem(List=flatten(ptuvcrvs), Index=Slider(2, range=0..4), Wrap=True)
item_5 = ListItem(List=flatten(ptuvcrvs), Index=Slider(1, range=0..4), Wrap=True)
rec_2pt = Rectangle2Pt(Plane=PlaneXY(0, 0, 0), PointA=item_4, PointB=item_5, Radius=0)  # -> Rectangle, Length
area = Area(Geometry=rec_2pt.Rectangle)  # -> Area, Centroid
explode_2 = Explode(Curve=rec_2pt.Rectangle, Recursive=True)  # -> Segments, Vertices
panel_3 = Panel(rec_2pt.Rectangle)
panel_4 = Panel(area.Area)
item_6 = ListItem(List=explode_2.Segments, Index=Slider(0, range=0..3), Wrap=True)
item_7 = ListItem(List=explode_2.Segments, Index=Slider(1, range=0..3), Wrap=True)
len = Length(Curve=item_6)
len_2 = Length(Curve=item_7)
division = Division(A=len, B=len_2)

# ----
B = ClusterInput()
B_2 = ClusterInput()
multiplication = Multiplication(A=Slider(3.7, range=0..10), B=B)
multiplication_2 = Multiplication(A=Slider(7, range=0..10), B=B_2)
division_2 = Division(A=multiplication, B=5.67826)
division_3 = Division(A=multiplication_2, B=5.67826)
division_4 = Division(A=Slider(1, range=0..1), B=5.67826)
division_5 = Division(A="0.63", B=5.67826)
multiplication_3 = Multiplication(A=division_2, B="0.906")
opaquematnomass = HBOpaqueMaterialNoMass(name="ContExtInsulation", r_value=division_3)  # -> mat; plug-in component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
division_6 = Division(A=Slider(0.61, range=0..1), B=5.67826)
opaquemat = HBOpaqueMaterial(name="InteriorFinish", thickness="0.015875", conductivity="0.16", density="800", spec_heat="109")  # -> mat; plug-in component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
opaquematnomass_2 = HBOpaqueMaterialNoMass(name="AirGap", r_value=division_4)  # -> flatten(mat); plug-in component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
opaquematnomass_3 = HBOpaqueMaterialNoMass(name="1/2\" Plywood", r_value=division_5)  # -> mat; plug-in component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
opaquematnomass_4 = HBOpaqueMaterialNoMass(name="IntInsulation", r_value=multiplication_3)  # -> mat; plug-in component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
opaquematnomass_5 = HBOpaqueMaterialNoMass(name="FacadeCladding", r_value=division_6)  # -> flatten(mat); plug-in component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
R = ClusterOutput(rec_2pt.Rectangle)
R_2 = ClusterOutput(entwine_5)
searchmats = HBSearchMaterials(keywords="air")  # -> opaque_mats, window_mats; plug-in component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
searchmats_2 = HBSearchMaterials(keywords="carpet")  # -> opaque_mats, window_mats; plug-in component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
searchmats_3 = HBSearchMaterials(keywords="gypsum")  # -> opaque_mats, window_mats; plug-in component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
clean = CleanTree(
    RemoveNulls=True,
    RemoveInvalid=True,
    RemoveEmpty=False,
    Tree=flatten([opaquematnomass_5, opaquematnomass_2, opaquematnomass, opaquematnomass_3, opaquematnomass_4, opaquemat]))
multiplication_4 = Multiplication(B=5.67826)
list = ItemSelector(
    searchmats_3.opaque_mats,
    {"1/2 in. Gypsum Board", "1/2IN Gypsum", "5/8 in. Gypsum Board", "G01 13mm gypsum board", "G01a 19mm gypsum board", "Generic Gypsum Board", "Gypsum Board - 1/2 in. CBES", "Gypsum Or Plaster Board - 3/8 in.", "NACM_Gypsum Board 5/8in"}, selected="1/2 in. Gypsum Board")
list_2 = ItemSelector(
    searchmats.opaque_mats,
    {"F04 Wall air space resistance", "F05 Ceiling air space resistance", "Generic Ceiling Air Gap", "Generic Wall Air Gap", "Typical Air Wall"}, selected="F04 Wall air space resistance")
list_3 = ItemSelector(
    searchmats_2.opaque_mats,
    {"CP02 CARPET PAD", "Carpet - 3/4 in. CBES", "NACM_Carpet 3/4in", "Typical Carpet Pad"}, selected="CP02 CARPET PAD")
panel_5 = Panel("2.2712")
opaqueconstr = HBOpaqueConstruction(name="ExteriorWall", materials=clean)  # -> constr; plug-in component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

A = ClusterInput()
consarearec = ConstrainedAreaRectangle(Plane=PlaneXY(0, 0, 0), Area=A, FactorX=division, FactorY=Slider(1, range=0..1))  # -> Rectangle, DimensionX, DimensionY
area_2 = Area(Geometry=consarearec.Rectangle)  # -> Area, Centroid
panel_6 = Panel(area_2.Area)
move2pt = MoveToPoint(Geometry=consarearec.Rectangle, PointA=area_2.Centroid, PointB=area.Centroid)  # -> Moved, Vector, Transform
A_2 = ClusterInput()
scale_nu = ScaleNU(Geometry=move2pt.Moved, Plane=PlaneXY(0, 0, 0), ScaleX=Slider(0.5, range=0..1), ScaleY=1, ScaleZ=1)  # -> Geometry, Transform
scale_nu_2 = ScaleNU(Geometry=move2pt.Moved, Plane=PlaneXY(0, 0, 0), ScaleX=1, ScaleY=Slider(0.5, range=0..1), ScaleZ=1)  # -> Geometry, Transform
division_7 = Division(A=A_2, B=Slider(2, range=0..10))
G_2 = ClusterInput()
_1 = ClusterInput()
debrep = DeconstructBrep(Brep=scale_nu.Geometry)  # -> Faces, Edges, Vertices
debrep_2 = DeconstructBrep(Brep=scale_nu_2.Geometry)  # -> Faces, Edges, Vertices
debrep_3 = DeconstructBrep(Brep=move2pt.Moved)  # -> Faces, Edges, Vertices
filter_2 = StreamFilter(Gate=G_2, Stream1=_1, Stream2=division_7)
item_8 = ListItem(List=debrep.Edges, Index=1, Wrap=True)
item_9 = ListItem(List=debrep_2.Edges, Index=2, Wrap=True)
item_10 = ListItem(List=debrep.Edges, Index=2, Wrap=True)
item_11 = ListItem(List=debrep_2.Edges, Index=1, Wrap=True)
boundary = BoundarySurfaces(FloorCrvs=debrep_3.Edges)  # -> simplify(Surfaces)
Z = UnitZ(Factor=filter_2)
len_3 = Length(Curve=item_10)
len_4 = Length(Curve=item_11)
midpt_2 = CurveMiddle(Curve=item_8)
midpt_3 = CurveMiddle(Curve=item_9)
move2pt_2 = MoveToPoint(Geometry=scale_nu.Geometry, PointA=midpt_2, PointB=area.Centroid)  # -> Moved, Vector, Transform
move2pt_3 = MoveToPoint(Geometry=scale_nu_2.Geometry, PointA=midpt_3, PointB=area.Centroid)  # -> Moved, Vector, Transform
X_3 = UnitX(Factor=len_3)
Y_3 = UnitY(Factor=len_4)
item_12 = ListItem(List=debrep_3.Edges, Index=2, Wrap=True)
item_13 = ListItem(List=debrep_3.Edges, Index=1, Wrap=True)
move_5 = Move(Geometry=move2pt_2.Moved, Motion=X_3)  # -> Geometry, Transform
move_6 = Move(Geometry=move2pt_3.Moved, Motion=Y_3)  # -> Geometry, Transform
extr = Extrude(Base=boundary, Direction=Z)
len_5 = Length(Curve=item_12)
len_6 = Length(Curve=item_13)
extr_2 = Extrude(Base=move_5.Geometry, Direction=Z)
extr_3 = Extrude(Base=move2pt_2.Moved, Direction=Z)
extr_4 = Extrude(Base=move_6.Geometry, Direction=Z)
extr_5 = Extrude(Base=move2pt_3.Moved, Direction=Z)
E = ClusterOutput(extr)
python = GhPythonScript(x=len_5, y=len_6)  # -> out, a
# ---------- python: Python ----------
__author__ = "papep"
__version__ = "2022.02.07"

import rhinoscriptsyntax as rs

if x >= y:
    a = 0
else:
    a = 1
# ---------- end python ----------
cap = CapHoles(Brep=extr_3)
cap_2 = CapHoles(Brep=extr_5)
cap_3 = CapHoles(Brep=extr_2)
cap_4 = CapHoles(Brep=extr_4)
move_7 = Move(Geometry=extr, Motion=Z)  # -> Geometry, Transform
G_3 = ClusterOutput(move_7.Geometry)
sunion = SolidUnion(Breps=[cap, cap_3])
sunion_2 = SolidUnion(Breps=[cap_2, cap_4])
filter_3 = StreamFilter(Gate=python.a, Stream0=sunion, Stream1=sunion_2)
sunion_3 = SolidUnion(Breps=[move_7.Geometry, extr])
filter_4 = StreamFilter(Gate=python.a, Stream0=[cap, cap_3], Stream1=[cap_2, cap_4])
volume = Volume(Geometry=sunion_3)  # -> Volume, Centroid
s_0 = ClusterOutput(filter_4)
volume_2 = Volume(Geometry=extr)  # -> Volume, Centroid
area_3 = Area(Geometry=sunion_3)  # -> Area, Centroid
area_4 = Area(Geometry=extr)  # -> Area, Centroid
area_5 = Area(Geometry=filter_3)  # -> Area, Centroid
volume_3 = Volume(Geometry=filter_3)  # -> Volume, Centroid

windowmat = HBWindowMaterial(name="aluminum", u_factor=flatten("1.98"), shgc=flatten(0.25), t_vis=flatten("0.63"))  # -> mat; plug-in component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
decnstrconstr = HBDeconstructConstruction(constr=opaqueconstr)  # -> materials, layers, r_val_si, r_val_ip, u_fac_si, u_fac_ip, t_sol, t_vis; plug-in component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
panel_7 = Panel(decnstrconstr.materials)
opaqueconstr_2 = HBOpaqueConstruction(name="Floor_Residential", materials=[list, list_2, list_3])  # -> constr; plug-in component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
opaqueconstr_3 = HBOpaqueConstruction(name="Ceiling_Residential", materials=[list_3, list_2, list])  # -> constr; plug-in component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
panel_8 = Panel([opaqueconstr_3, opaqueconstr_2])
windowconstr = HBWindowConstruction(name="NGlass", materials=flatten(windowmat))  # -> constr; plug-in component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
one_over_x = OneOverX(Value=decnstrconstr.u_fac_ip)
searchconstrset = HBSearchConstructionSets()  # -> constr_sets; plug-in component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
panel_9 = Panel([opaqueconstr, one_over_x])
list_4 = ItemSelector(
    searchconstrset,
    {"1980_2004::ClimateZone1::Mass", "1980_2004::ClimateZone1::Metal Building", "1980_2004::ClimateZone1::SteelFramed", "1980_2004::ClimateZone1::WoodFramed", "1980_2004::ClimateZone2::Mass", "1980_2004::ClimateZone2::Metal Building"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}, selected="2019::ClimateZone4::WoodFramed")
interiorsubset = HBInteriorConstructionSubset(ceiling=opaqueconstr_3, interior_floor=opaqueconstr_2)  # -> interior_set; plug-in component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
exteriorsubset = HBExteriorConstructionSubset(exterior_wall=opaqueconstr, exposed_floor=opaqueconstr_2)  # -> exterior_set; plug-in component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
subfacesubset = HBSubfaceSubset(window=windowconstr, skylight=windowconstr, operable=windowconstr)  # -> subface_set; plug-in component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
groundsubset = HBGroundConstructionSubset(ground_floor=opaqueconstr_2)  # -> ground_set; plug-in component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
panel_10 = Panel(exteriorsubset)
constructionset = HBConstructionSet(
    name="dadu_assembly",
    base_constr_set=list_4,
    exterior_subset=exteriorsubset,
    ground_subset=groundsubset,
    interior_subset=interiorsubset,
    subface_subset=subfacesubset)  # -> constr_set; plug-in component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
decnstrconstrset = HBDeconstructConstructionSet(constr_set=list_4)  # -> exterior_wall, exterior_roof, exposed_floor, ground_wall, ground_roof, ground_floor, window, skylight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; plug-in component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
constr_set = ClusterOutput(constructionset)
decnstrconstr_2 = HBDeconstructConstruction(constr=decnstrconstrset.exposed_floor)  # -> materials, layers, r_val_si, r_val_ip, u_fac_si, u_fac_ip, shgc, t_sol, t_vis; plug-in component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
num_stories = ClusterInput()
num_units = ClusterInput()
panel_11 = Panel(decnstrconstr_2.materials)
python_2 = GhPythonScript(num_stories=num_stories, num_units=num_units)  # -> out, a; same code as python

# ---- group: znames
entwine_6 = Entwine(Branch00="zone1", Branch01="zone2", FlattenInputs=True)
filter_5 = StreamFilter(Gate=python_2.a, Stream1="zone1", Stream2=entwine_6, Stream3=entwine_6)

# ----
s_1 = ClusterOutput(filter_5)
filter_6 = StreamFilter(
    Gate=python_2.a,
    Stream1=[volume_2.Volume, area_4.Area],
    Stream2=[volume.Volume, area_3.Area],
    Stream3=[volume_3.Volume, area_5.Area])
item_14 = ListItem(List=filter_6, Index=0, Wrap=True)
item_15 = ListItem(List=filter_6, Index=1, Wrap=True)
adu = ClusterInput()
python_3 = GhPythonScript(adu=adu, assembly_r=one_over_x, volume=item_14, surf_area=item_15, area_buildable=area.Area)  # -> out, adu
# ---------- python_3: Python ----------
__author__ = "papep"
__version__ = "2022.01.25"

import rhinoscriptsyntax as rs

if adu.num_stories  == 2 or adu.num_units == 2:
    adu.num_adiabatic = 2
else:
    adu.num_adiabatic = 1

adu.assembly_r      = assembly_r
adu.volume          = volume
adu.surf_area       = surf_area
adu.surf_vol_ratio  = surf_area / volume
adu.area_buildable  = area_buildable

print "num_adiabatic:", adu.num_adiabatic
print "assembly_r:", adu.assembly_r
print "volume:", adu.volume
print "surf_area:", adu.surf_area
print "surf_vol_ratio:", adu.surf_vol_ratio
print "area_buildable:", adu.area_buildable
# ---------- end python_3 ----------
out = ClusterOutput(python_3.out)
adu_2 = ClusterOutput(python_3.adu)
