# Grasshopper definition sim_gen_confirmation tests.gh (Grasshopper 1.0.7)
# plug-ins: Human, Bifocals

toggle = BooleanToggle(False)
python = GhPythonScript(material_name="Polyiso")  # -> out, a
# ---------- python: Python ----------
__author__ = "preston"

import rhinoscriptsyntax as rs
import sys

studiopath = "/Users/preston/Documents/GitHub/studio2021/src"
sys.path.append(studiopath)
import studio2021

from studio2021.functions import read_materials

material = read_materials(material_name)

print(material.keys())

r_per_in = material["r_per_in"]
embodied_carbon = material["embodied_carbon"]
type = material["mtype"]
density = material["density"]
sp_heat = material["sp_heat"]
thickness_in = material["thickness_in"]
thickness_m = material["thickness_m"]
r_value = material["r_value"]
conductivity = material["conductivity"]
# ---------- end python ----------
importmaterial = GhPythonScript(material_name="Cellulose")  # -> r_per_in, embodied_carbon, type, thickness_in, thickness_m, conductivity, density, sp_heat, r_value; same code as python
importmaterial_2 = GhPythonScript(material_name="Polyiso")  # -> r_per_in, embodied_carbon, type, thickness_in, thickness_m, conductivity, density, sp_heat, r_value; same code as python
panel = Panel(python.out)
number_slider = Slider(6, range=0..10)
multiplication = Multiplication(A=importmaterial.r_per_in, B=Slider(9.25, range=0..10))
importmaterial_3 = GhPythonScript(material_name="Gyp")  # -> r_per_in, embodied_carbon, type, thickness_in, thickness_m, conductivity, density, sp_heat, r_value; same code as python
brep = Brep([<brep referenced from the Rhino model> x4])
crv = Curve([<curve referenced from the Rhino model> x2])
importmaterial_4 = GhPythonScript(material_name="Aluminum")  # -> r_per_in, embodied_carbon, type, thickness_in, thickness_m, conductivity, density, sp_heat, r_value; same code as python
multiplication_2 = Multiplication(A=importmaterial_2.r_per_in, B=Slider(0, range=0..1))
division = Division(A=multiplication, B=5.67826)
Z = UnitZ(Factor=Slider(10, range=0..10))
extr = Extrude(Base=crv, Direction=Z)
division_2 = Division(A=multiplication_2, B=5.67826)
division_3 = Division(A=Slider(1, range=0..1), B=5.67826)
division_4 = Division(A="0.63", B=5.67826)
multiplication_3 = Multiplication(A=division, B="0.906")
cap = CapHoles(Brep=extr)
opaquematnomass = HBOpaqueMaterialNoMass(name="ContExtInsulation", r_value=division_2)  # -> mat; plug-in component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
division_5 = Division(A=importmaterial_4.r_value, B=5.67826)

# ---- group: zone_program
bldgprograms = HBBuildingPrograms({"LargeOffice", "MediumOffice", "SmallOffice", "MidriseApartment", "HighriseApartment", "Retail", "StripMall", "PrimarySchool", "SecondarySchool", "SmallHotel", "LargeHotel", "Hospital", "Outpatient", "Laboratory", "Warehouse", "SuperMarket", "FullServiceRestaurant", "QuickServiceRestaurant", "Courthouse", "LargeDataCenterHighITE", "LargeDataCenterLowITE", "SmallDataCenterHighITE", "SmallDataCenterLowITE"}, selected="MidriseApartment")
searchprog = HBSearchPrograms(bldg_prog=bldgprograms, keywords="Apartment")  # -> room_prog; plug-in component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
list = ItemSelector(searchprog, {"2019::MidriseApartment::Apartment"}, selected="2019::MidriseApartment::Apartment")

# ----
opaquemat = HBOpaqueMaterial(
    name="InteriorFinish",
    thickness=importmaterial_3.thickness_m,
    conductivity=importmaterial_3.conductivity,
    density=importmaterial_3.density,
    spec_heat=importmaterial_3.sp_heat)  # -> mat; plug-in component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
opaquematnomass_2 = HBOpaqueMaterialNoMass(name="AirGap", r_value=division_3)  # -> flatten(mat); plug-in component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
opaquematnomass_3 = HBOpaqueMaterialNoMass(name="1/2\" Plywood", r_value=division_4)  # -> mat; plug-in component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
opaquematnomass_4 = HBOpaqueMaterialNoMass(name="IntInsulation", r_value=multiplication_3)  # -> mat; plug-in component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
opaquematnomass_5 = HBOpaqueMaterialNoMass(name="FacadeCladding", r_value=division_5)  # -> flatten(mat); plug-in component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
intsolid = HBIntersectSolids(solids=flatten(cap), run=Toggle(True))  # -> int_solids; plug-in component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
searchmats = HBSearchMaterials(keywords="air")  # -> opaque_mats, window_mats; plug-in component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
searchmats_2 = HBSearchMaterials(keywords="carpet")  # -> opaque_mats, window_mats; plug-in component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
searchmats_3 = HBSearchMaterials(keywords="gypsum")  # -> opaque_mats, window_mats; plug-in component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
faceattr = HBFaceAttributes({"Display Name": "display_name", "Simulation Name (Identifier)": "identifier", "Boundary Condition": "boundary_condition", "Has Parent": "has_parent", "Parent": "parent", "Area": "area", "Perimeter": "perimeter", "Face Type": "type", "Aperture Is Operable": "is_operable", "Door Is Glass": "is_glass"}, selected="Boundary Condition")
clean = CleanTree(
    RemoveNulls=True,
    RemoveInvalid=True,
    RemoveEmpty=False,
    Tree=flatten([opaquematnomass_5, opaquematnomass_2, opaquematnomass, opaquematnomass_3, opaquematnomass_4, opaquemat]))
multiplication_4 = Multiplication(B=5.67826)
list_2 = ItemSelector(
    searchmats_3.opaque_mats,
    {"1/2 in. Gypsum Board", "1/2IN Gypsum", "5/8 in. Gypsum Board", "G01 13mm gypsum board", "G01a 19mm gypsum board", "Generic Gypsum Board", "Gypsum Board - 1/2 in. CBES", "Gypsum Or Plaster Board - 3/8 in.", "NACM_Gypsum Board 5/8in"}, selected="1/2 in. Gypsum Board")
list_3 = ItemSelector(
    searchmats.opaque_mats,
    {"F04 Wall air space resistance", "F05 Ceiling air space resistance", "Generic Ceiling Air Gap", "Generic Wall Air Gap", "Typical Air Wall"}, selected="F04 Wall air space resistance")
list_4 = ItemSelector(
    searchmats_2.opaque_mats,
    {"CP02 CARPET PAD", "Carpet - 3/4 in. CBES", "NACM_Carpet 3/4in", "Typical Carpet Pad"}, selected="CP02 CARPET PAD")
panel_2 = Panel("2.2712")
toggle_2 = BooleanToggle(True)
opaqueconstr = HBOpaqueConstruction(name="ExteriorWall", materials=clean)  # -> constr; plug-in component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
windowmat = HBWindowMaterial(name="aluminum", u_factor=flatten("1.98"), shgc=flatten(0.25), t_vis=flatten("0.63"))  # -> mat; plug-in component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
decnstrconstr = HBDeconstructConstruction(constr=opaqueconstr)  # -> materials, layers, r_val_si, r_val_ip, u_fac_si, u_fac_ip, t_sol, t_vis; plug-in component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
panel_3 = Panel(decnstrconstr.materials)
opaqueconstr_2 = HBOpaqueConstruction(name="Floor_Residential", materials=[list_2, list_3, list_4])  # -> constr; plug-in component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
opaqueconstr_3 = HBOpaqueConstruction(name="Ceiling_Residential", materials=[list_4, list_3, list_2])  # -> constr; plug-in component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
panel_4 = Panel([opaqueconstr_3, opaqueconstr_2])
windowconstr = HBWindowConstruction(name="NGlass", materials=flatten(windowmat))  # -> constr; plug-in component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
one_over_x = OneOverX(Value=decnstrconstr.u_fac_ip)
list_5 = ItemSelector([".00015", ".00059"], {".00015", ".00059"}, selected=".00059")
searchconstrset = HBSearchConstructionSets()  # -> constr_sets; plug-in component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
panel_5 = Panel([opaqueconstr, one_over_x])
list_6 = ItemSelector(
    searchconstrset,
    {"1980_2004::ClimateZone1::Mass", "1980_2004::ClimateZone1::Metal Building", "1980_2004::ClimateZone1::SteelFramed", "1980_2004::ClimateZone1::WoodFramed", "1980_2004::ClimateZone2::Mass", "1980_2004::ClimateZone2::Metal Building"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}, selected="2019::ClimateZone4::WoodFramed")
interiorsubset = HBInteriorConstructionSubset(ceiling=opaqueconstr_3, interior_floor=opaqueconstr_2)  # -> interior_set; plug-in component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
exteriorsubset = HBExteriorConstructionSubset(exterior_wall=opaqueconstr, exposed_floor=opaqueconstr_2)  # -> exterior_set; plug-in component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
subfacesubset = HBSubfaceSubset(window=windowconstr, skylight=windowconstr, operable=windowconstr)  # -> subface_set; plug-in component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
groundsubset = HBGroundConstructionSubset(ground_floor=opaqueconstr_2)  # -> ground_set; plug-in component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
shade = HBShade(geo=brep)  # -> report, shades; plug-in component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
panel_6 = Panel(exteriorsubset)
constructionset = HBConstructionSet(
    name="dadu_assembly",
    base_constr_set=list_6,
    exterior_subset=exteriorsubset,
    ground_subset=groundsubset,
    interior_subset=interiorsubset,
    subface_subset=subfacesubset)  # -> constr_set; plug-in component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
roomsolid = HBRoomFromSolid(geo=flatten(intsolid), name="test", constr_set=constructionset, program=list, conditioned=True)  # -> report, rooms; plug-in component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
panel_7 = Panel(roomsolid.report)
solveadj = HBSolveAdjacency(rooms=flatten(roomsolid.rooms), adiabatic=toggle_2, run=toggle_2)  # -> report, adj_rooms; plug-in component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
panel_8 = Panel(solveadj.report)
aperturesbyratio = HBAperturesByRatio(hb_objs=flatten(solveadj.adj_rooms), ratio=Slider(0.6, range=0..1))  # -> report, hb_objs; plug-in component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
applyloadvals = HBApplyLoadValues(room_or_program=flatten(aperturesbyratio.hb_objs), infilt_per_exterior=list_5)  # -> report, mod_obj; plug-in component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
daylightcontrol = HBApplyDaylightControl(rooms=flatten(applyloadvals.mod_obj))  # -> report, rooms; plug-in component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
vizbytype = HBVisualizeByType(hb_objs=daylightcontrol.rooms)  # -> walls, interior_walls, roofs, ceilings, exterior_floors, interior_floors, air_walls, apertures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; plug-in component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
lablefaces = HBLabelFaces(hb_objs=flatten(daylightcontrol.rooms), attribute=faceattr)  # -> label_text, base_pts, labels, wire_frame; plug-in component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
panel_9 = Panel(lablefaces.label_text)
data = Data(vizbytype.apertures)
clean_2 = CleanTree(RemoveNulls=True, RemoveInvalid=True, RemoveEmpty=False, Tree=shade.shades)
decnstrconstrset = HBDeconstructConstructionSet(constr_set=list_6)  # -> exterior_wall, exterior_roof, exposed_floor, ground_wall, ground_roof, ground_floor, window, skylight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; plug-in component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
model = HBModel(rooms=flatten(daylightcontrol.rooms), shades=flatten(clean_2))  # -> report, model; plug-in component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
decnstrconstr_2 = HBDeconstructConstruction(constr=decnstrconstrset.exposed_floor)  # -> materials, layers, r_val_si, r_val_ip, u_fac_si, u_fac_ip, shgc, t_sol, t_vis; plug-in component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
simoutput = HBSimulationOutput(zone_energy_use=Toggle(True), gains_and_losses=Toggle(True))  # -> report, sim_output; plug-in component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
panel_10 = Panel(decnstrconstr_2.materials)
list_7 = ItemSelector(
    [Slider(0, range=0..100), Slider(180, range=0..1000), Slider(270, range=0..270), Slider(90, range=0..1000)],
    {"0", "180", "270", "90"}, selected="90")
simpar = HBSimulationParameter(north=list_7, output=simoutput.sim_output, timestep=6)  # -> sim_par; plug-in component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
cities = GhPythonScript(city=0)  # -> out, city, weather_file, kgCo2e_kwh
# ---------- cities: Python ----------
__author__ = "tmendeze"

import rhinoscriptsyntax as rs

from studio2021.functions import city_carbon
reload(city_carbon)
from studio2021.functions.city_carbon import city_EUI
from studio2021.functions.city_carbon import weather

cities = {0: 'Seattle'}

city = cities[city]
kgCo2e_kwh = city_EUI(city)['kg/kWh']
weather_file = weather(city)
# ---------- end cities ----------
panel_11 = Panel(cities.city)
modeltoosm = HBModelToOSM(
    model=model.model,
    epw_file=cities.weather_file,
    sim_par=simpar,
    folder="C:\Users\papep\Documents\GitHub\msdc-thesis\tool\temp",
    write=toggle,
    run=toggle)  # -> report, jsons, osw, osm, idf, sql, zsz, rdd, html; plug-in component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
roomenergyresult = HBReadRoomEnergyResult(sql=modeltoosm.sql)  # -> cooling, heating, lighting, electric_equip, gas_equip, process, hot_water, fan_electric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; plug-in component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
toip = LBToIP(data_si=roomenergyresult.lighting)  # -> data_ip; plug-in component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
toip_2 = LBToIP(data_si=roomenergyresult.cooling)  # -> data_ip; plug-in component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
toip_3 = LBToIP(data_si=roomenergyresult.electric_equip)  # -> data_ip; plug-in component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
toip_4 = LBToIP(data_si=roomenergyresult.hot_water)  # -> data_ip; plug-in component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
toip_5 = LBToIP(data_si=roomenergyresult.heating)  # -> data_ip; plug-in component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
xdata = LBDeconstructData(data=toip)  # -> header, simplify(flatten(values)); plug-in component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
xdata_2 = LBDeconstructData(data=toip_2)  # -> header, simplify(flatten(values)); plug-in component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
xdata_3 = LBDeconstructData(data=toip_3)  # -> header, simplify(flatten(values)); plug-in component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
xdata_4 = LBDeconstructData(data=toip_4)  # -> header, simplify(flatten(values)); plug-in component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
xdata_5 = LBDeconstructData(data=toip_5)  # -> header, simplify(flatten(values)); plug-in component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
python_2 = GhPythonScript(values=xdata.values)  # -> out, a
# ---------- python_2: Python ----------
__author__ = "papep"
__version__ = "2022.02.10"

import rhinoscriptsyntax as rs

if values != 0:
    a = values

#print len(values)
# ---------- end python_2 ----------
python_3 = GhPythonScript(values=xdata_2.values)  # -> out, a; same code as python_2
python_4 = GhPythonScript(values=xdata_3.values)  # -> out, a; same code as python_2
python_5 = GhPythonScript(values=xdata_4.values)  # -> out, a; same code as python_2
python_6 = GhPythonScript(values=xdata_5.values)  # -> out, a; same code as python_2
clean_3 = CleanTree(RemoveNulls=True, RemoveInvalid=True, RemoveEmpty=False, Tree=python_2.a)
clean_4 = CleanTree(RemoveNulls=True, RemoveInvalid=True, RemoveEmpty=False, Tree=python_3.a)
clean_5 = CleanTree(RemoveNulls=True, RemoveInvalid=True, RemoveEmpty=False, Tree=python_4.a)
clean_6 = CleanTree(RemoveNulls=True, RemoveInvalid=True, RemoveEmpty=False, Tree=python_5.a)
clean_7 = CleanTree(RemoveNulls=True, RemoveInvalid=True, RemoveEmpty=False, Tree=python_6.a)
ma = MassAddition(Input=clean_3)  # -> Result, PartialResults
ma_2 = MassAddition(Input=clean_4)  # -> Result, PartialResults
ma_3 = MassAddition(Input=clean_5)  # -> Result, PartialResults
ma_4 = MassAddition(Input=clean_6)  # -> Result, PartialResults
ma_5 = MassAddition(Input=clean_7)  # -> Result, PartialResults
panel_12 = Panel(modeltoosm.html)
eui = HBEndUseIntensity(sql=modeltoosm.sql, ip=Toggle(True))  # -> eui, eui_end_use, end_uses, gross_floor; plug-in component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
panel_13 = Panel([eui.eui, eui.gross_floor])
panel_14 = Panel([eui.end_uses, eui.eui_end_use])
division_6 = Division(A=ma.Result, B=eui.gross_floor)
division_7 = Division(A=ma_2.Result, B=eui.gross_floor)
division_8 = Division(A=ma_3.Result, B=eui.gross_floor)
division_9 = Division(A=ma_4.Result, B=eui.gross_floor)
division_10 = Division(A=ma_5.Result, B=eui.gross_floor)
panel_15 = Panel(division_7)
panel_16 = Panel(division_6)
panel_17 = Panel(division_8)
panel_18 = Panel(division_9)
panel_19 = Panel(division_10)
ma_6 = MassAddition(Input=[division_7, division_10, division_6, division_8, division_9])  # -> Result, PartialResults
panel_20 = Panel(ma_6.Result)
eui_2 = HBEndUseIntensity(sql=modeltoosm.sql, ip=Toggle(False))  # -> eui, eui_end_use, end_uses, gross_floor; plug-in component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
panel_21 = Panel([eui_2.eui, eui_2.gross_floor])
panel_22 = Panel([eui_2.eui_end_use, eui_2.end_uses])
division_11 = Division(A=eui_2.eui, B=eui.eui)
